# Grasshopper definition parametric_curves.gh (Grasshopper 0.9.76)
# plug-ins: Python Interpreter

# ---- group: EVALUATE CURVE
# NON-PARAMETRIC CURVES
crv = Curve(<curve referenced from the Rhino model>)
python = PythonScript(crv=crv, n=Slider(100, range=0..100))  # -> out, points; inputs crv: Curve, n: Int32
# ---------- python: Python ----------
import Rhino.Geometry as rg

minD, maxD = crv.Domain
print minD
print maxD
step = (maxD)/(n-1)
#print step 
points = []
for i in range(n):
    t = minD + (i*step)
    pt = crv.PointAt(t)
    points.append(pt)
# ---------- end python ----------
pt = Point(python.points)

# ----
pt_2 = Point(Point(0, 0, 0))

# ---- group: LISSAJOUS CURVE
# PARAMETRIC CURVES
a = Slider(4, range=0..10)
b = Slider(3, range=0..10)
python_2 = PythonScript(a=a, b=b, loc=pt_2)  # -> out, pts; inputs loc: Point3d
# ---------- python_2: Python ----------
import math
import Rhino.Geometry as rg

pts = []
for t in range(-180,180):
    x = 200*math.sin(a*math.radians(t)+ math.radians(90)) + loc.X
    y = 200*math.sin(b*math.radians(t)) + loc.Y
    pt = rg.Point3d(x,y,0)
    pts.append(pt)
pts.append(pts[0])
# ---------- end python_2 ----------
pt_3 = Point(python_2.pts)
intcrv = Interpolate(Vertices=pt_3, Degree=3, Periodic=False, KnotStyle=1)  # -> Curve, Length, Domain

# ----
len = Length(Curve=crv)
panel = Panel(len)

# ---- group: EPICYCLOID_1
k = Slider(6, range=0..20)
k_2 = Slider(31, range=0..40)
pt_4 = Point(Point(756.0926036, 0, 0))
python_3 = PythonScript(r=k, k=k_2, loc=pt_4)  # -> out, pts; inputs loc: Point3d
# ---------- python_3: Python ----------
import math
import Rhino.Geometry as rg
from math import *

pts = []
maximum_ = 28*180
for t in range(180,maximum_):
    x = r*(k+1)*math.cos(math.radians(t)) - r*math.cos((k+1)*math.radians(t)) + loc.X
    y = r*(k+1)*math.sin(math.radians(t)) - r*math.sin((k+1)*math.radians(t)) + loc.Y
    pt = rg.Point3d(x,y,0)
    pts.append(pt)
# ---------- end python_3 ----------
pt_5 = Point(python_3.pts)
intcrv_2 = Interpolate(Vertices=pt_5, Degree=3, Periodic=False, KnotStyle=1)  # -> Curve, Length, Domain

# ---- group: CURVE MID POINT
crv_2 = Curve(<curve referenced from the Rhino model>)
python_4 = PythonScript(crv=crv_2)  # -> out, mid_point; inputs crv: Curve
# ---------- python_4: Python ----------
import Rhino.Geometry as rg

minD, maxD = crv.Domain
print minD
print maxD

mid_param = maxD/2
mid_point = crv.PointAt(mid_param)
# ---------- end python_4 ----------
pt_6 = Point(python_4.mid_point)

# ---- group: DIVIDE CURVE
crv_3 = Curve(<curve referenced from the Rhino model>)
python_5 = PythonScript(crv=crv_3, n=Slider(61, range=0..100))  # -> out, div_points; inputs crv: Curve, n: Int32
# ---------- python_5: Python ----------
import Rhino.Geometry as rg

params = crv.DivideByCount(n,True)
print params

div_points = []
for p in params:
    point = crv.PointAt(p)
    div_points.append(point)
# ---------- end python_5 ----------
pt_7 = Point(python_5.div_points)

# ---- group: EPICYCLOID_2
R = Slider(77, range=0..220)
r = Slider(98, range=0..220)
pt_8 = Point(Point(1512.185207, 0, 0))
python_6 = PythonScript(center_pts=pt_8, r=r, R=R, num=Slider(6, range=0..30), degree=Slider(100, range=0..100), bool=Toggle(True))  # -> out, pts; inputs center_pts: list of Point3d
# ---------- python_6: Python ----------
import math
import Rhino.Geometry as rg
import rhinoscriptsyntax as rs
import clr
clr.AddReference("Grasshopper")
from Grasshopper.Kernel.Data import GH_Path
from Grasshopper import DataTree

def Epicycloid(center):
    pos_x = center.X
    pos_y = center.Y
    pts = []
    pi = math.pi
    step = (2*pi)/(num*math.radians(degree))
    count = 0
    for a in rs.frange(0,2*pi*num,step):
        O = a/num
        x = ((R+r)*math.cos(O) - r*math.cos(O+a)) + pos_x
        if bool == True:
            y = ((R+r)*math.sin(O) - r*math.sin(O+a)) + pos_y
        else:
            y = ((R+r)*math.sin(O) + r*math.sin(O+a)) + pos_y
        pt = rg.Point3d(x,y,0)
        pts.append(pt)
        count+=1
    pts.append(pts[0])
    return pts

all = []
for center_pt in center_pts:
    ep_pts = Epicycloid(center_pt)
    all.append(ep_pts)

def dataTree(information):
    Tree = DataTree[object]()
    for i in range(len(information)):
        path = GH_Path(i)
        Tree.AddRange(information[i], path)
    return Tree

pts = dataTree(all)
# ---------- end python_6 ----------
pt_9 = Point(python_6.pts)
intcrv_3 = Interpolate(Vertices=python_6.pts, Degree=3, Periodic=False, KnotStyle=1)  # -> Curve, Length, Domain

# ---- group: RHODONEA CURVE
number_slider = Slider(6.739, range=0..10)
panel_2 = Panel("1/3")
panel_3 = Panel("-10/7")
panel_4 = Panel("7/13")
panel_5 = Panel("7/9")
panel_6 = Panel("3/8")
pt_10 = Point(Point(2268.277811, 0, 0))
python_7 = PythonScript(k="7/2", loc=pt_10)  # -> out, pts; inputs loc: Point3d
# ---------- python_7: Python ----------
import Rhino.Geometry as rg
import math
import rhinoscriptsyntax as rs


pts = []
pi = math.pi
for alpha in rs.frange(0,18*pi,math.radians(1)):
    x = 200*(math.cos(k*alpha))*(math.cos(alpha)) + loc.X
    y = 200*(math.cos(k*alpha))*(math.sin(alpha)) + loc.Y
    pt = rg.Point3d(x,y,0)
    pts.append(pt)
# ---------- end python_7 ----------
pt_11 = Point(python_7.pts)
intcrv_4 = Interpolate(Vertices=pt_11, Degree=3, Periodic=False, KnotStyle=1)  # -> Curve, Length, Domain

# ---- group: HYPOCYCLOID_1
pt_12 = Point(Point(3024.370414, 0, 0))
python_8 = PythonScript(loc=pt_12, a="1", b="7/13", h="7/13")  # -> out, pts; inputs loc: Point3d
# ---------- python_8: Python ----------
import math
import Rhino.Geometry as rg
import rhinoscriptsyntax as rs

pts = []
pi = math.pi
for alpha in rs.frange(0,18*pi,math.radians(1)):
    x = 110*((a+b)*math.cos(alpha) + h*math.cos((a+b)/b*alpha)) + loc.X
    y = 110*((a+b)*math.sin(alpha) + h*math.sin((a+b)/b*alpha)) + loc.Y
    pt = rg.Point3d(x,y,0)
    pts.append(pt)
pts.append(pts[0])
# ---------- end python_8 ----------
pt_13 = Point(python_8.pts)
intcrv_5 = Interpolate(Vertices=pt_13, Degree=3, Periodic=False, KnotStyle=1)  # -> Curve, Length, Domain

# ---- group: HYPOCYCLOID_2
panel_7 = Panel("1")
panel_8 = Panel("3/4")
panel_9 = Panel("15/13")
pt_14 = Point(Point(3780.463018, 0, 0))
python_9 = PythonScript(loc=pt_14, a="1", b="7/13", h="5/13")  # -> out, pts; inputs loc: Point3d
# ---------- python_9: Python ----------
import math
import Rhino.Geometry as rg
import rhinoscriptsyntax as rs

pts = []
pi = math.pi
for alpha in rs.frange(0,18*pi,math.radians(0.5)):
    x = 350*((a-b)*math.cos(alpha) + h*math.cos((a-b)/b*alpha)) + loc.X
    y = 350*((a-b)*math.sin(alpha) - h*math.sin((a-b)/b*alpha)) + loc.Y
    pt = rg.Point3d(x,y,0)
    pts.append(pt)
#pts.append(pts[0])
# ---------- end python_9 ----------
pt_15 = Point(python_9.pts)
intcrv_6 = Interpolate(Vertices=pt_15, Degree=3, Periodic=False, KnotStyle=1)  # -> Curve, Length, Domain
