# Grasshopper definition points_in_motion.gh (Grasshopper 0.9.76)
# plug-ins: Python Interpreter

# ---- group: step_01
# The codes are inspired by the work of Dr. Ehsan Baharlou and the book "The Nature of Code" by Daniel Shiffman.
number_slider = Slider(2, range=0..10)
vec = VectorXYZ(XComponent=number_slider, YComponent=Slider(0, range=0..10), ZComponent=Slider(0, range=0..10))  # -> Vector, Length
pt = Point(Point(32.87861325, 27.46695127, 0))
timer = Timer(TimerInterval=20, Target=python)
python = PythonScript(point0=pt, velocity0=vec.Vector, setup=Button())  # -> out, new_point; inputs point0: Point3d, velocity0: Vector3d; disabled
# ---------- python: Python ----------
## Creates a class to move a point along a vector.

class Point:
    def __init__(self,pt,vel):
        self.point = pt
        self.velocity = vel
        
    def update(self):
        self.point += self.velocity

if setup:
    P = Point(point0,velocity0)

if P:
    P.update()
    new_point = P.point
# ---------- end python ----------
pt_2 = Point(python.new_point)

# ---- group: step_02 / velocity0
vec_2 = VectorXYZ(XComponent=Slider(2, range=0..10), YComponent=Slider(0, range=0..10), ZComponent=Slider(0, range=0..10))  # -> Vector, Length

# ---- group: step_02 / velocity1
vec_3 = VectorXYZ(XComponent=Slider(2, range=0..10), YComponent=Slider(3, range=0..10), ZComponent=Slider(0, range=0..10))  # -> Vector, Length

# ---- group: step_02 / point0
pt_3 = Point(Point(32.87861325, 27.46695127, 0))

# ---- group: step_02 / point1
pt_4 = Point(Point(56.98796282, 78.33774635, 0))

# ---- group: step_02
timer_2 = Timer(TimerInterval=20, Target=python_2)
python_2 = PythonScript(point0=pt_3, velocity0=vec_2.Vector, point1=pt_4, velocity1=vec_3.Vector, setup=Button())  # -> out, new_point0, new_point1; inputs point0: Point3d, velocity0: Vector3d, point1: Point3d, velocity1: Vector3d; disabled
# ---------- python_2: Python ----------
## Calls the class twice for two different points.

class Point:
    def __init__(self,pt,vel):
        self.point = pt
        self.velocity = vel
        
    def update(self):
        self.point += self.velocity

if setup:
    P0 = Point(point0,velocity0)
    P1 = Point(point1,velocity1)

if P0 and P1:
    P0.update()
    new_point0 = P0.point
    
    P1.update()
    new_point1 = P1.point
# ---------- end python_2 ----------
pt_5 = Point(python_2.new_point1)
pt_6 = Point(python_2.new_point0)

# ---- group: step_03 / velocity0
vec_4 = VectorXYZ(XComponent=Slider(2, range=0..10), YComponent=Slider(0, range=0..10), ZComponent=Slider(0, range=0..10))  # -> Vector, Length

# ---- group: step_03 / velocity1
vec_5 = VectorXYZ(XComponent=Slider(2, range=0..10), YComponent=Slider(3, range=0..10), ZComponent=Slider(0, range=0..10))  # -> Vector, Length

# ---- group: step_03 / point0
pt_7 = Point(Point(32.87861325, 27.46695127, 0))

# ---- group: step_03 / point1
pt_8 = Point(Point(56.98796282, 78.33774635, 0))

# ---- group: step_03
timer_3 = Timer(TimerInterval=20, Target=python_3)
python_3 = PythonScript(point0=pt_7, velocity0=vec_4.Vector, point1=pt_8, velocity1=vec_5.Vector, setup=Button())  # -> out, new_point0, new_point1; inputs point0: Point3d, velocity0: Vector3d, point1: Point3d, velocity1: Vector3d; disabled
# ---------- python_3: Python ----------
## Adds a boundary for the point to move in.

class Point:
    def __init__(self,pt,vel):
        self.point = pt
        self.velocity = vel
        
    def update(self):
        self.point += self.velocity
        self.boundary()
        
    def boundary(self):
        if self.point.X > 200:
            self.point.X = 0
        if self.point.Y > 200:
            self.point.Y = 0
        if self.point.X < 0:
            self.point.X = 0
        if self.point.Y < 0:
            self.point.Y = 0


if setup:
    P0 = Point(point0,velocity0)
    P1 = Point(point1,velocity1)

if P0 and P1:
    P0.update()
    new_point0 = P0.point
    
    P1.update()
    new_point1 = P1.point
# ---------- end python_3 ----------
pt_9 = Point(python_3.new_point1)
pt_10 = Point(python_3.new_point0)

# ---- group: step_04 / velocity0
vec_6 = VectorXYZ(XComponent=Slider(2, range=0..10), YComponent=Slider(0, range=0..10), ZComponent=Slider(0, range=0..10))  # -> Vector, Length

vec_7 = VectorXYZ(XComponent=Slider(2, range=0..10), YComponent=Slider(3, range=0..10), ZComponent=Slider(0, range=0..10))  # -> Vector, Length

# ---- group: step_04 / point0
pt_11 = Point(Point(32.87861325, 27.46695127, 0))

# ---- group: step_04
timer_4 = Timer(TimerInterval=20, Target=python_4)
python_4 = PythonScript(point0=pt_11, velocity0=vec_7.Vector, acceleration0=vec_6.Vector, setup=Button())  # -> out, new_point0, new_point1; inputs point0: Point3d, velocity0: Vector3d, acceleration0: Vector3d; disabled
# ---------- python_4: Python ----------
## Adds acceleration to the movement.

class Point:
    def __init__(self,pt,vel,acc):
        self.point = pt
        self.velocity = vel
        self.acceleration = acc
        
    def update(self):
        self.velocity += self.acceleration
        self.point += self.velocity
        self.boundary()
        
    def boundary(self):
        if self.point.X > 200:
            self.point.X = 0
        if self.point.Y > 200:
            self.point.Y = 0
        if self.point.X < 0:
            self.point.X = 0
        if self.point.Y < 0:
            self.point.Y = 0


if setup:
    P0 = Point(point0,velocity0,acceleration0)

if P0:
    P0.update()
    new_point0 = P0.point
# ---------- end python_4 ----------
pt_12 = Point(python_4.new_point1)
pt_13 = Point(python_4.new_point0)

# ---- group: step_05 / velocity0
vec_8 = VectorXYZ(XComponent=Slider(10, range=0..10), YComponent=Slider(0, range=0..10), ZComponent=Slider(0, range=0..10))  # -> Vector, Length

vec_9 = VectorXYZ(XComponent=Slider(6, range=0..10), YComponent=Slider(5, range=0..10), ZComponent=Slider(0, range=0..10))  # -> Vector, Length

# ---- group: step_05 / point0
pt_14 = Point(Point(32.87861325, 27.46695127, 0))

# ---- group: step_05
timer_5 = Timer(TimerInterval=20, Target=python_5)
python_5 = PythonScript(point0=pt_14, velocity0=vec_9.Vector, acceleration0=vec_8.Vector, setup=Button())  # -> out, new_point0; inputs point0: Point3d, velocity0: Vector3d, acceleration0: Vector3d; disabled
# ---------- python_5: Python ----------
## Adds external force and mass to the movement.
import Rhino.Geometry as rg

class Point:
    def __init__(self,pt,vel,acc,mass):
        self.point = pt
        self.velocity = vel
        self.acceleration = acc
        self.mass = mass
        
    def update(self):
        self.velocity += self.acceleration
        self.point += self.velocity
        self.boundary()
        self.acceleration *= 0
        
    def boundary(self):
        if self.point.X > 200:
            self.point.X = 0
        if self.point.Y > 200:
            self.point.Y = 0
        if self.point.X < 0:
            self.point.X = 0
        if self.point.Y < 0:
            self.point.Y = 200
            
    def applyForce(self,force):
        force = rg.Vector3d.Divide(force,self.mass)
        self.acceleration += force

mass0 = 0.4
force = rg.Vector3d(0,-1,0)

if setup:
    P0 = Point(point0,velocity0,acceleration0,mass0)

if P0:
    P0.applyForce(force)
    P0.update()
    new_point0 = P0.point
# ---------- end python_5 ----------
pt_15 = Point(python_5.new_point0)

# ---- group: step_06 / velocity0
vec_10 = VectorXYZ(XComponent=Slider(8, range=0..10), YComponent=Slider(0, range=0..10), ZComponent=Slider(0, range=0..10))  # -> Vector, Length

vec_11 = VectorXYZ(XComponent=Slider(0, range=0..10), YComponent=Slider(1, range=0..10), ZComponent=Slider(0, range=0..10))  # -> Vector, Length

# ---- group: step_06 / point0
pt_16 = Point(Point(32.87861325, 27.46695127, 0))

# ---- group: step_06
python_6 = PythonScript(point0=pt_16, velocity0=vec_11.Vector, acceleration0=vec_10.Vector)  # -> out, list_pts, crv; inputs point0: Point3d, velocity0: Vector3d, acceleration0: Vector3d
# ---------- python_6: Python ----------
## Creates a curve out of the points movement.
import Rhino.Geometry as rg

class Point:
    def __init__(self,pt,vel,acc,mass):
        self.point = pt
        self.velocity = vel
        self.acceleration = acc
        self.mass = mass
        
    def update(self):
        self.velocity += self.acceleration
        self.point += self.velocity
        self.boundary()
        self.acceleration *= 0
        
    def boundary(self):
        if self.point.X > 200:
            self.point.X = 0
        if self.point.Y > 200:
            self.point.Y = 0
        if self.point.X < 0:
            self.point.X = 0
        if self.point.Y < 0:
            self.point.Y = 200
            
    def applyForce(self,force):
        force = rg.Vector3d.Divide(force,self.mass)
        self.acceleration += force

mass0 = 0.4
force = rg.Vector3d(0,-1,0)

P0 = Point(point0,velocity0,acceleration0,mass0)

list_pts = []
if P0:
    for i in range(100):
        P0.applyForce(force)
        P0.update()
        new_point0 = P0.point
        list_pts.append(new_point0)
    
    crv = rg.Curve.CreateInterpolatedCurve(list_pts,3)
# ---------- end python_6 ----------
crv = Curve(python_6.crv)
pt_17 = Point(python_6.list_pts)

# ---- group: bake
python_7 = PythonScript(geom=pt_17)  # -> out, attr; inputs geom: list, bake_it: Boolean
# ---------- python_7: Python ----------
import scriptcontext as sc
import Rhino
import System
import Rhino.Geometry as rg

bake_it = True

step = 100/len(geom)
if bake_it:
    sc.doc = Rhino.RhinoDoc.ActiveDoc
    
    for i,geo in enumerate(geom):
        if type(geo) == rg.Point3d:
            geo = rg.Point(geo)
        elif type(geo) == rg.Line:
            geo = rg.LineCurve(geo)
        elif type(geo) == rg.NurbsCurve:
            geo = rg.NurbsCurve(geo)
        
        attr = Rhino.DocObjects.ObjectAttributes()
        
        color = System.Drawing.Color.FromArgb(100+i*step,100+i*step,0)
        attr.ObjectColor = color
        attr.ColorSource = Rhino.DocObjects.ObjectColorSource.ColorFromObject
        
        plotweight = 10/(i+1)
        attr.PlotWeight = plotweight
        attr.PlotWeightSource = Rhino.DocObjects.ObjectPlotWeightSource.PlotWeightFromObject
        
        sc.doc.Objects.Add(geo,attr)
# ---------- end python_7 ----------
