# Grasshopper definition 171114_TopOpt2VoxelSpace.gh (Grasshopper 0.9.76)
# plug-ins: Python Interpreter, Millipede

vec = VectorXYZ(XComponent="30", YComponent="40", ZComponent="-120")  # -> Vector, Length
brep = Brep([<brep referenced from the Rhino model> x2])
brep_2 = Brep(<brep referenced from the Rhino model>)
brep_3 = Brep(<brep referenced from the Rhino model>)
Z = UnitZ(Factor=-100)
support = _3DSupportRegion(Boundary=brep, SupportType=63, AmendExistingSupports=True)
load = _3DLoadRegion(Boundary=brep_2, Load=vec.Vector)
boundary = _3DBoundaryRegion(Boundary=brep_3, IsVoid=False)
topostruct_3d = Topostruct3DModel(ModelComponents=[load, boundary, support], XResolution="30")  # -> FEModel, CellCentres, CellSize
topostruct_3d_solver = Topostruct3DSolver(
    FEModel=topostruct_3d.FEModel,
    SelfWeightCoefficient=0,
    OptimisationIterations="2",
    Smoothing=0.1,
    Penalization=3,
    TargetDensity=0.4,
    MinimumDensity=0.001,
    DeleteThreshold=0.5,
    PeriodicX=False,
    PeriodicY=False,
    PeriodicZ=False,
    LoadCase=0,
    AllCases=True)  # -> FEModel, MaxDeflection
_3d_iso_mesh = _3DIsoMesh(FEModel=topostruct_3d_solver.FEModel, Deflection=0, IsoContourValue=Slider(0.4, range=0..1), ColorMode=0)
_3d_cell_results = _3DCellResults(FEModel=topostruct_3d_solver.FEModel)  # -> PrincipalStressPlanes, PrincipalStresses, VonMisesStress, Density
unit = UnitVector(Vector=_3d_cell_results.PrincipalStresses)
expression = Expression(x=_3d_cell_results.VonMisesStress, Expression="x^0.2")
deplane = DeconstructPlane(Plane=_3d_cell_results.PrincipalStressPlanes)  # -> Origin, XAxis, YAxis, ZAxis
python = PythonScript(x=expression)  # -> out, a; inputs x: list
# ---------- python: Python ----------
a = min(x)
# ---------- end python ----------
python_2 = PythonScript(x=expression)  # -> out, a; inputs x: list
# ---------- python_2: Python ----------
a = max(x)
# ---------- end python_2 ----------
bnd = Bounds(Numbers=_3d_cell_results.VonMisesStress)
gradient = Gradient(
    LowerLimit=python.a,
    UpperLimit=python_2.a,
    Parameter=expression,
    stops=[0: RGB(234, 38, 0), 0.25: RGB(234, 126, 0), 0.5: RGB(254, 244, 84), 0.75: RGB(173, 203, 249), 1: RGB(75, 107, 169)])
vdis = VectorDisplay(Anchor=deplane.Origin, Vector=expr("x*10", unit))
dedomain = DeconstructDomain(Domain=bnd)  # -> Start, End
pt = Point(deplane.Origin)
scalarfieldexport = PythonScript(path="C:\Users\User\Desktop\", bounds=brep_3, nx="30", values=_3d_cell_results.Density, write=Button())  # -> a; inputs bounds: Brep, nx: Int32, values: list, write: Boolean
# ---------- scalarfieldexport: Python ----------
import Grasshopper as gh
import rhinoscriptsyntax as rs

ghenv.Component.NickName = "ScalarFieldExport"

dim = 1.0
dx,dy,dz = 0,0,0
ny,nz = 0,0
llc = None
if bounds:
    bb = rs.BoundingBox(bounds)
    dx = abs(bb[6][0] - bb[0][0])
    dy = abs(bb[6][1] - bb[0][1])
    dz = abs(bb[6][2] - bb[0][2])
    #a = (dx,dy,dz)
    dim = dx / nx
    ny = int(dy/dim)
    nz = int(dz/dim)
    llc = bb[0]

mx = float(max(values))
mn = float(min(values))
delta = mx-mn
nv = [[[0 for x in range(nx)] for y in range(ny)] for z in range(nz)]
nxy = nx*ny
for i,v in enumerate(values):
    ix = i % nx
    iy = (i // nx) % ny
    iy = ny-iy-1
    iz = i // nxy
    #print(type(ix))
    tv = (float(v)-mn)/delta
    tv = 2*tv - 1
    nv[iz][iy][ix] = tv*-1
#a = nv

if not path:
    path = "C:\Users\User\Desktop\\"
    
if write:
    with open(path+'export.txt','w') as f:
        #f.write('hallo welt')
        f.write(str(nx)+'\n')
        f.write(str(ny)+'\n')
        f.write(str(nz)+'\n')
        f.write(str(llc[0])+'\n')
        f.write(str(llc[1])+'\n')
        f.write(str(llc[2])+'\n')
        f.write(str(dim)+'\n')
        if values:
            #for v in values:
            #    f.write(str(v)+'\n')
            for x in range(nx):
                #for y in range(ny-1,0,-1):
                for y in range(ny):
                    for z in range(nz):
                        v = nv[z][y][x]
                        f.write(str(v)+'\n')
# ---------- end scalarfieldexport ----------
preview = CustomPreview(Geometry=pt, Shader=gradient)
