# Grasshopper definition receive.gh (Grasshopper 0.9.76)
# plug-ins: Python Interpreter

python = PythonScript(setup=Toggle(False))  # -> out, a; inputs setup: Boolean
# ---------- python: Python ----------
import json
import urllib2

if setup:
    a = json.load(urllib2.urlopen('http://10.2.17.31:5000'))
    print a
# ---------- end python ----------
panel = Panel(python.a)
