# Grasshopper definition send.gh (Grasshopper 0.9.76)
# plug-ins: Python Interpreter

python = PythonScript(setup=Toggle(False), num=Slider(3, range=0..10))  # -> out, a; inputs setup: Boolean
# ---------- python: Python ----------
import json
import urllib2

if setup:
    #a = json.load(urllib2.urlopen('http://192.168.10.11:5000?message=' + str(num)))
    a = json.load(urllib2.urlopen('http://192.168.10.11:5000?message=Hello'))
    print a
# ---------- end python ----------
