# Grasshopper definition minijammed.gh (Grasshopper 0.9.76)
# plug-ins: Python Interpreter

brep = Brep(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)

# ---- group: PART 1: CUTTING PLANES
python = PythonScript(brep=brep, layer_h=Slider(10, range=0..10))  # -> out, bounding_box, cutting_planes; inputs brep: Brep, layer_h: Int32
# ---------- python: Python ----------
'''
Created on 29.10.2017

@author: rgergana
'''

import Rhino.Geometry as rg

def cutting_planes(brp,l_height):
    
    """ Creates cutting planes for
    each layer of the structure. """
    
    plane = rg.Plane.WorldXY
    
    bb = rg.Brep.GetBoundingBox(brp,plane)
    corners = bb.GetCorners()
    h = rg.Point3d.DistanceTo(corners[0],corners[4])
    
    cutting_planes = []
    num_layers = int(h/l_height)
    z = corners[0].Z
    for num in range(num_layers):
        z += l_height
        origin = rg.Point3d(corners[0][0],corners[0][1],z)
        cutting_plane = rg.Plane(origin,rg.Vector3d.ZAxis)
        cutting_planes.append(cutting_plane)
        
    return cutting_planes,bb

c_p = cutting_planes(_brep,_layer_h)

cutting_planes_ = c_p[0]
bounding_box_ = c_p[1]
# ---------- end python ----------
pln = Plane(python.cutting_planes)
box = Box(python.bounding_box)

# ----
brep_2 = Brep(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)

# ---- group: PART 2: EXTRACT BOUNDING CURVES
python_2 = PythonScript(brep=brep, cutting_planes=pln, bounding_box=box)  # -> out, boundary_crvs, boundary_crvs_joined; inputs brep: Brep, cutting_planes: list of Plane, bounding_box: Box
# ---------- python_2: Python ----------
'''
Created on 29.10.2017

@author: rgergana
'''

import Rhino.Geometry as rg

def split_brep(brp,pln,bb):
    
    """ Splits the created levels
    with the global brep and creates
    the boundary curves. """
    
    boundary_crvs = []
    
    bool,U,V = rg.Plane.ExtendThroughBox(pln,bb)
    
    
    plnSrf = rg.PlaneSurface(pln,U,V)
    layerBrp = plnSrf.ToBrep()
    
    S_plnBrp = layerBrp.Split(brp,0.0001)
    
    for i in range(1,len(S_plnBrp)): 
        edge_crvs = rg.Brep.DuplicateEdgeCurves(S_plnBrp[i])
        if len(edge_crvs) == 1:
            #print "there is only one curve per layer"
            boundary_crvs.append(edge_crvs[0])
        else:
            #print "there is", len(edge_crvs), "curves per layer"
            
            for n,crv in enumerate(edge_crvs):
                boundary_crvs.append(crv)
                
    return boundary_crvs

boundary_crvs_ = []
boundary_crvs_joined_ = []
for _plane in _cutting_planes:
    s_b = split_brep(_brep,_plane,_bounding_box)
    
    for crv in s_b:
        boundary_crvs_.append(crv)
    
    joined_boundary_ = rg.Curve.JoinCurves(s_b)
    boundary_crvs_joined_.append(joined_boundary_[0])
# ---------- end python_2 ----------
crv = Curve(python_2.boundary_crvs)
crv_2 = Curve(python_2.boundary_crvs_joined)
number_slider = Slider(0, range=0..110)
item = ListItem(List=crv, Index=number_slider, Wrap=True)
item_2 = ListItem(List=crv_2, Index=number_slider, Wrap=True)

# ---- group: PART 4: OFFSET CURVES
num_iteration = Slider(2, range=0..8)
offset = Slider(34, range=0..200)
python_3 = PythonScript(crv=item_2, offset=offset, num_iteration=num_iteration)  # -> out, crvs; inputs crv: Curve, offset: Int32, num_iteration: Int32
# ---------- python_3: Python ----------
'''
Created on 31.10.2017

@author: rgergana
'''

import rhinoscriptsyntax as rs


class offset_crv():
    """ Creates offseted curves. """
    
    def __init__(self,crv,offset,num_iteration):
        self.obj = crv
        self.centroid = rs.CurveAreaCentroid(self.obj)[0]
        
        self.num_itter = num_iteration
        self.offset = int(offset)
        
        self.crvs = []
    
    def activate(self): 
        for i in range(self.num_itter):
            offset_crv = rs.OffsetCurve(self.obj, self.centroid, self.offset)
            self.crvs.append(offset_crv[0])
            
            self.obj = offset_crv[0]


ip = offset_crv(_crv,_offset,_num_iteration)
ip.activate()
crvs_ = ip.crvs
# ---------- end python_3 ----------
crv_3 = Curve(python_3.crvs)
item_3 = ListItem(List=crv_3, Index=0, Wrap=True)

# ---- group: PART 3: PATTERN GENERATION FROM CURVE
cir_rad = Slider(62, range=0..100)
crv_4 = Curve(item_2)
python_4 = PythonScript(crv=crv_4, d=Slider(81, range=0..100), cir_rad=cir_rad, flip=Toggle(True))  # -> out, div_pts, tan_vecs, perp_vecs, planes, circles, path_pts; inputs crv: Curve, d: Int32, cir_rad: Int32, flip: Boolean
# ---------- python_4: Python ----------
'''
Created on 31.10.2017

@author: rgergana
'''

import math
import Rhino.Geometry as rg

def pattern_generation(crv,d,flip,rad):
    
    """ Creates a circle-based pattern along 
    a given curve. """
    
    tangent_vecs = []; div_pts = []; perp_vecs = []
    cirs = []; planes = []; path_pts = []
    
    f_div = crv.DivideByLength((d),True)
    num = int(len(f_div))
    
    if flip == True:
        angle = 90
    else:
        angle = 270
    
    params = crv.DivideByCount(num,True)
    
    def vecs_point(param,curve):
        tangent_vec = curve.TangentAt(param)
        tangent_vec = tangent_vec*10
        perp_vec = curve.TangentAt(param)
        perp_vec = perp_vec*10
        perp_vec.Rotate(math.radians(angle),rg.Vector3d.ZAxis)
        pt = curve.PointAt(param)
        
        return pt,tangent_vec,perp_vec
        
    for p in params:
        
        v_p = vecs_point(p,crv)
        p_v = v_p[2]; t_v = v_p[1]; pt = v_p[0]
        
        plane = rg.Plane(pt,p_v,t_v)
        cir = rg.Circle(plane,rad)
        
        cir = rg.Circle.ToNurbsCurve(cir)
        
        div_cir = cir.DivideByCount(10,False)
        
        for param in div_cir: path_pts.append(cir.PointAt(param))
        
        tangent_vecs.append(t_v)
        div_pts.append(pt)
        perp_vecs.append(p_v)
        cirs.append(cir)
        planes.append(plane)
        
    return div_pts, tangent_vecs, perp_vecs, planes, cirs, path_pts

c_d = pattern_generation(_crv,_d,_flip,_cir_rad)
div_pts_ = c_d[0] 
tan_vecs_ = c_d[1]
perp_vecs_ = c_d[2]
planes_ = c_d[3]
circles_ = c_d[4]
path_pts_ = c_d[5]
# ---------- end python_4 ----------
vdis = VectorDisplay(Anchor=python_4.div_pts, Vector=python_4.tan_vecs)
vdis_2 = VectorDisplay(Anchor=python_4.div_pts, Vector=python_4.perp_vecs)
pt = Point(python_4.div_pts)
pln_2 = Plane(python_4.planes)
circle = Circle(python_4.circles)
pt_2 = Point(python_4.path_pts)
intcrv = Interpolate(Vertices=pt_2, Degree=3, Periodic=False, KnotStyle=1)  # -> Curve, Length, Domain

# ---- group: PART 6: CIRCLE-CIRCLE INTERSECTION
python_5 = PythonScript(crv=item_2, points=python_4.div_pts, radius=cir_rad)  # -> out, int_points, distances, lines, locations; inputs crv: Curve, points: list of Point3d
# ---------- python_5: Python ----------
'''
Created on 31.10.2017

@author: rgergana
'''

import math
from math import pow,sqrt
import Rhino.Geometry as rg
import rhinoscriptsyntax as rs


class circle_circle_intersection():
    """ Creates the intersection points between circles
    and calculates the distance between them. """
    
    def __init__(self,points,boundary_crv,radius):
        
        self.points = points
        self.crv = boundary_crv
        self.radius = radius
        
        self.int_points_ = []; self.lines_ = [];
        self.distances_ = []; self.locations_ = []
    
    def intersection(self,_pt1,_pt2,_r1,_r2,_crv):
        if _pt1 and _pt2:
            x1 = _pt1.X; y1 = _pt1.Y; z1 = _pt1.Z
            x2 = _pt2.X; y2 = _pt2.Y
            
            dx,dy = x2-x1,y2-y1
            d = math.sqrt(pow(dx,2) + pow(dy,2))
            
            if d != 0:
                a = (pow(_r1,2) - pow(_r2,2) + pow(d,2))/(2*d)
                h = sqrt(abs(pow(_r1,2) - pow(a,2)))
                
                xm = x1 + a*dx/d
                ym = y1 + a*dy/d
                
                xs1 = xm + h*dy/d
                xs2 = xm - h*dy/d
                
                ys1 = ym - h*dx/d
                ys2 = ym + h*dx/d
                
                pt = rg.Point3d(xs1,ys1,z1)
                check = rs.PointInPlanarClosedCurve(pt, self.crv)
                if check == 1 or check == 2:
                    pt = rg.Point3d(xs2,ys2,z1)
                return pt
    
    def activate(self):
        for i in range(len(self.points)):
            if i != len(self.points)-1:
                pt_ = self.intersection(self.points[i],self.points[i+1],self.radius,self.radius,_crv)
            else:
                pt_ = self.intersection(self.points[i],self.points[0],self.radius,self.radius,_crv)
                
            if pt_ != None:
                self.int_points_.append(pt_)
                
                    
        for j in range(len(self.int_points_)):
            if j != len(self.int_points_)-1:
                dist = rs.Distance(self.int_points_[j],self.int_points_[j+1])
                line = rs.AddLine(self.int_points_[j],self.int_points_[j+1])
                
            else:
                dist = rs.Distance(self.int_points_[j],self.int_points_[0])
                line = rs.AddLine(self.int_points_[j],self.int_points_[0])
                
            
            self.distances_.append(dist)
            
            self.lines_.append(line)
            mid_pt = rs.CurveMidPoint(line)
            self.locations_.append(mid_pt)

c_c_i = circle_circle_intersection(_points,_crv,_radius)
c_c_i.activate()

int_points_ = c_c_i.int_points_
distances_ = c_c_i.distances_
lines_ = c_c_i.lines_
locations_ = c_c_i.locations_
# ---------- end python_5 ----------
pt_3 = Point(python_5.int_points)
line = Line(python_5.lines)
pt_4 = Point(python_5.locations)
tag = TextTag3D(Location=pt_4, Text=python_5.distances, Size=Slider(10, range=0..10), Justification=7)

# ---- group: PART 5: CONVEX AND CONCAVE PARTS OF THE CURVE
crv_5 = Curve(item_2)
python_6 = PythonScript(crv=crv_5)  # -> out, crvs, convex_pts, concave_pts; inputs crv: Curve
# ---------- python_6: Python ----------
'''
Created on 31.10.2017

@author: rgergana
'''

import Rhino.Geometry as rg
import math

def curve_convex_concave(crv,count):
    
    """ Divides the curve in convex and concave segments. """
    
    chks = []; all_points = [];
    concave_pts = []; convex_pts = []
    split_pts = []; interpol_crvs = []
    break_inds = []; break_inds.append(0)
    
    params = crv.DivideByCount(count,True)
    
    for p in params:
        tan = crv.TangentAt(p)
        pt = crv.PointAt(p)
        curv = crv.CurvatureAt(p)
        
        move = rg.Vector3d.CrossProduct(tan,rg.Vector3d.ZAxis*5)
        
        angle = rg.Vector3d.VectorAngle(move,curv)
        if angle > 0.5*math.pi: 
            chks.append(0); all_points.append(pt); convex_pts.append(pt)
        else:
            chks.append(1); all_points.append(pt); concave_pts.append(pt)
     
    break_ind = chks[0]
    for ind,val in enumerate(chks):
        if val != break_ind:
            break_ind = val
            break_inds.append(ind)
    
    def split(start_ind,next_ind):
        list = []
        for i in range(start_ind,next_ind):
            list.append(all_points[i])
        return list
        
    for i,index in enumerate(break_inds):
        if i != len(break_inds)-1:
            str_ind = index
            n_ind = break_inds[i+1]+1
            s = split(str_ind, n_ind)
        else:
            str_ind = index
            n_ind = len(all_points)
            s = split(str_ind, n_ind)
            
            ## use the next line only if the curve is closed:
            #s.append(all_points[0])
        split_pts.append(s)
    for list in split_pts:
        crv = rg.Curve.CreateInterpolatedCurve(list,3)
        interpol_crvs.append(crv)
        
    if chks[0] == chks[-1]:
        last_crv = rg.Curve.JoinCurves([interpol_crvs[0],interpol_crvs[-1]])
        interpol_crvs.pop(0);interpol_crvs.pop(-1)
        interpol_crvs.append(last_crv[0])
        
    return interpol_crvs,concave_pts,convex_pts

c_c_c = curve_convex_concave(_crv,1000)
crvs_ = c_c_c[0]
concave_pts_ = c_c_c[1]
convex_pts_ = c_c_c[2]
# ---------- end python_6 ----------
crv_6 = Curve(python_6.crvs)
pt_5 = Point(python_6.convex_pts)
pt_6 = Point(python_6.concave_pts)
number_slider_2 = Slider(10, range=0..30)
dots = DotDisplay(Point=pt_6, Colour=ColourSwatch(SwatchColor=RGB(0, 255, 4)), Size=number_slider_2)
dots_2 = DotDisplay(Point=pt_5, Colour=ColourSwatch(SwatchColor=RGB(255, 30, 0)), Size=number_slider_2)
