# Grasshopper definition 171025_178_ur_online_StringPlacment_PA.gh (Grasshopper 0.9.76)
# plug-ins: Python Interpreter

crv = Curve([<curve referenced from the Rhino model> x63])
pt = Point([<point referenced from the Rhino model> x40])

# ----
# Check your IP address and set UR IP address
server_port = Integer(30003)
# 0a
# Settings
server_address = ValueList({"192.168.10.12", "192.168.10.11", "127.0.0.1"}, selected="192.168.10.11")
ur_ip = ValueList({"192.168.10.11", "192.168.10.10", "127.0.0.1"}, selected="192.168.10.10")
globals = PythonScript(server_address=server_address, server_port=server_port, ur_ip=ur_ip)  # inputs server_port: Int32
# ---------- globals: Python ----------
from scriptcontext import sticky as st

st["server_address"] = server_address
st["server_port"] = server_port

st["ur_ip"] = ur_ip
# ---------- end globals ----------

# ----
# Check if UR is available
ping = Button()
py = PythonScript(ip=ur_ip, ping=ping)  # -> out
# ---------- py: Python ----------
from scriptcontext import sticky as st
from ur_online_control.communication import is_available


guid = str(ghenv.Component.InstanceGuid)
txt_key = "txt_" + guid
if txt_key not in st:
    st[txt_key] = ""

if ping:
    
    available = is_available(ip)
    
    if available:
        st[txt_key] = "%s is up!" % ip
    else:
        st[txt_key] = "%s is down!" % ip

print st[txt_key]
# ---------- end py ----------
# Planning
# 0b
panel = Panel(py)

number_slider = Slider(75, range=0..1000)

panel_2 = Panel("Unload libraries")
bang = Button()
unload = PythonScript(bang=bang)
# ---------- unload: Python ----------
from compas_fab.fab.grasshopper.utilities import unload_modules

unload_modules("compas")
unload_modules("ur_online_control")
# ---------- end unload ----------

list = ValueList({"no_tool": 0, "measurement_tool": 1, "string_tool": 2, "string_tool_1": 3}, selected="string_tool_1")

# ---- group: Robot
# 1. load robot model
# 2. set tool
# 3. set basis
tools = Tools(tool_id=list)  # -> tool_6, tools_2
base = PythonScript()  # -> base_frame
# ---------- base: Python ----------
from compas_fab.fab.geometry import Frame

"""
origin = [-484.56, -202.24, -222.90]
xaxis = [-0.00015, 0.99998, -0.00552]
yaxis = [-0.99997, -0.00011, 0.00752]
"""

"""
origin = [0, 0, 0]
xaxis = [1, 0, 0]
yaxis = [0, 1, 0]
"""

 
origin = [113.56, -904.96, 448.53]
xaxis = [1.00000, 0.00000, 0.00000]
yaxis = [0.00000, 0.00000, -1.00000]


base_frame = Frame(list(origin), list(xaxis), list(yaxis))
# ---------- end base ----------
list_2 = ValueList({"UR5", "UR10"}, selected="UR10")
robot = PythonScript(model=list_2, tool=tools.tool_6, base_frame=base)  # -> robot
# ---------- robot: Python ----------
from compas_fab.fab.robots.ur.ur10 import UR10
from compas_fab.fab.robots.ur.ur5 import UR5
from scriptcontext import sticky as st

if model == "UR5":
    robot = UR5()
elif model == "UR10":
    robot = UR10()

if tool:
    robot.set_tool(tool)
if base_frame:
    robot.set_base(base_frame)

st["robot"] = robot
# ---------- end robot ----------

# ----
# Executing
# 1
panel_3 = Panel("Start communication server")
py_2 = PythonScript()  # -> path
# ---------- py_2: Python ----------
import sys
import os

ghComp = ghenv.Component
ghDoc = ghComp.OnPingDocument()

# the full path of the gh file
path = ghDoc.FilePath
# the directory of the gh file
path = os.path.dirname(path)

path = os.path.abspath(os.path.join(path, ".."))

print path
# ---------- end py_2 ----------
panel_4 = Panel(py_2)
panel_5 = Panel("C:\Users\jennyd\Documents\DavidJenny\GIT\ur_online_control")
start = Button()
server = PythonScript(path=panel_4, start=start)
# ---------- server: Python ----------
import os
import threading
from scriptcontext import sticky as st

server_address = st["server_address"]
server_port = st["server_port"]
ur_ip = st["ur_ip"]

"""
Change main!!!!
"""
main = os.path.join(path, "communication", "mainString.py")

if os.path.isfile(main):
        
    def myfunc():
        syscall = "python %s %s %s %s" % (main, server_address, server_port, ur_ip)
        os.system(syscall)
    
    if start:
        t = threading.Thread(target=myfunc)
        t.start()
# ---------- end server ----------

send = Button()
# 2
panel_6 = Panel("Get UR connected")
ur = PythonScript(send=send)
# ---------- ur: Python ----------
from scriptcontext import sticky as st
from ur_online_control.ur_driver import URDriver

server_address = st["server_address"]
server_port = st["server_port"]
ur_ip = st["ur_ip"]
robot = st["robot"]

tool_angle_axis = robot.tool.tcp_frame.pose_axis_angle_vector
print tool_angle_axis

ur_driver = URDriver(server_address, server_port, tool_angle_axis, ur_ip, "UR")
print ur_driver

if send:
    ur_driver.send()
# ---------- end ur ----------

connect = Button()
disconnect = Button()
# 3
panel_7 = Panel("Get Grasshopper connected")
# TODO
client = PythonScript(connect=connect, disconnect=disconnect)  # -> connected, client
# ---------- client: Python ----------
import time
from scriptcontext import sticky as st
from Rhino.RhinoApp import WriteLine
from ur_online_control.grasshopper import GHClient, gh_component_timer
import time

server_address = st["server_address"]
server_port = st["server_port"]

guid = str(ghenv.Component.InstanceGuid)

client_key = "client_" + guid
run_key = "run_" + guid

if connect:
    if client_key not in st:
        st[client_key] = GHClient(server_address, server_port)
        client = st[client_key]
        client.connect_to_server()
        client.start()
        
    else:
        if st[client_key].running:
            WriteLine("Client is already connected.")
            
        else:
            st[client_key] = GHClient(server_address, server_port)
            client = st[client_key]
            client.connect_to_server()
            client.start()
"""
else:
    if client_key in st:
        # we need a timer to ask if we have something on the rcv queue
        client = st[client_key]
        #if client.running:
        #    #client.run_inner_while()
        #    gh_component_timer(ghenv, True, 1000)
"""

if disconnect:
    if client_key in st:
        client = st[client_key]
        if client.running:
            client.close()

if client_key in st:
    connected =  st[client_key].running
    client = st[client_key]
    print st[client_key].rcv_queue.qsize()
    print st[client_key].snd_queue.qsize()
else:
    connected = False
# ---------- end client ----------
# * implement client wrapper completely
panel_8 = Panel(client.connected)

# ----
# This component updates on receive
bang_2 = Button()
receive = PythonScript(client=client.client, bang=bang_2)  # -> qsize, client
# ---------- receive: Python ----------
from ur_online_control.communication.msg_identifiers import *
from ur_online_control.utilities.lists import flatten_list
from Rhino.RhinoApp import WriteLine


if client:
    if not client.ghenv:
        client.ghenv = ghenv
    qsize = client.rcv_queue.qsize()
# ---------- end receive ----------
panel_9 = Panel(receive.qsize)

sortbyz = PythonScript(crvs=crv, pts=pt, item=Slider(28, range=0..100))  # -> crv, pt; inputs crvs: list, pts: list, item: Int32
# ---------- sortbyz: Python ----------
import Rhino.Geometry as rg

crvs = sorted(_crvs, key=lambda i: i.PointAtEnd[2])

pts = sorted(_pts, key=lambda i: i[2])


crv = crvs[_item]

pt = pts[_item]
# ---------- end sortbyz ----------

# ---- group: Define path
number = Slider(22, range=0..100)
Z = UnitZ(Factor=1)
py_3 = PythonScript(crv=sortbyz.crv, number=number, normal=Z)  # -> planes
# ---------- py_3: Python ----------
import Rhino.Geometry as rg

normal.Unitize()

# 1. Divide curve
params = rg.Curve.DivideByCount(crv, number - 1, True)
planes = []
for param in params:
    point = rg.Curve.PointAt(crv, param)
    """
    tangent = rg.Curve.TangentAt(crv, param)
    tangent.Unitize()
    # tangent = xaxis, normal is given, so we calculate yaxis
    yaxis = rg.Vector3d.CrossProduct(normal, tangent)
    yaxis.Unitize()
    planes.append(rg.Plane(point, tangent, yaxis))
    """
    planes.append(rg.Plane(point, rg.Vector3d.XAxis, rg.Vector3d.YAxis))
    
    
print len(params)
# ---------- end py_3 ----------

# ---- group: Define commands
number_slider_2 = Slider(100, range=0..100)
number_slider_3 = Slider(45, range=0..100)
python = PythonScript(planes_WCS=py_3, dfillet=number_slider_3, speed=number_slider)  # -> commands; inputs planes_WCS: list
# ---------- python: Python ----------
import Rhino.Geometry as rg
from compas_fab.fab.geometry import Frame, Transformation
from compas_fab.fab.grasshopper import xdraw_frame
from scriptcontext import sticky as st

robot = st["robot"]
buffer = 0.7

# TODO this must be optimized! matrix multiplication!
commands = []
for i, plane_WCS in enumerate(planes_WCS):
    tcp_WCS = Frame(plane_WCS.Origin, plane_WCS.XAxis, plane_WCS.YAxis)
    if i == 0 or i == len(planes_WCS) - 1:
        radius = 0.
    else:
        # calculate blend radius
        prev, current, next = planes_WCS[i-1].Origin, planes_WCS[i].Origin, planes_WCS[i+1].Origin
        radius = min((prev - current).Length/2 * buffer, (next - current).Length/2 * buffer, dfillet)
        
    tcp_RCS = robot.get_frame_in_RCS(tcp_WCS)
    cmd = tcp_RCS.pose_axis_angle_vector + [speed, radius]
    commands.append(cmd)

print len(commands)
# ---------- end python ----------

# ----
py_4 = PythonScript(pts=sortbyz.pt)  # -> planes; inputs pts: list
# ---------- py_4: Python ----------
import Rhino.Geometry as rg

print pts

planes = []
for pt in pts:
    planes.append(rg.Plane(pt, rg.Vector3d.XAxis, rg.Vector3d.YAxis))
# ---------- end py_4 ----------
python_2 = PythonScript(planes_WCS=py_4, dfillet=number_slider_3, speed=number_slider)  # -> commands; inputs planes_WCS: list
# ---------- python_2: Python ----------
import Rhino.Geometry as rg
from compas_fab.fab.geometry import Frame, Transformation
from compas_fab.fab.grasshopper import xdraw_frame
from scriptcontext import sticky as st

robot = st["robot"]
buffer = 0.7

acc = 50
vel = 50


# TODO this must be optimized! matrix multiplication!
commands = []
for i, plane_WCS in enumerate(planes_WCS):
    tcp_WCS = Frame(plane_WCS.Origin, plane_WCS.XAxis, plane_WCS.YAxis)
    if i == 0 or i == len(planes_WCS) - 1:
        radius = 0.
    else:
        # calculate blend radius
        prev, current, next = planes_WCS[i-1].Origin, planes_WCS[i].Origin, planes_WCS[i+1].Origin
        radius = min((prev - current).Length/2 * buffer, (next - current).Length/2 * buffer, dfillet)
        
    tcp_RCS = robot.get_frame_in_RCS(tcp_WCS)
    cmd = tcp_RCS.pose_axis_angle_vector + [vel, acc]
    commands.append(cmd)

print len(commands)
# ---------- end python_2 ----------
entryexitpt = PythonScript(planes=py_4, safety_distance=Slider(50, range=0..100))  # -> commands, planes; inputs planes: list
# ---------- entryexitpt: Python ----------
import Rhino.Geometry as rg
from scriptcontext import sticky as st
from compas_fab.fab.geometry import Frame

robot = st["robot"]

in_plane = _planes[0]
out_plane = _planes[-1]

safe_in_plane = rg.Plane(in_plane)
safe_out_plane = rg.Plane(out_plane)

### safe_in_plane 30 mm above start ####
safe_in_plane.Translate(rg.Vector3d(0,0,safety_distance))
safe_in_frame_WCS = Frame(safe_in_plane.Origin, safe_in_plane.XAxis, safe_in_plane.YAxis)
safe_in_frame_RCS = robot.get_frame_in_RCS(safe_in_frame_WCS)

### in_plane ###
in_frame_WCS = Frame(in_plane.Origin, in_plane.XAxis, in_plane.YAxis)
in_frame_RCS = robot.get_frame_in_RCS(in_frame_WCS)

### out_plane ###
out_frame_WCS = Frame(out_plane.Origin, out_plane.XAxis, out_plane.YAxis)
out_frame_RCS = robot.get_frame_in_RCS(out_frame_WCS)

### safe_out_plane 30 mm above start ####
safe_out_plane.Translate(rg.Vector3d(0,0,safety_distance))
safe_out_frame_WCS = Frame(safe_out_plane.Origin, safe_out_plane.XAxis, safe_out_plane.YAxis)
safe_out_frame_RCS = robot.get_frame_in_RCS(safe_out_frame_WCS)


planes = safe_in_plane, in_plane, out_plane, safe_out_plane


acc = 50
vel = 50


commands = []
commands.append(safe_in_frame_RCS.pose_axis_angle_vector + [acc, vel])
#commands.append(in_frame_RCS.pose_axis_angle_vector + [acc, vel])

#commands.append(out_frame_RCS.pose_axis_angle_vector + [acc, vel])
commands.append(safe_out_frame_RCS.pose_axis_angle_vector + [acc, vel])


print commands
# ---------- end entryexitpt ----------
pln = Plane(entryexitpt.planes)

entryexitpt_2 = PythonScript(planes=py_3, safety_distance=Slider(30, range=0..100))  # -> commands, planes; inputs planes: list
# ---------- entryexitpt_2: Python ----------
import Rhino.Geometry as rg
from scriptcontext import sticky as st
from compas_fab.fab.geometry import Frame

robot = st["robot"]

in_plane = _planes[0]
out_plane = _planes[-1]

safe_in_plane = rg.Plane(in_plane)
safe_out_plane = rg.Plane(out_plane)

### safe_in_plane 30 mm above start ####
safe_in_plane.Translate(rg.Vector3d(0,0,safety_distance))
safe_in_frame_WCS = Frame(safe_in_plane.Origin, safe_in_plane.XAxis, safe_in_plane.YAxis)
safe_in_frame_RCS = robot.get_frame_in_RCS(safe_in_frame_WCS)

### in_plane ###
in_frame_WCS = Frame(in_plane.Origin, in_plane.XAxis, in_plane.YAxis)
in_frame_RCS = robot.get_frame_in_RCS(in_frame_WCS)

### out_plane ###
out_frame_WCS = Frame(out_plane.Origin, out_plane.XAxis, out_plane.YAxis)
out_frame_RCS = robot.get_frame_in_RCS(out_frame_WCS)

### safe_out_plane 30 mm above start ####
safe_out_plane.Translate(rg.Vector3d(0,0,safety_distance))
safe_out_frame_WCS = Frame(safe_out_plane.Origin, safe_out_plane.XAxis, safe_out_plane.YAxis)
safe_out_frame_RCS = robot.get_frame_in_RCS(safe_out_frame_WCS)


planes = safe_in_plane, in_plane, out_plane, safe_out_plane


acc = 100
vel = 50


commands = []
commands.append(safe_in_frame_RCS.pose_axis_angle_vector + [acc, vel])
commands.append(in_frame_RCS.pose_axis_angle_vector + [acc, vel])

commands.append(out_frame_RCS.pose_axis_angle_vector + [acc, vel])
commands.append(safe_out_frame_RCS.pose_axis_angle_vector + [acc, vel])


print commands
# ---------- end entryexitpt_2 ----------
# TOPICS: overhangs
# surface based
# volume based
# mesh optimisation
pln_2 = Plane(entryexitpt_2.planes)

continue_fabrication = BooleanToggle(True)
panel_10 = Panel("Send a message")
send_2 = Button()
commands = Data(python)
# 4
send_3 = PythonScript(
    client=client.client,
    send=send_2,
    continue_fabrication=continue_fabrication,
    in_out_cmd=entryexitpt_2.commands,
    tools=tools.tools_2,
    commands=commands,
    cmd_gravel=python_2,
    cmd_gravel_in_out=entryexitpt.commands)  # -> out; inputs continue_fabrication: Int32, in_out_cmd: list, tools: list, commands: list, cmd_gravel_in_out: list
# ---------- send_3: Python ----------
from ur_online_control.communication.msg_identifiers import *
from ur_online_control.utilities.lists import flatten_list

len_command = len(commands[0])
commands_flattened = flatten_list(commands)

safe_in_pose_cmd, in_pose_cmd, out_pose_cmd, safe_out_pose_cmd = in_out_cmd

tool_string, tool_gravel = tools
tool_string_axis = tool_string.tcp_frame.pose_axis_angle_vector
tool_gravel_axis = tool_gravel.tcp_frame.pose_axis_angle_vector

### Gravel placment ###

safe_in_pose_gravel, safe_out_pose_gravel = cmd_gravel_in_out 
pose_gravel = cmd_gravel

if send and client:
    ### string_fabrication ###
    client.send(MSG_INT, int(continue_fabrication))
    client.send(MSG_FLOAT_LIST, tool_string_axis) ### set string_tcp ###
    client.send(MSG_FLOAT_LIST, safe_in_pose_cmd)
    client.send(MSG_INT, len_command)
    client.send(MSG_FLOAT_LIST, commands_flattened)
    client.send(MSG_FLOAT_LIST, safe_out_pose_cmd)
    
    ### gravel placment ###
    client.send(MSG_FLOAT_LIST, tool_gravel_axis) ### set gravel_tcp ###
    client.send(MSG_FLOAT_LIST, safe_in_pose_gravel)
    client.send(MSG_FLOAT_LIST, pose_gravel)
    client.send(MSG_FLOAT_LIST, safe_out_pose_gravel)
# ---------- end send_3 ----------

send_4 = PythonScript(client=receive.client)  # -> out
# ---------- send_4: Python ----------
from ur_online_control.communication.msg_identifiers import *
from ur_online_control.utilities.lists import flatten_list

if client:
    qsize = client.rcv_queue.qsize()
    if qsize:
        msg = client.rcv_queue.get()
        print msg
# ---------- end send_4 ----------
panel_11 = Panel(send_4)
panel_12 = Panel(send_3)

# ----
# Direct UR control
get = Button()
get_2 = Button()
pose = PythonScript(get=get_2)  # -> pose_joints
# ---------- pose: Python ----------
from scriptcontext import sticky as st
from ur_online_control.ur_direct import get_current_pose_joints

server_address = st["server_address"]
server_port = 30005
ur_ip = st["ur_ip"]
robot = st["robot"]
tool_angle_axis = robot.tool.tcp_frame.pose_axis_angle_vector
print tool_angle_axis

guid = str(ghenv.Component.InstanceGuid)
pose_joints_key = "pose_joints" + guid


if get:
    st[pose_joints_key] = get_current_pose_joints(server_address, server_port, ur_ip, tool_angle_axis)
    
if pose_joints_key not in st:
    pose_joints = []
else:
    pose_joints = st[pose_joints_key]
# ---------- end pose ----------
pose_2 = PythonScript(get=get)  # -> pose_cartesian
# ---------- pose_2: Python ----------
from scriptcontext import sticky as st
from ur_online_control.ur_direct import get_current_pose_cartesian

server_address = st["server_address"]
server_port = 30005
ur_ip = st["ur_ip"]
robot = st["robot"]
tool_angle_axis = robot.tool.tcp_frame.pose_axis_angle_vector
print tool_angle_axis

guid = str(ghenv.Component.InstanceGuid)
pose_cartesian_key = "pose_cartesian" + guid


if get:
    st[pose_cartesian_key] = get_current_pose_cartesian(server_address, server_port, ur_ip, tool_angle_axis)

if pose_cartesian_key not in st:
    pose_cartesian = []
else:
    pose_cartesian = st[pose_cartesian_key]
# ---------- end pose_2 ----------
stop = Button()
stop_2 = PythonScript(stop=stop)
# ---------- stop_2: Python ----------
from scriptcontext import sticky as st
from ur_online_control.ur_direct import stop as stop_robot

ur_ip = st["ur_ip"]

if stop:
    stop_robot(ur_ip)
# ---------- end stop_2 ----------
panel_13 = Panel(pose)
panel_14 = Panel(pose_2)

# ----
# Visualisation
pose_joints = Data(pose)
planes_wcs = Plane(py_3)
robot_2 = Data(robot)

# ---- group: Calculate joint positions for path
# Add init joint states
joint_states = Data([-0.1728179112, -1.415058186, 1.813991282, -1.971940356, -1.571654205, -3.308720436])
init_configuration = Slider(2, range=0..7)
py_5 = PythonScript(robot=robot_2, planes_WCS=planes_wcs, configuration_idx=init_configuration, init_configuration=joint_states)  # -> configurations; inputs planes_WCS: list, configuration_idx: Int32, init_configuration: list
# ---------- py_5: Python ----------
import Rhino.Geometry as rg
from compas_fab.fab.geometry import Frame, Transformation
from compas_fab.fab.grasshopper import xdraw_frame
from compas_fab.fab.robots.ur.kinematics import calculate_configurations_for_path, format_joint_positions


# TODO this must be optimized! matrix multiplication!
frames_tool0_RCS = []
for plane_WCS in planes_WCS:
    tcp_WCS = Frame(plane_WCS.Origin, plane_WCS.XAxis, plane_WCS.YAxis)
    tcp_RCS = robot.get_frame_in_RCS(tcp_WCS)
    frames_tool0_RCS.append(robot.get_tool0_frame_from_tcp_frame(tcp_RCS))
    

configurations = calculate_configurations_for_path(frames_tool0_RCS, robot.params, init_configuration)

configurations = configurations[min([configuration_idx, len(configurations) - 1])]

def format(numbers, k=4):
    #numbers = format_joint_positions(numbers)
    return "[" + ", ".join([("%." + str(k) + "f") % n for n in numbers]) + "]"

print "Q1 = ", format(configurations[0])
print "Q2 = ", format(configurations[10])
print "Q3 = ", format(configurations[20])

"""
Q1 =  [-0.1727, -1.4144, 1.8145, -1.9709, -1.5708, 2.9757]
Q2 =  [-0.6497, -1.4872, 1.7623, -1.7329, -1.7115, -2.4608]
Q3 =  [-1.2111, -1.9716, 2.4040, -1.9940, -1.6098, -2.9102]
"""
# ---------- end py_5 ----------
start_2 = Button()
stop_3 = Button()
step = Button()
counter = CountThroughList(L=py_5, start=start_2, stop=stop_3, step=step, interval=100)  # -> item; inputs L: list, start: Boolean, stop: Boolean
# ---------- counter: Python ----------
from scriptcontext import sticky as st
from compas_fab.fab.grasshopper import gh_component_timer


# store data in component
guid = str(ghenv.Component.InstanceGuid)
counter_key = "counter_" + guid
running_key = "running_" + guid

if counter_key not in st:
    st[counter_key] = 0

if running_key not in st:
    st[running_key] = False

if start:
    st[running_key] = True

if stop:
    st[running_key] = False

if step:
    if st[counter_key] < len(L) - 1:
        st[counter_key] += 1
    
if len(L):
    item = L[st[counter_key]]

if st[running_key]:
    if st[counter_key] < len(L) - 1:
        st[counter_key] += 1
        gh_component_timer(ghenv, interval)
    else:
        st[counter_key] = 0
        st[running_key] = False
# ---------- end counter ----------

# ----
vertical_pose = Number([-152.427, -780.635, 855.229, -1.1958, -1.22046, -1.20201])
py_6 = PythonScript(pose_cartesian=pose_2)  # -> frame_WCS; inputs pose_cartesian: list
# ---------- py_6: Python ----------
import Rhino.Geometry as rg
from scriptcontext import sticky as st
from compas_fab.fab.geometry import Frame, Transformation

robot = st["robot"]

if pose_cartesian:
    frame_RCS = Frame.from_pose_axis_angle_vector(pose_cartesian)
    frame_WCS = robot.get_frame_in_WCS(frame_RCS)
    
    print frame_WCS
# ---------- end py_6 ----------

# ---- group: Define plane in WCS, calculate joint positions
select_configuration = Slider(0, range=0..7)
pt_2 = Point(Point(161.5375279, -573.1989596, 433.9356602))
xy = XYPlane(Origin=pt_2)
plane_wcs = Plane(xy)
inverse = PythonScript(robot=robot_2, plane_WCS=plane_wcs, idx=select_configuration)  # -> configuration; inputs plane_WCS: Plane, idx: Int32
# ---------- inverse: Python ----------
import Rhino.Geometry as rg
from compas_fab.fab.geometry import Frame, Transformation
from compas_fab.fab.grasshopper import xdraw_frame

tcp_WCS = Frame(plane_WCS.Origin, plane_WCS.XAxis, plane_WCS.YAxis)

# transform frame to robot coordinate system
tcp_RCS = robot.get_frame_in_RCS(tcp_WCS)

# get the frame of tool0
tool0_RCS = robot.get_tool0_frame_from_tcp_frame(tcp_RCS)

# calculate solutions to frame
solutions = robot.inverse_kinematics(tool0_RCS)

if not len(solutions):
    q = [0,0,0,0,0,0]
else:
    idx = min(len(solutions) - 1, idx)
    q = solutions[idx]
    
print q

configuration = q
# ---------- end inverse ----------

# ---- group: Calculate joint positions for path / Shows joint positions along path
flip = BooleanToggle(True)
l2t = PythonScript(L=py_5, flip=flip)  # -> T; inputs L: list, flip: Boolean
# ---------- l2t: Python ----------
from compas_fab.fab.grasshopper import list_to_tree

if flip:
    L = zip(*L)
T = list_to_tree(L)
# ---------- end l2t ----------
graph = QuickGraph(l2t)

# ----
draw = Draw(frame=py_6)  # -> G, C

# ---- group: Define joint positions
elbow = Slider(158.393, range=-360..360)
wrist2 = Slider(89, range=-360..360)
base_2 = Slider(-214.102, range=-360..360)
shoulder = Slider(-57.05, range=-360..360)
wrist1 = Slider(-108.821, range=-360..360)
wrist3 = Slider(-33.607, range=-360..360)
ur1_q1_q6 = Data([base_2, wrist3, shoulder, wrist2, elbow, wrist1])
rad = Radians(Degrees=ur1_q1_q6)

# ----
preview = CustomPreview(Geometry=draw.G, Shader=draw.C)

# ----
# Calculate basis
# Measure basis:
# 1. Clear the recorded poses
# 2. Move robot to origin and press "get pose"
# 3. Move robot to point in positive x-axis and press "get pose"
# 4. Move robot to an other point in your basis and press "get pose"
# (The farer away these positions are, the better)
# 
# 5. Alternatively change the order in the component calc base
# 6. Copy output into base component
list_3 = ValueList({"origin, pt on positive x-axis, pt in xy plane": 0, "origin, pt on positive y-axis, pt in xy plane": 1}, selected="origin, pt on positive x-axis, pt in xy plane")
clear = Button()
rec = PythonScript(msg=pose_2, rec=get, clear=clear)  # -> rec; inputs msg: list
# ---------- rec: Python ----------
from scriptcontext import sticky as st

guid = str(ghenv.Component.InstanceGuid)
recorded_key =  "recorded_" + guid
just_cleared_key = "just_cleared_" + guid

if recorded_key not in st:
    st[recorded_key] = []

if just_cleared_key not in st:
    st[just_cleared_key] = False

if clear:
    st[recorded_key] = []
    st[just_cleared_key] = True
else:
    if len(msg):
        if msg != [None] and not st[just_cleared_key] and rec:
            st[recorded_key].append(msg)
    st[just_cleared_key] = False
        


rec = st[recorded_key]

print rec
# ---------- end rec ----------
calc_base = PythonScript(poses=rec, input_type=list_3)  # -> out; inputs poses: list
# ---------- calc_base: Python ----------
import Rhino.Geometry as rg
import math


if len(poses) > 2:
    
    O = poses[0]
    P1 = poses[1]
    P2 = poses[2]
    
    if input_type == 0:
        # origin, pt on positive x-axis, pt in xy plane
        origin = rg.Point3d(O[0], O[1], O[2])
        pt_on_xaxis = rg.Point3d(P1[0], P1[1], P1[2])
        pt_in_xyplane = rg.Point3d(P2[0], P2[1], P2[2])
        
        xaxis = pt_on_xaxis - origin
        xaxis.Unitize()
        
        v = pt_in_xyplane - origin
        zaxis = rg.Vector3d.CrossProduct(v, xaxis)
        zaxis.Unitize()
        
        # zaxis must look up!
        if math.acos(rg.Vector3d.ZAxis * zaxis) > math.acos(rg.Vector3d.ZAxis * -zaxis):
            zaxis = -zaxis
        
        yaxis = rg.Vector3d.CrossProduct(zaxis, xaxis)
    
    elif input_type == 1:
        # origin, pt on positive y-axis, pt in xy plane
        origin = rg.Point3d(O[0], O[1], O[2])
        pt_on_yaxis = rg.Point3d(P1[0], P1[1], P1[2])
        pt_in_xyplane = rg.Point3d(P2[0], P2[1], P2[2])
        
        yaxis = pt_on_yaxis - origin
        yaxis.Unitize()
        
        v = pt_in_xyplane - origin
        zaxis = rg.Vector3d.CrossProduct(v, yaxis)
        zaxis.Unitize()
        
        # zaxis must look up!
        if math.acos(rg.Vector3d.ZAxis * zaxis) > math.acos(rg.Vector3d.ZAxis * -zaxis):
            zaxis = -zaxis
        
        xaxis = rg.Vector3d.CrossProduct(yaxis, zaxis)
        
        
    print "Copy the following into base component:"
    print " "
    print "origin = [%.2f, %.2f, %.2f]" % tuple(list(origin))
    print "xaxis = [%.5f, %.5f, %.5f]" % tuple(list(xaxis))
    print "yaxis = [%.5f, %.5f, %.5f]" % tuple(list(yaxis))
    

#print rg.Vector3d.CrossProduct(rg.Vector3d.YAxis, rg.Vector3d.ZAxis)
#print rg.Vector3d.CrossProduct(rg.Vector3d.ZAxis, rg.Vector3d.XAxis)
# ---------- end calc_base ----------
panel_15 = Panel(rec)
panel_16 = Panel(calc_base)

# ---- group: Visualise / robot model brep
py_7 = PythonScript(model=list_2)  # -> n
# ---------- py_7: Python ----------
if model == "UR5":
    n = 0
if model == "UR10":
    n = 1

print n
# ---------- end py_7 ----------
ur10_brep = UR10Brep([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])
ur5_brep = UR5Brep([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])
show_brep = BooleanToggle(False)
filter = StreamFilter(Gate=py_7, Stream0=ur5_brep, Stream1=ur10_brep)

# ---- group: Visualise
list_4 = ValueList({"0 forward, from angles": 0, "1 inverse, from one plane": 1, "2 inverse, from multiple planes": 2, "3 forward, from robot": 3}, selected="1 inverse, from one plane")
filter_2 = StreamFilter(Gate=list_4, Stream0=rad, Stream1=inverse, Stream2=counter, Stream3=pose_joints)
configuration = Panel(filter_2)
mesh = Mesh(filter)
draw_2 = PythonScript(robot=robot_2, configuration=filter_2, mesh=mesh, brep=filter, show_brep=show_brep)  # -> meshes, tool0_plane, tcp_plane, robot_brep; inputs configuration: list, mesh: list, brep: list
# ---------- draw_2: Python ----------
from compas_fab.fab.grasshopper import xdraw_frame
from compas_fab.fab.grasshopper import draw_mesh 
from compas_fab.fab.grasshopper import xform_from_transformation
from compas_fab.fab.geometry import Frame, Transformation
from compas_fab.fab.geometry.helpers import mesh_update_vertices

import Rhino.Geometry as rg
import Rhino

q = configuration

if len(q):

    R0, R1, R2, R3, R4, R5 = robot.get_forward_transformations(q)
    
    tool0_frame2 = robot.tool0_frame.transform(R5, copy=True)
    tcp_frame2 = Frame.from_transformation(Transformation.from_frame(tool0_frame2) * robot.transformation_tool0_tcp)
    
    print robot.transformation_tool0_tcp
    print robot.transformation_tcp_tool0
    print robot.transformation_tool0_tcp * robot.transformation_tcp_tool0
    print tcp_frame2
    tcp_frame2 = Frame.from_transformation(Transformation.from_frame(tool0_frame2) * robot.transformation_tcp_tool0)
    print tcp_frame2
    
    
    tool0_frame, tcp_frame = robot.get_transformed_tool_frames(R5)
    
    tool0_frame = tool0_frame2
    tcp_frame = tcp_frame2
    
    m0, m1, m2, m3, m4, m5 = mesh
    for i in range(6):
        exec("R%drg = xform_from_transformation(R%d)" % (i, i))
        exec("m%d.Transform(R%drg)" % (i, i))
    meshes = [m0, m1, m2, m3, m4, m5]
    
    mt = robot.get_transformed_tool_model(tcp_frame)
    if mt:
        meshes.append(draw_mesh(mt))
    
    """
    m0, m1, m2, m3, m4, m5, tool0_frame, tcp_frame = robot.get_transformed_model(q)
    mt = robot.get_transformed_tool_model(tcp_frame)
    
    meshes = []
    meshes.append(draw_mesh(m0))
    meshes.append(draw_mesh(m1))
    meshes.append(draw_mesh(m2))
    meshes.append(draw_mesh(m3))
    meshes.append(draw_mesh(m4))
    meshes.append(draw_mesh(m5))
    if mt:
        meshes.append(draw_mesh(mt))
    
    """
    
    tool0_plane = xdraw_frame(tool0_frame)
    tcp_plane = xdraw_frame(tcp_frame)
    
    if show_brep:
        
        b0, b1, b2, b3, b4, b5 = brep
        
        b0.Transform(R0rg)
        b1.Transform(R1rg)
        b2.Transform(R2rg)
        b3.Transform(R3rg)
        b4.Transform(R4rg)
        b5.Transform(R5rg)
        
        robot_brep = [b0, b1, b2, b3, b4, b5]
# ---------- end draw_2 ----------
robot_brep = Brep(draw_2.robot_brep)
tcp_plane = Plane(draw_2.tcp_plane)
tool0_plane = Plane(draw_2.tool0_plane)
draw_3 = RepresentPlaneAsLines(plane=tcp_plane, size=100)  # -> G, C
# ---------- draw_3: Python ----------
import Rhino.Geometry as rg
from System.Drawing import Color

if plane:

    G = []
    G.append(rg.Line(plane.Origin, size * plane.XAxis))
    G.append(rg.Line(plane.Origin, size * plane.YAxis))
    G.append(rg.Line(plane.Origin, size * plane.ZAxis))
    
    C = []
    C.append(Color.FromArgb(255, 0, 0))
    C.append(Color.FromArgb(0, 255, 0))
    C.append(Color.FromArgb(0, 0, 255))
# ---------- end draw_3 ----------
preview_2 = CustomPreview(Geometry=draw_2.meshes, Shader=ColourSwatch(SwatchColor=RGBA(99, 94, 94, 96)))
preview_3 = CustomPreview(Geometry=draw_3.G, Shader=draw_3.C)

# ---- group: Send joint position directly to robot
panel_17 = Panel("move cartesian")
idx = Slider(0, range=0..100)
commands_2 = Data(python)
item = ListItem(List=commands_2, Index=idx, Wrap=True)
list_5 = ValueList({"send all positions": 0, "send only one position": 1}, selected="send only one position")
filter_3 = StreamFilter(Gate=list_5, Stream0=commands_2, Stream1=item)
movel = PythonScript(commands=filter_3, velocity=Slider(100, range=0..100))  # -> script; inputs commands: list
# ---------- movel: Python ----------
from scriptcontext import sticky as st

script_lines = []
for cmd in commands:
    #q, a=1.4, v=1.05, t=0, r=0)
    x, y, z, ax, ay, az, speed, radius = cmd
    script_lines.append("movel(p%s, v=%f, r=%f)" % (str([x/1000., y/1000., z/1000, ax, ay, az]), speed/1000., radius/1000.))

robot = st["robot"]
tool_angle_axis = robot.tool.tcp_frame.pose_axis_angle_vector
x, y, z, ax, ay, az = tool_angle_axis

script = "def prog():\n"
script += "\ttextmsg(\">> program start\")\n"
script += "\tset_tcp(p%s)\n" % str([x/1000., y/1000., z/1000, ax, ay, az])
script += "".join(["\t%s\n" % line for line in script_lines])
script += "\ttextmsg(\"<< program end\")\n"
script += "end\n"
script += "prog()\n\n"

print script
# ---------- end movel ----------
send_5 = Button()
send_6 = Send(script=movel, send=send_5)
panel_18 = Panel(send_6)

# ----
panel_19 = Panel("move vertical")
movel_2 = PythonScript()  # -> script
# ---------- movel_2: Python ----------
from scriptcontext import sticky as st

robot = st["robot"]
tool_angle_axis = robot.tool.tcp_frame.pose_axis_angle_vector
x, y, z, ax, ay, az = tool_angle_axis

script = "def prog():\n"
script += "\ttextmsg(\">> program start\")\n"
script += "\tset_tcp(p%s)\n" % str([x/1000., y/1000., z/1000, ax, ay, az])
script += "\tcurrent_pose = get_forward_kin()\n"
script += "\tmovel(p[current_pose[0], current_pose[1], current_pose[2], 0, 0, 0], a=0.1, v=0.1)\n"
script += "\ttextmsg(\"<< program end\")\n"
script += "end\n"
script += "prog()\n\n"

print script
# ---------- end movel_2 ----------
send_7 = Button()
send_8 = Send(script=movel_2, send=send_7)
panel_20 = Panel(send_8)

panel_21 = Panel("set digital out")
number_2 = Slider(2, range=0..10)
value = BooleanToggle(False)
digital_out = PythonScript(number=number_2, value=value)  # -> script; inputs number: Int32, value: Boolean
# ---------- digital_out: Python ----------
script = "def prog():\n"
script += "\ttextmsg(\">> program start\")\n"
script += "\tset_digital_out(%i, %s)\n" % (int(number), str(value))
script += "\ttextmsg(\"<< program end\")\n"
script += "end\n"
script += "prog()\n\n"

print script
# ---------- end digital_out ----------
send_9 = Button()
send_10 = Send(script=digital_out, send=send_9)
panel_22 = Panel(send_10)

# ----
# move incremental in WCS
number_slider_4 = Slider(5, range=-10..10)
list_6 = ValueList({"xaxis", "yaxis", "zaxis"}, selected="zaxis")
movel_3 = PythonScript(step_size=number_slider_4, direction=list_6)  # -> script
# ---------- movel_3: Python ----------
from scriptcontext import sticky as st

robot = st["robot"]
tool_angle_axis = robot.tool.tcp_frame.pose_axis_angle_vector
x, y, z, ax, ay, az = tool_angle_axis

script = "def prog():\n"
script += "\ttextmsg(\">> program start\")\n"
script += "\tset_tcp(p%s)\n" % str([x/1000., y/1000., z/1000, ax, ay, az])
script += "\tcurrent_pose = get_forward_kin()\n"


if direction == "xaxis":
    script += "\tmovel(p[current_pose[0] + %f, current_pose[1], current_pose[2], current_pose[3], current_pose[4], current_pose[5]], t=%f)\n" % (step_size/1000., step_size * 0.1)

elif direction == "yaxis":
    script += "\tmovel(p[current_pose[0], current_pose[1] + %f, current_pose[2], current_pose[3], current_pose[4], current_pose[5]], t=%f)\n" % (step_size/1000., step_size * 0.1)

else: # direction == "zaxis":
    script += "\tmovel(p[current_pose[0], current_pose[1], current_pose[2] + %f, current_pose[3], current_pose[4], current_pose[5]], t=%f)\n" % (step_size/1000., step_size * 0.1)

script += "\ttextmsg(\"<< program end\")\n"
script += "end\n"
script += "prog()\n\n"

print script
# ---------- end movel_3 ----------
send_11 = Button()
send_12 = Send(script=movel_3, send=send_11)
panel_23 = Panel(send_12)

# ----
# move incremental in TCS
get_current_pose = Button()
list_7 = ValueList({"xaxis", "yaxis", "zaxis"}, selected="zaxis")
movel_4 = PythonScript(get=get_current_pose, step_size=Slider(5, range=-10..10), direction=list_7)  # -> script; inputs get: list
# ---------- movel_4: Python ----------
from scriptcontext import sticky as st
from compas_fab.fab.geometry import Frame
from compas.geometry.objects import Point, Vector
from ur_online_control.ur_direct import get_current_pose_cartesian

server_address = st["server_address"]
server_port = 30005
ur_ip = st["ur_ip"]
robot = st["robot"]
tool_angle_axis = robot.tool.tcp_frame.pose_axis_angle_vector
print tool_angle_axis

guid = str(ghenv.Component.InstanceGuid)
pose_cartesian_key = "pose_cartesian" + guid

if get:
    st[pose_cartesian_key] = get_current_pose_cartesian(server_address, server_port, ur_ip, tool_angle_axis)

if pose_cartesian_key not in st:
    pose_cartesian = []
    script = ""
else:
    pose_cartesian = st[pose_cartesian_key]

    robot = st["robot"]
    tool_angle_axis = robot.tool.tcp_frame.pose_axis_angle_vector
    x, y, z, ax, ay, az = tool_angle_axis
    
    script = "def prog():\n"
    script += "\ttextmsg(\">> program start\")\n"
    script += "\tset_tcp(p%s)\n" % str([x/1000., y/1000., z/1000, ax, ay, az])
    script += "\tcurrent_pose = get_forward_kin()\n"
    
    frame = Frame.from_pose_axis_angle_vector(pose_cartesian)
    
    if direction == "xaxis":
        next_vector = Vector(*frame.xaxis) * step_size
    elif direction == "yaxis":
        next_vector = Vector(*frame.yaxis) * step_size
    else: # direction == "zaxis":
        next_vector = Vector(*frame.zaxis) * step_size
    
    x, y, z = next_vector
    script += "\tmovel(p[current_pose[0] + %f, current_pose[1] + %f, current_pose[2] + %f, current_pose[3], current_pose[4], current_pose[5]], t=%f)\n" % (x/1000., y/1000., z/1000., step_size * 0.1)
    
    script += "\ttextmsg(\"<< program end\")\n"
    script += "end\n"
    script += "prog()\n\n"
    
    print script
# ---------- end movel_4 ----------
send_13 = Button()
send_14 = Send(script=movel_4, send=send_13)
panel_24 = Panel(send_14)

# ---- group: Send joint position directly to robot
joint_positions = Data(py_5)
idx_2 = Slider(0, range=0..100)
panel_25 = Panel("move joints")
item_2 = ListItem(List=joint_positions, Index=idx_2, Wrap=True)
list_8 = ValueList({"send all positions": 0, "send only one position": 1}, selected="send only one position")
filter_4 = StreamFilter(Gate=list_8, Stream0=joint_positions, Stream1=item_2)
movej = PythonScript(joint_positions=filter_4, velocity=Slider(153, range=0..200))  # -> script; inputs joint_positions: list
# ---------- movej: Python ----------
script_lines = []

for position in joint_positions:
    script_lines.append("movej(%s, v=%f)" % (str(position), velocity/1000.))


script = "def prog():\n"
script += "\ttextmsg(\">> program start\")\n"
script += "".join(["\t%s\n" % line for line in script_lines])
script += "\ttextmsg(\"<< program end\")\n"
script += "end\n"
script += "prog()\n\n"


print script

#script = ""
# ---------- end movej ----------
send_15 = Button()

# ----
send_16 = Send(script=movej, send=send_15)

# ---- group: Send joint position directly to robot (continued)
panel_26 = Panel(send_16)

# ==== cluster Tools
tool_id = ClusterInput()

# ---- group: measurement tool
measurement_tool_geo = Geometry([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])
tool = PythonScript(brep=measurement_tool_geo)  # -> tool; inputs brep: list
# ---------- tool: Python ----------
from compas_fab.fab.robots.ur.tools import MeasurementTool

tool = MeasurementTool()
tool.brep = brep
# ---------- end tool ----------

# ----
test_geometry = Geometry([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])
yaxis_line = Curve(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)
xaxis_line = Curve(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)
mesh = Mesh(test_geometry)
brep = Brep(test_geometry)
tool_2 = Tool(M=mesh, brep=brep, xline=xaxis_line, yline=yaxis_line)

yaxis_line_2 = Curve(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)
test_geometry_2 = Geometry([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])
xaxis_line_2 = Curve(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)
brep_2 = Brep(test_geometry_2)
mesh_2 = Mesh(test_geometry_2)
tool_3 = Tool(M=mesh_2, brep=brep_2, xline=xaxis_line_2, yline=yaxis_line_2)

test_geometry_3 = Geometry([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])
yaxis_line_3 = Curve(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)
xaxis_line_3 = Curve(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)
brep_3 = Brep(test_geometry_3)
mesh_3 = Mesh(test_geometry_3)
tool_4 = Tool(M=mesh_3, brep=brep_3, xline=xaxis_line_3, yline=yaxis_line_3)

tool_id_2 = Integer(tool_id)
filter = StreamFilter(Gate=tool_id_2, Stream1=tool, Stream2=tool_3, Stream3=tool_4)
tools = Data([tool_3, tool_4])
py = PythonScript(tool=filter)  # -> tcp_frame, model
# ---------- py: Python ----------
from compas_fab.fab.grasshopper import draw_mesh 

tcp_frame = tool.tcp_frame
model = draw_mesh(tool.model)
# ---------- end py ----------
tool_5 = Data(filter)
draw = PythonScript(frame=py.tcp_frame)  # -> G, C
# ---------- draw: Python ----------
import Rhino.Geometry as rg
from System.Drawing import Color

if not size:
    size = 100

if frame:
    
    plane = rg.Plane(rg.Point3d(*frame.point), rg.Vector3d(*frame.xaxis), rg.Vector3d(*frame.yaxis))

    G = []
    G.append(rg.Line(plane.Origin, size * plane.XAxis))
    G.append(rg.Line(plane.Origin, size * plane.YAxis))
    G.append(rg.Line(plane.Origin, size * plane.ZAxis))
    
    C = []
    C.append(Color.FromArgb(255, 0, 0))
    C.append(Color.FromArgb(0, 255, 0))
    C.append(Color.FromArgb(0, 0, 255))
# ---------- end draw ----------
tool_6 = ClusterOutput(tool_5)
preview = CustomPreview(Geometry=draw.G, Shader=draw.C)
tools_2 = ClusterOutput(tools)
preview_2 = CustomPreview(Geometry=py.model, Shader=ColourSwatch(SwatchColor=RGB(141, 170, 178)))

# ==== cluster Send
script = ClusterInput()
send = ClusterInput()
send_2 = PythonScript(script=script, send=send)  # -> out
# ---------- send_2: Python ----------
import socket
from scriptcontext import sticky as st

ur_ip = st["ur_ip"]
ur_port = 30002

if send:
    s = socket.create_connection((ur_ip, ur_port), timeout=0.5) 
    s.send(script)
    s.close()
# ---------- end send_2 ----------
out = ClusterOutput(send_2)

# ==== cluster Draw
size = ClusterInput()
frame = ClusterInput()
draw = PythonScript(frame=frame, size=size)  # -> G, C; same code as draw
G = ClusterOutput(draw.G)
C = ClusterOutput(draw.C)

# ==== cluster Tool
M = ClusterInput()
mjoin = MeshJoin(Meshes=M)
brep = ClusterInput()
xline = ClusterInput()
yline = ClusterInput()
tool = PythonScript(mesh=mjoin, brep=brep, xline=xline, yline=yline)  # -> tool; inputs mesh: Mesh, brep: list
# ---------- tool: Python ----------
import Rhino.Geometry as rg
from compas_fab.fab.geometry import Frame
from compas_fab.fab.robots import Tool
from compas.datastructures.mesh import Mesh

xaxis = rg.Line(xline.PointAtStart, xline.PointAtEnd)
yaxis = rg.Line(yline.PointAtStart, yline.PointAtEnd)

if xaxis.From.DistanceTo(yaxis.From) < 0.01:
    origin = xaxis.From
    xaxis = xaxis.Direction
    yaxis = yaxis.Direction
elif xaxis.To.DistanceTo(yaxis.To) < 0.01:
    origin = xaxis.To
    xaxis = -xaxis.Direction
    yaxis = -yaxis.Direction
elif xaxis.From.DistanceTo(yaxis.To) < 0.01:
    origin = xaxis.From
    xaxis = xaxis.Direction
    yaxis = -yaxis.Direction
elif xaxis.To.DistanceTo(yaxis.From) < 0.01:
    origin = xaxis.To
    xaxis = -xaxis.Direction
    yaxis = yaxis.Direction

xaxis.Unitize()
yaxis.Unitize()

print origin
print xaxis
print yaxis

tcp_frame = Frame(origin, xaxis, yaxis)
vertices = [[v.X, v.Y, v.Z] for v in mesh.Vertices]
faces = map(list, mesh.Faces)

tool = Tool(tcp_frame)
tool.model = Mesh.from_vertices_and_faces(vertices, faces)
tool.model_xyz = tool.model.xyz
tool.brep = brep
# ---------- end tool ----------
tool_2 = ClusterOutput(tool)
