# Grasshopper definition InterWeavePattern.gh (Grasshopper 0.9.76)

amplitude = Slider(0.6, range=0..10)
udiv = Slider(16, range=2..50)
vdiv = Slider(25, range=2..153)
radius = Slider(0.2, range=0..1)
crv = Curve([<curve referenced from the Rhino model> x3])
num = Number(amplitude)
loft = Loft(Curves=crv, Options={Adjust=False, Closed=False, LoftEnds=3, LoftSimp=0, LoftType=0, Rebuild=10, Refit=0.01})

num_2 = Number(num)
srf = Surface(loft)
Z = UnitZ(Factor=num_2)
move = Move(Geometry=srf, Motion=Z)  # -> Geometry, Transform
srf_2 = Surface(move.Geometry)

srf_3 = Surface(srf_2)
radius_2 = Number(radius)
udiv_2 = Integer(udiv)
vdiv_2 = Integer(vdiv)
ampl = Number(amplitude)
clu_interweave = CLU_InterWeave(srf=srf_3, udiv=udiv_2, vdiv=vdiv_2, ampl=ampl)  # -> crvu0_2, crvu1_2, crvv0_2, crvv1_2
radius_3 = Number(radius_2)
crvu1 = Curve(clu_interweave.crvu1_2)
crvv0 = Curve(clu_interweave.crvv0_2)
crvu0 = Curve(clu_interweave.crvu0_2)
crvv1 = Curve(clu_interweave.crvv1_2)
pipe = Pipe(Curve=crvu0, Radius=radius_3, Caps=0)
pipe_2 = Pipe(Curve=crvu1, Radius=radius_3, Caps=0)
pipe_3 = Pipe(Curve=crvv0, Radius=radius_3, Caps=0)
pipe_4 = Pipe(Curve=crvv1, Radius=radius_3, Caps=0)

# ==== cluster CLU_InterWeave
vdiv = ClusterInput()
srf = ClusterInput()
udiv = ClusterInput()
ampl = ClusterInput()
panel = Panel("""True
False""")
panel_2 = Panel("""True
False""")
panel_3 = Panel("""True
False""")
panel_4 = Panel("""True
False""")

ampl_2 = Number(ampl)
udiv_2 = Integer(udiv)
vdiv_2 = Integer(vdiv)
srf_2 = Surface(srf)
sdivide = DivideSurface(Surface=srf_2, UCount=udiv_2, VCount=vdiv_2)  # -> simplify(Points), Normals, Parameters
amp = Amplitude(Vector=sdivide.Normals, Amplitude=ampl_2)
points = PointList(Points=sdivide.Points)

rev = Reverse(Vector=amp)
move = Move(Geometry=sdivide.Points, Motion=amp)  # -> Geometry, Transform
move_2 = Move(Geometry=sdivide.Points, Motion=rev)  # -> Geometry, Transform
pt = Point(move_2.Geometry)
pt_bottom = Point(pt)

pt_2 = Point(move.Geometry)

pt_top = Point(pt_2)

panel_5 = Panel("""False
True""")
pt_3 = Point(pt_bottom)
bool = Boolean(panel_5)
viewer = ParamViewer(pt_3)
txt = Text(viewer)
cull = CullPattern(List=txt, CullPattern=bool)
branch = TreeBranch(Tree=pt_3, Path=cull, MaintainPaths=True)
renumber = RenumberPaths(Data=branch)
pt_4 = Point(renumber)

panel_6 = Panel("""False
True""")
pt_5 = Point(pt_top)
bool_2 = Boolean(panel_6)
viewer_2 = ParamViewer(pt_5)
txt_2 = Text(viewer_2)
cull_2 = CullPattern(List=txt_2, CullPattern=bool_2)
branch_2 = TreeBranch(Tree=pt_5, Path=cull_2, MaintainPaths=True)
renumber_2 = RenumberPaths(Data=branch_2)
pt_6 = Point(renumber_2)

panel_7 = Panel("""True
False""")
pt_7 = Point(pt_bottom)
bool_3 = Boolean(panel_7)
viewer_3 = ParamViewer(pt_7)
txt_3 = Text(viewer_3)
cull_3 = CullPattern(List=txt_3, CullPattern=bool_3)
branch_3 = TreeBranch(Tree=pt_7, Path=cull_3, MaintainPaths=True)
renumber_3 = RenumberPaths(Data=branch_3)
pt_8 = Point(renumber_3)

panel_8 = Panel("""True
False""")
pt_9 = Point(pt_top)
bool_4 = Boolean(panel_8)
viewer_4 = ParamViewer(pt_9)
txt_4 = Text(viewer_4)
cull_4 = CullPattern(List=txt_4, CullPattern=bool_4)
branch_4 = TreeBranch(Tree=pt_9, Path=cull_4, MaintainPaths=True)
renumber_4 = RenumberPaths(Data=branch_4)
pt_10 = Point(renumber_4)

pt_bottomeven = Point(pt_8)
pt_bottomodd = Point(pt_4)
pt_topeven = Point(pt_10)
pt_topodd = Point(pt_6)

bool_5 = Boolean(reverse(panel_3))
pt_11 = Point(pt_topodd)
bool_6 = Boolean(panel_3)
cull_5 = CullPattern(List=pt_11, CullPattern=bool_6)
cull_6 = CullPattern(List=pt_11, CullPattern=bool_5)
pt_12 = Point(cull_6)
pt_13 = Point(cull_5)

bool_7 = Boolean(reverse(panel_2))
pt_14 = Point(pt_bottomeven)
bool_8 = Boolean(panel_2)
cull_7 = CullPattern(List=pt_14, CullPattern=bool_8)
cull_8 = CullPattern(List=pt_14, CullPattern=bool_7)
pt_15 = Point(cull_7)
pt_16 = Point(cull_8)

bool_9 = Boolean(reverse(panel))
pt_17 = Point(pt_bottomodd)
bool_10 = Boolean(panel)
cull_9 = CullPattern(List=pt_17, CullPattern=bool_10)
cull_10 = CullPattern(List=pt_17, CullPattern=bool_9)
pt_18 = Point(cull_9)
pt_19 = Point(cull_10)

bool_11 = Boolean(reverse(panel_4))
pt_20 = Point(pt_topeven)
bool_12 = Boolean(panel_4)
cull_11 = CullPattern(List=pt_20, CullPattern=bool_12)
cull_12 = CullPattern(List=pt_20, CullPattern=bool_11)
pt_21 = Point(cull_11)
pt_22 = Point(cull_12)

pt_bottomeveneven = Point(pt_15)
pt_bottomoddeven = Point(pt_18)
pt_bottomevenodd = Point(pt_16)
pt_bottomoddodd = Point(pt_19)
pt_topeveneven = Point(pt_21)
pt_topoddeven = Point(pt_13)
pt_topevenodd = Point(pt_22)
pt_topoddodd = Point(pt_12)

pt_23 = Point(pt_bottomeveneven)
pt_24 = Point(pt_topevenodd)
merge = Merge(Data1=pt_24, Data2=pt_23)
pdecon = Deconstruct(Point=merge)  # -> XComponent, YComponent, ZComponent
sort = SortList(Keys=pdecon.YComponent, ValuesA=merge)  # -> Keys, ValuesA
pt_25 = Point(sort.ValuesA)

pt_26 = Point(pt_bottomevenodd)
pt_27 = Point(pt_topoddodd)
flip = FlipMatrix(Data=pt_27)
flip_2 = FlipMatrix(Data=pt_26)
merge_2 = Merge(Data1=flip, Data2=flip_2)
sort_pt = SortPoints(Points=merge_2)  # -> Points, Indices
pt_28 = Point(sort_pt.Points)

pt_29 = Point(pt_bottomoddeven)
pt_30 = Point(pt_topeveneven)
flip_3 = FlipMatrix(Data=pt_30)
flip_4 = FlipMatrix(Data=pt_29)
merge_3 = Merge(Data1=flip_3, Data2=flip_4)
sort_pt_2 = SortPoints(Points=merge_3)  # -> Points, Indices
pt_31 = Point(sort_pt_2.Points)

pt_32 = Point(pt_bottomoddodd)
pt_33 = Point(pt_topoddeven)
merge_4 = Merge(Data1=pt_33, Data2=pt_32)
pdecon_2 = Deconstruct(Point=merge_4)  # -> XComponent, YComponent, ZComponent
sort_2 = SortList(Keys=pdecon_2.YComponent, ValuesA=merge_4)  # -> Keys, ValuesA
pt_34 = Point(sort_2.ValuesA)

intcrv = Interpolate(Vertices=pt_31, Degree=3, Periodic=False, KnotStyle=1)  # -> Curve, Length, Domain
intcrv_2 = Interpolate(Vertices=pt_28, Degree=3, Periodic=False, KnotStyle=1)  # -> Curve, Length, Domain
intcrv_3 = Interpolate(Vertices=pt_25, Degree=3, Periodic=False, KnotStyle=1)  # -> Curve, Length, Domain
intcrv_4 = Interpolate(Vertices=pt_34, Degree=3, Periodic=False, KnotStyle=1)  # -> Curve, Length, Domain
crvu0 = Curve(intcrv.Curve)
crvu1 = Curve(intcrv_2.Curve)
crvv0 = Curve(intcrv_4.Curve)
crvv1 = Curve(intcrv_3.Curve)
crvu0_2 = ClusterOutput(crvu0)
crvu1_2 = ClusterOutput(crvu1)
crvv0_2 = ClusterOutput(crvv0)
crvv1_2 = ClusterOutput(crvv1)
