# Grasshopper definition graphMapperFromCurve.gh (Grasshopper 0.9.76)

ndiv = Slider(18, range=10..20)
fontsize = Slider(1, range=0..1)
t0 = Slider(0, range=0..2)
t1 = Slider(1, range=0..3)
crv_outerrectangle = Curve(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)
pt_graphcurvepts = Point([Point(29.25664035, -56.34588636, 0), Point(39.06749231, -55.83639296, 0), Point(50.49021735, -53.96639978, 0), Point(44.4669419, -57.77616879, 0), Point(63.9234032, -55.48313877, 0), Point(76.5646215, -37.51655066, 0), Point(56.79137641, -41.98171138, 0)])
dom = ConstructDomain(DomainStart=t0, DomainEnd=t1)
crv_outerrectangle_2 = Curve(crv_outerrectangle)
pt_graphcurvepts_2 = Point(pt_graphcurvepts)
domain_refdomain = Domain(dom)
num_fontsize = Number(fontsize)
int_ndiv = Integer(ndiv)
clu_graphmapper = CLU_GraphMapper(
    crv_outerrectangle=crv_outerrectangle_2,
    pt_graphcurvepts=pt_graphcurvepts_2,
    int_ndiv=int_ndiv,
    domain_refdomain=domain_refdomain,
    num_fontsize=num_fontsize)
num_values = Number(clu_graphmapper)

# ==== cluster CLU_GraphMapper
crv_outerrectangle = ClusterInput()
pt_graphcurvepts = ClusterInput()
int_ndiv = ClusterInput()
domain_refdomain = ClusterInput()
num_fontsize = ClusterInput()
crv_outerrectangle_2 = Curve(crv_outerrectangle)
domain_refdomain_2 = Domain(domain_refdomain)
pt_graphcurvepts_2 = Point(pt_graphcurvepts)
num_fontsize_2 = Number(num_fontsize)
int_ndiv_2 = Integer(int_ndiv)
num_fontsize_3 = Number(num_fontsize_2)

crv = Curve(crv_outerrectangle_2)
disc = Discontinuity(Curve=crv, Level=1)  # -> Points, Parameters
pt = Point(disc.Points)
item = ListItem(List=pt, Index=0, Wrap=True)  # -> Item, Item1, Item2, Item3
ln = Line(StartPoint=item.Item, EndPoint=item.Item1)
ln_2 = Line(StartPoint=item.Item, EndPoint=item.Item3)
line_axisx = Line(ln)
line_axisy = Line(ln_2)
pt_origin = Point(item.Item)

domain_refdomain_3 = Domain(domain_refdomain_2)
pt_graphcurvepts_3 = Point(pt_graphcurvepts_2)
line_axisx_2 = Line(line_axisx)
line_axisy_2 = Line(ln_2)
pt_origin_2 = Point(pt_origin)
int_ndiv_3 = Integer(int_ndiv_2)

pt_ptstosort = Point(pt_graphcurvepts_3)
line_refline = Line(line_axisx_2)
python = PythonScript(line=line_refline, pt=pt_ptstosort)  # -> out, a; inputs line: Line, pt: Point3d
# ---------- python: Python ----------
import Rhino.Geometry as rg
a = rg.Line.ClosestParameter(line, pt);
# ---------- end python ----------
sort = SortList(Keys=python.a, ValuesA=pt_ptstosort)  # -> Keys, ValuesA
pt_sortedpts = Point(sort.ValuesA)
intcrv = Interpolate(Vertices=pt_sortedpts, Degree=3, Periodic=False, KnotStyle=1)  # -> Curve, Length, Domain
crv_graphcurve = Curve(intcrv.Curve)
pt_sortedpts_2 = Point(pt_sortedpts)

domain_refdomain_4 = Domain(domain_refdomain_3)
pt_graphcurvepts_4 = Point(pt_graphcurvepts_3)
crv_graphcurve_2 = Curve(crv_graphcurve)
pt_sortedpts_3 = Point(pt_sortedpts_2)
line_axisx_3 = Line(line_axisx_2)
line_axisy_3 = Line(line_axisy_2)
pt_origin_3 = Point(pt_origin_2)
int_ndiv_4 = Integer(int_ndiv_3)

domain_refdomain_5 = Domain(domain_refdomain_4)
crv_graphcurve_3 = Curve(crv_graphcurve_2)
line_axisx_4 = Line(line_axisx_3)
line_axisy_4 = Line(line_axisy_3)
int_ndiv_5 = Integer(int_ndiv_4)
Z = UnitZ(Factor=1)
xprod = CrossProduct(VectorA=Z, VectorB=line_axisx_4, Unitize=False)  # -> Vector, Length
divide = DivideCurve(Curve=line_axisx_4, Count=int_ndiv_5, Kinks=False)  # -> simplify(graft(Points)), Tangents, Parameters
line = LineSDL(Start=divide.Points, Direction=xprod.Vector, Length=1)
clx = CurveLine(Curve=crv_graphcurve_3, Line=line)  # -> Points, Params, Count
num_lengthy = Number(line_axisy_4)
ln_3 = Line(StartPoint=divide.Points, EndPoint=clx.Points)
shift = ShiftPaths(Data=clx.Points, Offset=-1)
domain_refdomain_6 = Domain(domain_refdomain_5)
num_dist = Number(ln_3)
domain = Domain(num_lengthy)
intcrv_2 = Interpolate(Vertices=flatten(shift), Degree=3, Periodic=False, KnotStyle=1)  # -> Curve, Length, Domain
remap = RemapNumbers(Value=num_dist, Source=domain, Target=domain_refdomain_6)  # -> simplify(Mapped), Clipped
line_2 = Line(ln_3)
num_values = Number(remap.Mapped)
crv_graphcurveremapped = Curve(intcrv_2.Curve)

num_size = Number(num_fontsize_3)
pt_origin_4 = Point(pt_origin_3)
line_axisx_5 = Line(line_axisx_3)
line_axisy_5 = Line(line_axisy_3)
end = EndPoints(Curve=line_axisx_5)  # -> Start, End
end_2 = EndPoints(Curve=line_axisy_5)  # -> Start, End
tag = TextTag3D(Location=pt_origin_4, Text="0", Size=num_size, Justification=3)
tag_2 = TextTag3D(Location=end.End, Text="X", Size=num_size, Justification=1)
tag_3 = TextTag3D(Location=end_2.End, Text="Y", Size=num_size, Justification=3)

crv_graphcurveremapped_2 = Curve(crv_graphcurveremapped)
domain_refdomain_7 = Domain(domain_refdomain_4)
pt_graphcurvepts_5 = Point(pt_graphcurvepts_4)
crv_graphcurve_4 = Curve(crv_graphcurve_2)
pt_sortedpts_4 = Point(pt_sortedpts_3)
num_values_2 = Number(num_values)
num_values_3 = ClusterOutput(num_values_2)
line_axisx_6 = Line(line_axisx_3)
line_axisy_6 = Line(line_axisy_3)
pt_origin_5 = Point(pt_origin_3)
int_ndiv_6 = Integer(int_ndiv_4)
line_3 = Line(line_2)
