# Grasshopper definition MeshSurface.gh (Grasshopper 0.9.76)

srf = Surface(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)

int = Integer(Slider(7, range=0..10))
srf_2 = Surface(srf)
int_2 = Integer(Slider(10, range=0..10))
sdivide = DivideSurface(Surface=srf_2, UCount=int, VCount=int_2)  # -> Points, Normals, Parameters
addition = Addition(A=int_2, B=1)
int_3 = Integer(addition)
int_4 = Integer(int)
series = Series(Start=0, Step=1, Count=int_3)
pt = Point(flatten(sdivide.Points))
series_2 = Series(Start=0, Step=1, Count=int_4)
points = PointList(Points=pt)
neg = Negative(Value="1")
shift = ShiftList(List=series, Shift="1", Wrap=False)
shift_2 = ShiftList(List=series, Shift=neg, Wrap=False)
addition_2 = Addition(A=shift_2, B=int_3)
addition_3 = Addition(A=shift, B=int_3)
int_5 = Integer(simplify(graft(shift_2)))
int_6 = Integer(simplify(graft(shift)))
int_7 = Integer(simplify(graft(addition_3)))
int_8 = Integer(simplify(graft(addition_2)))
int_9 = Integer(series_2)
merge = Merge(Data1=int_5, Data2=int_6, Data3=int_7, Data4=int_8)
int_10 = Integer(graft(merge))
multiplication = Multiplication(A=int_3, B=int_9)
item = ListItem(List=merge, Index=0, Wrap=True)  # -> Item, Item1, Item2, Item3
addition_4 = Addition(A=int_10, B=multiplication)  # -> graft(Result)
quad = MeshQuad(CornerA=item.Item, CornerB=item.Item1, CornerC=item.Item2, CornerD=item.Item3)
path_mapper = PathMapper(addition_4, source="{a;b;c}", target="{a;c}")
conmesh = ConstructMesh(Vertices=pt, Faces=flatten(quad))
item_2 = ListItem(List=path_mapper, Index=0, Wrap=True)  # -> Item, Item1, Item2, Item3
quad_2 = MeshQuad(CornerA=item_2.Item, CornerB=item_2.Item1, CornerC=item_2.Item2, CornerD=item_2.Item3)
conmesh_2 = ConstructMesh(Vertices=pt, Faces=flatten(quad_2))
mesh_firstrow = Mesh(conmesh)
mesh_whole = Mesh(conmesh_2)
