# Grasshopper definition gcode_v0.18_Flow.gh (Grasshopper 0.9.76)
# plug-ins: MeshEdit Components, HDTReference, Weaverbird, Mesh Pipe, onScreen

mesh = Mesh([<mesh referenced from the Rhino model> x2])
# BASE GENERATOR
x = Panel("0")  # disabled
# G-CODE GENERATOR
x_2 = Panel("0")  # disabled

# ---- group: old?
weaverbird_s_naked_boundary = WeaverbirdsNakedBoundary(MeshClosedPolylines=mesh)  # disabled
length = Length(Curve=weaverbird_s_naked_boundary)  # disabled
# CREATE BASE CRV
sort_list = SortList(Keys=length, ValuesValuesA=weaverbird_s_naked_boundary)  # -> reverse(Keys), reverse(ValuesValuesA); disabled
list_item = ListItem(List=sort_list.ValuesValuesA, Index=0, Wrap=True)  # -> Item, Item1; disabled

# ---- group: Test Mesh
number_slider = Slider(50, range=0..100)
point = Point(Point(0, 0, 0))
unit_z = UnitZ(Factor=number_slider)
circle_cnr = CircleCNR(Center=point, Normal=Vector(0, 0, 1), Radius=number_slider)
move = Move(Geometry=circle_cnr, Motion=unit_z)  # -> Geometry, Transform
loft = Loft(
    Curves=[circle_cnr, move.Geometry],
    Options={Adjust=False, Closed=False, LoftEnds=0, LoftSimp=0, LoftType=0, Rebuild=10, Refit=0.01})
mesh_brep = MeshBrep(
    Brep=loft,
    Settings={GridMaxCount=0, GridMinCount=16, JaggedSeams=False, MaxEdgeLength=0, MinEdgeLength=0.0001, MinTolerance=0, Refine=True, RefineAngle=0, RelativeTolerance=0.65, SimplePlanes=True, Tolerance=0})

# ----
x_3 = Panel("0")

# ---- group: INPUT
outer_shells = Mesh([<mesh referenced from the Rhino model> x3])  # disabled

# ----
flowrate_reduced = Slider(0.8, range=0..2)
select_printer = ValueList({"Raise3D N2+ (2.85mm)": 0, "Raise3D N2+ (1.75mm)": 4, "DeltaTower 445": 5, "GRR-X400": 1, "Ultimaker 2": 2, "GRR-X1000": 3}, selected="Raise3D N2+ (2.85mm)")
flowrate_normal = Slider(1, range=0..2)
_1st_layer_height_mm = Slider(0.3, range=0..1)
layer_height_mm = Slider(10, range=0..100)
_1st_layer_overextrusion_factor = Slider(1.25, range=0..10)
fan_speed_0_255 = Slider(255, range=0..255)
minimum_retraction_distance_mm = Slider(3, range=0..10)
z_hop_height_mm_min = Slider(1, range=0..2)
nozzle_temerature_ºc = Slider(235, range=0..300)

select_printer_2 = ValueList({"MAC": 0, "PC": 1}, selected="MAC")

# ---- group: distance raft lines
distance_between_lines = Slider(1.6, range=0..5)
x_4 = Multiplication(A="8", B=distance_between_lines)

# ----
# Settings
panel = Panel("Hatch1")
mesh_2 = Mesh(mesh_brep)  # disabled

# ---- group: get base DATA
bounding_box = BoundingBox(Content=mesh_2, Plane=PlaneXY(0, 0, 0))  # -> Box, Box_2
# CONNECTION RINGS
mesh_weldvertices = MeshWeldVertices(Mesh=mesh_2, Tolerance=0.01)  # -> RuntimeMessage, Mesh
weaverbird_s_naked_boundary_2 = WeaverbirdsNakedBoundary(MeshClosedPolylines=mesh_weldvertices.Mesh)

# ---- group: setting height raft
x_5 = Multiplication(A=layer_height_mm, B="0.5")
addition = Addition(A=_1st_layer_height_mm, B=x_5)
addition_2 = Addition(A=addition, B=layer_height_mm)
z = UnitZ(Factor=addition)
z_2 = UnitZ(Factor=addition_2)

# ----
boolean_toggle = BooleanToggle(True)

# ---- group: checking the planars normals
planar = PlanarSrf(Edges=weaverbird_s_naked_boundary_2)
eval = EvaluateSurface(Surface=reparameterize(planar), Point=Point(0.5, 0.5, 0))  # -> Point, Normal, Frame
vcomp = Decompose(Vector=eval.Normal)  # -> XComponent, YComponent, ZComponent
smaller = SmallerThan(FirstNumber=vcomp.ZComponent, SecondNumber=0)  # -> SmallerThan, OrEqualTo
cull = CullPattern(List=weaverbird_s_naked_boundary_2, CullPattern=smaller.SmallerThan)
not = GateNot(A=smaller.SmallerThan)
flip = Flip(Curve=cull)  # -> Curve, Flag
cull_2 = CullPattern(List=weaverbird_s_naked_boundary_2, CullPattern=not)
weave = Weave(Pattern=smaller.SmallerThan, Stream0=cull_2, Stream1=flip.Curve, NullGaps=False)

# ---- group: Reducing and offsetting crv
simplify_curve = SimplifyCurve(Curve=weave, Tolerance=Slider(0.3, range=0..1), AngleTolerance=Slider(5, range=0..100))  # -> Curve, Simplified
offset_mesh_pipe_base_line = Slider(1, range=0..10)
polyline_collapse = PolylineCollapse(Polyline=simplify_curve.Curve, Tolerance=Slider(0.8, range=0..1))  # -> Polyline, Count
xy_plane = XYPlane(Origin=Point(0, 0, 0))
offset_loose = OffsetLoose(Curve=polyline_collapse.Polyline, Distance=offset_mesh_pipe_base_line, Plane=xy_plane)

# ----
# LAYER CHANGE lINES
x_6 = Panel("-1")  # disabled
list_item_2 = ListItem(Index=x_6, Wrap=True)  # -> flatten(Item), flatten(Item1); disabled
x_7 = Panel("0")  # disabled
x_8 = Panel("-1")  # disabled
cull_index = CullIndex(List=list_item_2.Item, Indices=x_7, Wrap=True)  # disabled
cull_index_2 = CullIndex(List=list_item_2.Item1, Indices=x_8, Wrap=True)  # disabled
point_on_curve = PointOnCurve(cull_index_2, parameter=0)  # disabled
point_on_curve_2 = PointOnCurve(cull_index, parameter=1)  # disabled
number_slider_2 = Slider(3, range=0..10)  # disabled
line = Line(StartPoint=point_on_curve_2, EndPoint=point_on_curve)  # disabled
mesh_pipe = MeshPipe(Curve=line, Radius=expr("x/2", layer_height_mm), Accuracy=0.2, Rotation=0, Segments=number_slider_2, Caps=2)  # disabled

x_9 = Panel(flowrate_normal)
x_10 = Panel(flowrate_reduced)

# ----
# TRAVEL LINES
x_11 = Panel("-1")  # disabled
x_12 = Panel("0")  # disabled
cull_index_3 = CullIndex(Indices=x_11, Wrap=True)  # disabled
cull_index_4 = CullIndex(Indices=x_12, Wrap=True)  # disabled
point_on_curve_3 = PointOnCurve(cull_index_4, parameter=1)  # disabled
point_on_curve_4 = PointOnCurve(cull_index_3, parameter=0)  # disabled
number_slider_3 = Slider(3, range=0..10)  # disabled
line_2 = Line(StartPoint=point_on_curve_4, EndPoint=point_on_curve_3)  # disabled
mesh_pipe_2 = MeshPipe(Curve=flatten(line_2), Radius=expr("x/2", layer_height_mm), Accuracy=0.2, Rotation=0, Segments=number_slider_3, Caps=2)  # disabled

# ----
# PRINT LINES
number_slider_4 = Slider(3, range=0..10)  # disabled
mesh_pipe_3 = MeshPipe(Radius=expr("x/2", layer_height_mm), Accuracy=0.2, Rotation=0, Segments=number_slider_4, Caps=2)  # disabled

# ---- group: Connection ring
radius_mm = Slider(1.8, range=0..10)
mesh_pipe_4 = MeshPipe(Curve=offset_loose, Radius=radius_mm, Accuracy=0.2, Rotation=0, Segments="4", Caps=2)

# ---- group: create infill top
negative = Negative(Value=radius_mm)  # disabled
list_item_3 = ListItem(List=offset_loose, Index=0, Wrap=True)  # -> Item, Item1; disabled
offset_loose_2 = OffsetLoose(Curve=list_item_3.Item1, Distance=negative)  # disabled
offset_loose_3 = OffsetLoose(Curve=list_item_3.Item1, Distance=radius_mm)  # disabled
merge = Merge(Data1=offset_loose_3, Data2=offset_loose_2)  # -> flatten(Result); disabled
boolean_toggle_2 = BooleanToggle(True)  # disabled
createhatch = CreateHatch(Bake=False, Curves=merge, HatchPatternName=panel, HatchScale=expr("x*0.3", x_4), HatchRotation=0)  # disabled
clean_tree = CleanTree(RemoveNulls=boolean_toggle_2, RemoveInvalid=boolean_toggle_2, RemoveEmpty=boolean_toggle_2, Tree=flatten(createhatch))  # -> graft(Tree); disabled
move_2 = Move(Geometry=clean_tree, Motion=expr("x*-1", z))  # -> Geometry, Transform; disabled
end_points = EndPoints(Curve=clean_tree)  # -> Start, End; disabled
end_points_2 = EndPoints(Curve=move_2.Geometry)  # -> Start, End; disabled
merge_2 = Merge(
    Data1=simplify(end_points_2.Start),
    Data2=simplify(end_points_2.End),
    Data3=simplify(end_points.End),
    Data4=simplify(end_points.Start))  # disabled
construct_mesh = ConstructMesh(Vertices=merge_2, Faces={A=0, B=1, C=2, D=3})  # disabled

# ----
# PREVIEW
colour_swatch = ColourSwatch(SwatchColor=RGBA(0, 162, 255, 63))  # disabled
colour_swatch_2 = ColourSwatch(SwatchColor=RGB(69, 153, 12))  # disabled
colour_swatch_3 = ColourSwatch(SwatchColor=RGB(0, 38, 255))  # disabled
custom_preview = CustomPreview(Geometry=mesh_pipe_3, Shader=colour_swatch_2)  # disabled
custom_preview_2 = CustomPreview(Geometry=mesh_pipe_2, Shader=colour_swatch)  # disabled
custom_preview_3 = CustomPreview(Geometry=mesh_pipe, Shader=colour_swatch_3)  # disabled

cluster = Cluster(index=select_printer)  # -> i_2, i_3, i_4, i_5, i_6, i_7, i_8, i_9, i

# ---- group: trim connection ring
deconstruct_mesh = DeconstructMesh(Mesh=mesh_pipe_4)  # -> Vertices, Faces, Colours, Normals
point_in_brep = PointInBrep(Brep=bounding_box.Box, Point=deconstruct_mesh.Vertices, Strict=False)
dispatch = Dispatch(List=deconstruct_mesh.Vertices, DispatchPattern=point_in_brep)  # -> ListA, ListB
brep_closest_point = BrepClosestPoint(Point=dispatch.ListB, Brep=bounding_box.Box)  # -> Point, Distance
weave_2 = Weave(Pattern=point_in_brep, Stream0=brep_closest_point.Point, Stream1=dispatch.ListA, NullGaps=False)
construct_mesh_2 = ConstructMesh(Vertices=weave_2, Faces=deconstruct_mesh.Faces)

# ----
offset_distance_nozzle_thickness = Slider(0.4, range=0..1)
weaverbird_s_offset_mesh = WeaverbirdsOffsetMesh(MeshCurves=construct_mesh_2, Distance=expr("x*-1", offset_distance_nozzle_thickness), OffsetType=0)

mesh_3 = Mesh([construct_mesh_2, weaverbird_s_offset_mesh])

# ----
# Not implemented yet
travel_acceleration_mm_sec2 = Slider(10, range=0..10000)
print_acceleration_mm_sec2 = Slider(8, range=0..10000)
travel_jerk_mm_sec3 = Slider(10, range=0..10)
print_jerk_mm_sec3 = Slider(8, range=0..10)

layer_width_mm = Panel("0.65")
filament_diameter_mm = Panel(cluster.i_2)
layer_height_mm_2 = Panel(layer_height_mm)
tool_head = ValueList({"One": 0, "Two": 1}, selected="One")

# ---- group: timestamp
clock = Clock(SecondHand=True)
gcode_file_path = Panel("C:\Users\rob-otter\Desktop\")
replace_text = ReplaceText(Text=clock, Find=":", Replace="_", RecursiveReplace=False)
list_item_4 = ListItem(List="myFile", Index=Slider(2, range=0..10), Wrap=True)
# Export
merge_3 = Merge(Data1=gcode_file_path, Data2=replace_text, Data3=cluster.i, Data4=list_item_4, Data5=".gcode")
text_join = TextJoin(Text=merge_3)
panel_2 = Panel(text_join)

# ---- group: SAVE
button = Button()

# ---- group: seutp for multiple lines
series = Series(Start=_1st_layer_height_mm, Step=layer_height_mm, Count=Slider(1, range=0..1))

# ---- group: INPUT
inner_shell = Mesh(mesh)

# ----
# dimensions
x_14 = Panel("0")

# ----
# Slicing
# Slicer
xy = XYPlane(Origin=Point(0, 0, 0))

# ---- group: seutp for multiple lines (continued)
contour_ex = ContourEx(Shape=mesh, Plane=xy, Offsets=series)  # -> simplify(Contours)
divide_length = DivideLength(Curve=contour_ex, Length=Slider(10, range=0..10))  # -> flatten(Points), Tangents, Parameters
alpha_shape = AlphaShape(Points=divide_length.Points, Radius=Slider(100, range=0..100), Plane=PlaneXY(0, 0, 0))

# ---- group: planarize and reduce CRV
project = Project(Geometry=alpha_shape, Plane=PlaneXY(0, 0, 0))  # -> Geometry, Transform
rebuild_curve = RebuildCurve(Curve=project.Geometry, Count=10, Tangents=False)

# ---- group: outer border
offset_loose_4 = OffsetLoose(Curve=rebuild_curve, Distance=Slider(13, range=0..100))

# ---- group: Input CRVs / can be changed to individual crvs
inner_crv = Curve(project.Geometry)
# Input CRVs
outer_crv = Curve(offset_loose_4)
merge_4 = Merge(Data1=outer_crv, Data2=inner_crv)  # -> flatten(Result)

# ----
# CREATE PATTERN
createhatch_2 = CreateHatch(Bake=False, Curves=merge_4, HatchPatternName=panel, HatchScale=x_4, HatchRotation=0)
createhatch_3 = CreateHatch(Bake=False, Curves=merge_4, HatchPatternName=panel, HatchScale=x_4, HatchRotation="pi/2")

# ---- group: raft contour / outline
curve_to_polyline = CurveToPolyline(Curve=outer_crv, ToleranceDistance="0.1", ToleranceAngle=0)  # -> simplify(Polyline), Segments
explode = Explode(Curve=curve_to_polyline.Polyline, Recursive=True)  # -> graft(Segments), Vertices

# ----
clean_tree_2 = CleanTree(RemoveNulls=boolean_toggle, RemoveInvalid=boolean_toggle, RemoveEmpty=boolean_toggle, Tree=flatten(createhatch_2))  # -> graft(Tree)
clean_tree_3 = CleanTree(RemoveNulls=boolean_toggle, RemoveInvalid=boolean_toggle, RemoveEmpty=boolean_toggle, Tree=flatten(createhatch_3))  # -> graft(Tree)

move_3 = Move(Geometry=clean_tree_3, Motion=z)  # -> Geometry, Transform
move_4 = Move(Geometry=clean_tree_3, Motion=z_2)  # -> Geometry, Transform
end_points_3 = EndPoints(Curve=move_4.Geometry)  # -> Start, End
end_points_4 = EndPoints(Curve=move_3.Geometry)  # -> Start, End
merge_5 = Merge(
    Data1=simplify(end_points_3.Start),
    Data2=simplify(end_points_3.End),
    Data3=simplify(end_points_4.End),
    Data4=simplify(end_points_4.Start))

# ----
# CREATE MESH
move_5 = Move(Geometry=clean_tree_2, Motion=z)  # -> Geometry, Transform
end_points_5 = EndPoints(Curve=move_5.Geometry)  # -> Start, End
end_points_6 = EndPoints(Curve=clean_tree_2)  # -> Start, End
merge_6 = Merge(
    Data1=simplify(end_points_5.Start),
    Data2=simplify(end_points_5.End),
    Data3=simplify(end_points_6.End),
    Data4=simplify(end_points_6.Start))

move_6 = Move(Geometry=explode.Segments, Motion=z_2)  # -> Geometry, Transform
end_points_7 = EndPoints(Curve=move_6.Geometry)  # -> Start, End
end_points_8 = EndPoints(Curve=explode.Segments)  # -> Start, End
merge_7 = Merge(
    Data1=simplify(end_points_8.Start),
    Data2=simplify(end_points_8.End),
    Data3=simplify(end_points_7.End),
    Data4=simplify(end_points_7.Start))

construct_mesh_3 = ConstructMesh(Vertices=merge_6, Faces={A=0, B=1, C=2, D=3})
construct_mesh_4 = ConstructMesh(Vertices=merge_5, Faces={A=0, B=1, C=2, D=3})
construct_mesh_5 = ConstructMesh(Vertices=merge_7, Faces={A=0, B=1, C=2, D=3})

merge_8 = Merge(Data1=construct_mesh_3, Data2=construct_mesh_4, Data3=construct_mesh_5)

# ---- group: INPUT (continued)
# Input
merge_9 = Merge(Data1=merge_8, Data2=inner_shell, Data3=outer_shells)  # -> flatten(Result)
data = Data(merge_9)

# ----
bounding_box_2 = BoundingBox(Content=flatten(data), Plane=PlaneXY(0, 0, 0), UnionBox=True)  # -> Box, Box_2
evaluate_box = EvaluateBox(Box=bounding_box_2.Box, UParameter=x_14, VParameter=x_14, WParameter="1")  # -> Plane, Point, Include
evaluate_box_2 = EvaluateBox(Box=bounding_box_2.Box, UParameter=x_14, VParameter=x_14, WParameter=x_14)  # -> Plane, Point, Include
distance = Distance(PointA=evaluate_box_2.Point, PointB=evaluate_box.Point)
division = Division(A=distance, B=layer_height_mm)

series_2 = Series(Start=_1st_layer_height_mm, Step=layer_height_mm, Count=division)
contour_ex_2 = ContourEx(Shape=data, Plane=xy, Offsets=series_2)  # -> simplify(Contours)
curve_to_polyline_2 = CurveToPolyline(Curve=contour_ex_2, ToleranceDistance="0.1", ToleranceAngle=0)  # -> reparameterize(Polyline), Segments
path_mapper = PathMapper(curve_to_polyline_2.Polyline, source="{A;B}", target="{B}")

# ---- group: BETA cleaning small lines
line_lenght_to_cull = Slider(0.5, range=0..1)  # disabled
length_2 = Length(Curve=curve_to_polyline_2.Polyline)  # disabled
larger_than = LargerThan(FirstNumber=length_2, SecondNumber=line_lenght_to_cull)  # -> LargerThan, OrEqualTo; disabled
bounds = Bounds(Numbers=flatten(length_2))  # disabled
cull_pattern = CullPattern(List=curve_to_polyline_2.Polyline, CullPattern=larger_than.LargerThan)  # disabled
path_mapper_2 = PathMapper(cull_pattern, source="{A;B}", target="{B}")  # disabled

# ----
# Custom List of Flowrates
point_on_curve_5 = PointOnCurve(path_mapper, parameter=0.5)
deconstruct = Deconstruct(Point=point_on_curve_5)  # -> XComponent, YComponent, ZComponent
domain = ConstructDomain(DomainStart=x_9, DomainEnd=x_10)
bounds_2 = Bounds(Numbers=flatten(deconstruct.ZComponent))
remap_numbers = RemapNumbers(Value=deconstruct.ZComponent, Source=bounds_2, Target=domain)  # -> Mapped, Clipped

# ---- group: create indices
tree_statistics = TreeStatistics(Tree=remap_numbers.Mapped)  # -> Paths, Length, Count
series_3 = Series(Start=0, Step=1, Count=tree_statistics.Length)  # -> simplify(Series)
boolean_toggle_3 = BooleanToggle(True)
integer = Integer(series_3)
clean_tree_4 = CleanTree(RemoveNulls=boolean_toggle_3, RemoveInvalid=boolean_toggle_3, RemoveEmpty=boolean_toggle_3, Tree=integer)

# ----
custom_preview_4 = CustomPreview(Geometry=merge_8, Shader=ColourSwatch(SwatchColor=RGB(240, 79, 67)))

# ----
# Nearest Neighbour Algorithm
vb_script_new = VBScript(myCurves=simplify(path_mapper), toSort=simplify(clean_tree_4), myBedSize=cluster.i_5)  # -> out, simplify(A), Indices, FlipFlags; inputs myCurves: tree of Curve, toSort: tree
# ---------- vb_script_new: VB ----------
    Dim myNewList As  New List (Of Curve)
    Dim myNewList2 As  New List (Of Object)
    Dim myFlips As New List (Of Boolean)
    Dim myTempA, myTempB, myMin As Double
    Dim myIndex, i, myB As New Integer
    Dim myTempC  As Curve
    Dim myTempS As Object
    Dim myTempF As Boolean = False
    Dim myTempPt As New Point3d

    For myB = 0 To myCurves.BranchCount - 1

      If myCurves.Branch(myB).Count > 0 Then

        'add first curve
        If myB = 0 Then
          myNewList2.Add(toSort.Branch(myB)(0))
          myNewList.Add(myCurves.Branch(myB)(0))
          myFlips.Add(myTempF)
          myCurves.Branch(myB).RemoveAt(0)
          toSOrt.Branch(myB).RemoveAt(0)
        Else'add first curve according to previous layer
          'find min distance to start with
          myIndex = 0
          myTempPt = myNewList(myNewList.Count - 1).PointAtEnd
          subAdjustSeam(myCurves.Branch(myB)(0), myTempPt, myBedSize)
          '
          myTempA = myTempPt.DistanceTo(myCurves.Branch(myB)(0).PointAtStart)
          myTempB = myTempPt.DistanceTo(myCurves.Branch(myB)(0).PointAtEnd)
          myTempC = myCurves.Branch(myB)(0)
          myTempS = toSort.Branch(myB)(0)
          If myTempA <= myTempB Then
            myMin = myTempA
            myTempF = False
          Else
            myMin = myTempB
            myTempC.Reverse
            myTempF = True
          End If

          For i = 1 To myCurves.Branch(myB).Count - 1
            myTempPt = myNewList(myNewList.Count - 1).PointAtEnd
            subAdjustSeam(myCurves.Branch(myB)(i), myTempPt, myMin)
            '
            myTempA = myTempPt.DistanceTo(myCurves.Branch(myB)(i).PointAtStart)
            myTempB = myTempPt.DistanceTo(myCurves.Branch(myB)(i).PointAtEnd)
            If myTempA <= myTempB Then
              If myTempA <= myMin Then
                myMin = myTempA
                myTempC = myCurves.Branch(myB)(i)
                myTempS = toSort.Branch(myB)(i)
                myTempF = False
                myIndex = i
              End If
            Else If myTempB <= myMin Then
              myMin = myTempB
              myTempC = myCurves.Branch(myB)(i)
              myTempS = toSOrt.Branch(myB)(i)
              myTempC.Reverse
              'myTempS.Reverse
              myTempF = True
              myIndex = i
            End If
          Next
          myNewList.Add(myTempC)
          myNewList2.Add(myTempS)
          myFlips.Add(myTempF)
          myCurves.Branch(myB).RemoveAt(myIndex)
          toSort.Branch(myB).RemoveAt(myIndex)
          'If myIndex <> 0 Then
          '  myCurves.Branch(myB).Add(myCurves.Branch(myB)(0))
          'End If
        End If

        If myCurves.Branch(myB).Count > 0 Then

          While myCurves.Branch(myB).Count > 1

            myIndex = 0

            'find min distance to start with
            myTempPt = myNewList(myNewList.Count - 1).PointAtEnd
            subAdjustSeam(myCurves.Branch(myB)(0), myTempPt, myBedSize)
            '
            myTempA = myTempPt.DistanceTo(myCurves.Branch(myB)(0).PointAtStart)
            myTempB = myTempPt.DistanceTo(myCurves.Branch(myB)(0).PointAtEnd)
            myTempC = myCurves.Branch(myB)(0)
            myTempS = toSort.Branch(myB)(0)
            If myTempA <= myTempB Then
              myMin = myTempA
              myTempF = False
            Else
              myMin = myTempB
              myTempC.Reverse
              myTempF = True
            End If

            'loop all curves in myCurves
            For i = 1 To myCurves.Branch(myB).Count - 1
              myTempPt = myNewList(myNewList.Count - 1).PointAtEnd
              subAdjustSeam(myCurves.Branch(myB)(i), myTempPt, myMin)
              '
              myTempA = myTempPt.DistanceTo(myCurves.Branch(myB)(i).PointAtStart)
              myTempB = myTempPt.DistanceTo(myCurves.Branch(myB)(i).PointAtEnd)
              If myTempA <= myTempB Then
                If myTempA <= myMin Then
                  myMin = myTempA
                  myTempC = myCurves.Branch(myB)(i)
                  myTempS = toSort.Branch(myB)(i)
                  myIndex = i
                  myTempF = False
                End If
              Else If myTempB <= myMin Then
                myMin = myTempB
                myTempC = myCurves.Branch(myB)(i)
                myTempC.Reverse
                myTempS = toSort.Branch(myB)(i)
                'myTempS.Reverse
                myIndex = i
                myTempF = True
              End If
            Next

            myNewList.Add(myTempC)
            myNewList2.Add(myTempS)
            myFlips.Add(myTempF)
            myCurves.Branch(myB).RemoveAt(myIndex)
            toSort.Branch(myB).RemoveAt(myIndex)

          End While

          'add the last curve
          myTempPt = myNewList(myNewList.Count - 1).PointAtEnd
          subAdjustSeam(myCurves.Branch(myB)(0), myTempPt, myBedSize)
          '
          myTempA = myTempPt.DistanceTo(myCurves.Branch(myB)(0).PointAtStart)
          myTempB = myTempPt.DistanceTo(myCurves.Branch(myB)(0).PointAtEnd)
          'myTempC = myCurves.Branch(myB)(0)
          If myTempA > myTempB Then
            myCurves.Branch(myB)(0).Reverse
            myTempF = True
          Else
            myTempF = False
          End If
          myNewList.Add(myCurves.Branch(myB)(0))
          myNewList2.Add(toSort.Branch(myB)(0))
          myFlips.Add(myTempF)
        End If
      End If

    Next

    A = myNewList
    Indices = myNewList2
    FlipFlags = myFlips
# ---------- vb_script_new: VB additional code ----------
  Sub subAdjustSeam (ByRef mySubCurve As Curve,
    ByVal mySubPoint As Point3d,
    ByVal mySubDist As Double)

    Dim myPar As New Double

    mySubCurve.ClosestPoint(mySubPoint, myPar, mySubDist)
    mySubCurve.ChangeClosedCurveSeam(myPar)

  End Sub
# ---------- end vb_script_new ----------

unflatten_crv = UnflattenTree(Tree=vb_script_new.A, Guide=path_mapper)
list_of_polylines = Curve(unflatten_crv)
unflatten_crv_2 = UnflattenTree(Tree=vb_script_new.Indices, Guide=path_mapper)
# Flow rates
explode_2 = Explode(Curve=flatten(list_of_polylines), Recursive=True)  # -> Segments, simplify(Vertices)
list_item_5 = ListItem(List=remap_numbers.Mapped, Index=unflatten_crv_2, Wrap=True)  # -> flatten(Item)
list_length = ListLength(List=explode_2.Vertices)
graft_tree = GraftTree(Tree=list_item_5, IncludeEmptyLists=True, IncludeNullItems=True)
duplicate_data = DuplicateData(Data=graft_tree, Number=list_length, Order=True)

# ---- group: time estimation
length_3 = Length(Curve=flatten(list_of_polylines))
speed___3600mm_min = Panel("3600")
_60_minutes_h = Panel("60")
mass_addition = MassAddition(Input=length_3)  # -> Result, PartialResults
division_2 = Division(A=mass_addition.Result, B=speed___3600mm_min)
division_3 = Division(A=division_2, B=_60_minutes_h)
integer_2 = Integer(division_3)
printing_time = Panel(integer_2)

# ---- group: Tree structure; after each branch there is a retraction
deconstruct_2 = Deconstruct(Point=explode_2.Vertices)  # -> XComponent, YComponent, ZComponent

# ----
# G-Code
gcode_maker = VBScript(
    x=deconstruct_2.XComponent,
    y=deconstruct_2.YComponent,
    z=deconstruct_2.ZComponent,
    layW=layer_width_mm,
    layH=layer_height_mm_2,
    layHOne=_1st_layer_height_mm,
    myOverF=_1st_layer_overextrusion_factor,
    filD=filament_diameter_mm,
    myflow=duplicate_data,
    myExtrudeSpeed=cluster.i_6,
    myTravelSpeed=cluster.i_7,
    myLowSpeed=cluster.i_8,
    myFan=fan_speed_0_255,
    myTemp=nozzle_temerature_ºc,
    myRetSpeed=cluster.i_4,
    myRetraction=cluster.i_3,
    myMinRet=minimum_retraction_distance_mm,
    myZHop=z_hop_height_mm_min,
    tool=tool_head,
    myBedTemp=cluster.i_9)  # -> out, A; inputs x: tree, y: tree, z: tree, myflow: tree
# ---------- gcode_maker: VB ----------
    'Variable declaration
    Dim gPath As New List (Of String)
    Dim i, b As New Integer
    Dim tmPath As String
    Dim tmpF, reL, tmpE, myZ, tmpflow As New Double
    Dim myRetChk, myFanZ As New Boolean

    'variable initialization
    myRetChk = True
    myFanZ = False


    'Header
    gPath.Add("T" & tool & "                   ;set Tool")
    gPath.Add("G21                             ;metric values")
    gPath.Add("G90                             ;absolute positioning")
    gPath.Add("M107                            ;start With the fan Off")
    gPath.Add("M190 S" & myBedTemp & "         ;Set Bed Temperature and Wait")
    gPath.Add("M104 S" & myTemp & "            ;Set Extruder Temperature")
    gPath.Add("M109 S" & myTemp & "            ;Set Extruder Temperature and Wait")
    gPath.Add("G28                             ;home all axes")
    gPath.Add("G92 E0                          ;zero the extruded length")
    gPath.Add("G1 F4500                        ;set feedrate to 4500 mm/min(75mm/s)")
    gPath.Add("M83                             ;set E-values to relative while in absolute mode")
    'gPath.Add("M106 S" & myFan & "             ;set fan on to 200/255 speed")
    gPath.Add("G1 X0 Y0 Z0                     ;move to base center")
    gPath.Add("M117 print...                   ;show up text on LCD")


    'Set initial Feedrate
    tmPath = "G1 F" & myLowSpeed
    gPath.Add(tmPath)

    'move nozzle up
    gPath.Add("G1 Z10 E4                       ;move nozzle up 10mm")
    gPath.Add("G1 E4                           ;extrude 4mm")

    'Set extrude Feedrate
    gPath.Add("G1 F" & myLowSpeed & "         ; Set Extrude Feedrate")

    'for each branch:
    For b = 0 To x.BranchCount - 1

      'Fan On:
      If (Not myFanZ) And (z.Branch(b)(0) > 0.7) Then
        myFanZ = True
        gPath.Add("M106 S" & myFan & "             ;set fan on to 200/255 speed")
      End If

      'First instruction
      tmPath = "G1 X" & FormatNumber(x.Branch(b)(0), 3,,, False) & " Y" & FormatNumber(y.Branch(b)(0), 3,,, False) & " Z" & FormatNumber(z.Branch(b)(0), 3,,, False)

      gPath.Add(tmPath)

      'reverse retract after first polyline
      If (b > 0) And myRetChk Then
        gPath.Add("G1 F" & myRetSpeed & "          ;set retraction speed")
        gPath.Add("G1" & " Z" & FormatNumber(z.Branch(b)(0), 3,,, False) & "          ;Reverse ZHop")
        gPath.Add("G1" & " E" & myRetraction & "            ;reverse filament retraction")
        If Not myFanZ Then
          gPath.Add("G1" & " F" & myLowSpeed & "          ;set Low speed")
        Else
          gPath.Add("G1" & " F" & myExtrudeSpeed & "          ;set extrusion speed")
        End If
      End If

      'Loop points
      For i = 1 To x.Branch(b).Count - 1

        'Calculate relative length
        reL = ((x.Branch(b)(i) - x.Branch(b)(i - 1)) ^ 2 + (y.Branch(b)(i) - y.Branch(b)(i - 1)) ^ 2 + (z.Branch(b)(i) - z.Branch(b)(i - 1)) ^ 2) ^ 0.5
        tmpflow = myflow.Branch(b)(i)
        print(tmpflow)
        'Calculate feedrate
        'tmpE = 4 * reL * layH * (layW - layH + (Math.PI * (layH ^ 3)) / 4) / (math.PI * (filD ^ 2))
        If z.Branch(b)(i) > layHOne Then
          tmpE = (4 * reL * layH * layW / (math.PI * (filD ^ 2))) * tmpflow
        Else
          tmpE = (myOverF * 4 * reL * layHOne * layW / (math.PI * (filD ^ 2)))
        End If


        'Concatenate gCode instruction:
        tmPath = "G1 X" & FormatNumber(x.Branch(b)(i), 3,,, False) & " Y" & FormatNumber(y.Branch(b)(i), 3,,, False) & " Z" & FormatNumber(z.Branch(b)(i), 3,,, False) & " E" & FormatNumber(tmpE, 5,,, False) ' & " D=" & reL
        gPath.Add(tmPath)

      Next

      'retract after each branch/contour
      'Check if minimum retraction distance condition is met
      If b < x.BranchCount - 1 Then
        If myMinRet < ((x.Branch(b + 1)(0) - x.Branch(b)(x.Branch(b).Count - 1)) ^ 2 + (y.Branch(b + 1)(0) - y.Branch(b)(y.Branch(b).Count - 1)) ^ 2 + (z.Branch(b + 1)(0) - z.Branch(b)(z.Branch(b).Count - 1)) ^ 2) ^ 0.5 Then
          gPath.Add("G1 F" & myRetSpeed & "                  ;set retraction speed")
          gPath.Add("G1" & " E" & -myRetraction & "          ;retract filament")
          gPath.Add("G1" & " Z" & FormatNumber(z.Branch(b)(z.Branch(b).Count - 1) + myZHop, 3,,, False) & "          ;ZHop")
          gPath.Add("G1" & " F" & myTravelSpeed & "          ;set travel speed")
          myRetChk = True
        Else
          myRetChk = False
        End If
      End If

    Next


    'Footer
    gPath.Add("M106 S0                     ;set fan on to 200/255 speed")
    gPath.Add("M201 X500 Y500              ;Set acceleration To 500mm/s^2")
    gPath.Add("G1" & " F 1000              ;set travel speed to 1000 mm/min")
    gPath.Add("G1 X0 Y0                    ;Home X and Y")
    gPath.Add("M104 S0                     ;extruder heater Off")
    gPath.Add("M140 S0                     ;heated bed heater Off(If you have it)")
    gPath.Add("M84                         ;steppers off")

    A = gPath
# ---------- end gcode_maker ----------

# ---- group: choose computer
# .gcode exporter
gcode_file_path_2 = Panel(text_join)
gcode_file_path_3 = Panel("C:\Users\WinJimPanse\Desktop\PVA.gcode")
list_item_6 = ListItem(List=[gcode_file_path_3, gcode_file_path_2], Index=select_printer_2, Wrap=True)
vb_script = VBScript(myPath=list_item_6, myGCode=gcode_maker.A, save=button)  # -> out, A; inputs myGCode: list
# ---------- vb_script: VB ----------
    If save = True Then:
      IO.File.WriteAllText(myPath, String.Join(Environment.NewLine, myGcode))
      A = "File written to " & myPath & " at " & DateTime.Now
    Else:

    End If
# ---------- end vb_script ----------

# ==== cluster Cluster
_1st_layer_feed_rate = Panel("""2000
1500
100
2000
1500""")
retract_speed = Panel("""100
1000
1500
3600
1200
3600""")
heated_bed = Panel("""40
40
0
60
40""")
filament = Panel("""2.85
2.85
2.85
1.75
1.75
2.85""")
bed_size = Panel("""300
400
200
800
300
300""")
printer = Panel("""_IDEA_
_X400_
_UM_
_x1000_
_Delta_""")
travel_feedrate = Panel("""4800
4800
200
4800
9000""")
retract = Panel("""0.02
0.3
5.5
1.0
1.0
7.0""")
feedrate = Panel("""3600
3600
200
3600
3600
3600""")
index = ClusterInput()
list_item = ListItem(List=printer, Index=index, Wrap=True)
list_item_2 = ListItem(List=filament, Index=index, Wrap=True)
list_item_3 = ListItem(List=retract, Index=index, Wrap=True)
list_item_4 = ListItem(List=retract_speed, Index=index, Wrap=True)
list_item_5 = ListItem(List=bed_size, Index=index, Wrap=True)
list_item_6 = ListItem(List=feedrate, Index=index, Wrap=True)
list_item_7 = ListItem(List=travel_feedrate, Index=index, Wrap=True)
list_item_8 = ListItem(List=_1st_layer_feed_rate, Index=index, Wrap=True)
list_item_9 = ListItem(List=heated_bed, Index=index, Wrap=True)
i = ClusterOutput(list_item)
i_2 = ClusterOutput(list_item_2)
i_3 = ClusterOutput(list_item_3)
i_4 = ClusterOutput(list_item_4)
i_5 = ClusterOutput(list_item_5)
i_6 = ClusterOutput(list_item_6)
i_7 = ClusterOutput(list_item_7)
i_8 = ClusterOutput(list_item_8)
i_9 = ClusterOutput(list_item_9)
