# Grasshopper definition tutorial_part1+part2.gh (Grasshopper 0.9.76)
# plug-ins: Python Interpreter, treesloth01, LunchBox

height = Slider(20, range=10..25)
nsections = Slider(23, range=10..50)
nverticals = Slider(40, range=10..50)
numberofverticals = Number(nverticals)
numberofsections = Number(nsections)
num_fontsize = Number(Slider(1, range=0..1))
height_2 = Number(height)
pta = Point(<point referenced from the Rhino model>)
ptb = Point(<point referenced from the Rhino model>)
ptc = Point(<point referenced from the Rhino model>)
numberofsections_2 = Number(numberofsections)
numberofverticals_2 = Number(numberofverticals)
num_fontsize_2 = Number(num_fontsize)
height_3 = Number(height_2)
pta_2 = Point(pta)
ptb_2 = Point(ptb)
ptc_2 = Point(ptc)
numberofsections_3 = Number(numberofsections_2)
num_fontsize_3 = Number(num_fontsize_2)

t0 = Slider(-0.4, range=-2..2)
t1 = Slider(3, range=0..3)
crv_outerrectangle = Curve(<curve referenced from the Rhino model>)
pt_graphcurvepts = Point([<point referenced from the Rhino model> x7])
num_fontsize_4 = Number(num_fontsize_3)
int_ndiv = Integer(numberofsections_3)
dom = ConstructDomain(DomainStart=t0, DomainEnd=t1)
crv_outerrectangle_2 = Curve(crv_outerrectangle)
pt_graphcurvepts_2 = Point(pt_graphcurvepts)
domain_refdomain = Domain(dom)
num_fontsize_5 = Number(num_fontsize_4)
int_ndiv_2 = Integer(int_ndiv)
clu_graphmapper = CLU_GraphMapper(
    crv_outerrectangle=crv_outerrectangle_2,
    pt_graphcurvepts=pt_graphcurvepts_2,
    int_ndiv=int_ndiv_2,
    domain_refdomain=domain_refdomain,
    num_fontsize=num_fontsize_5)
num_values = Number(clu_graphmapper)

t0_2 = Slider(-0.4, range=-2..2)
t1_2 = Slider(3, range=0..3)
crv_outerrectangle_3 = Curve(<curve referenced from the Rhino model>)
pt_graphcurvepts_3 = Point([<point referenced from the Rhino model> x7])
num_fontsize_6 = Number(num_fontsize_3)
int_ndiv_3 = Integer(numberofsections_3)
dom_2 = ConstructDomain(DomainStart=t0_2, DomainEnd=t1_2)
crv_outerrectangle_4 = Curve(crv_outerrectangle_3)
pt_graphcurvepts_4 = Point(pt_graphcurvepts_3)
domain_refdomain_2 = Domain(dom_2)
num_fontsize_7 = Number(num_fontsize_6)
int_ndiv_4 = Integer(int_ndiv_3)
clu_graphmapper_2 = CLU_GraphMapper(
    crv_outerrectangle=crv_outerrectangle_4,
    pt_graphcurvepts=pt_graphcurvepts_4,
    int_ndiv=int_ndiv_4,
    domain_refdomain=domain_refdomain_2,
    num_fontsize=num_fontsize_7)
num_values_2 = Number(clu_graphmapper_2)

t0_3 = Slider(-0.15, range=-2..2)
t1_3 = Slider(2.74, range=0..3)
crv_outerrectangle_5 = Curve(<curve referenced from the Rhino model>)
pt_graphcurvepts_5 = Point([<point referenced from the Rhino model> x7])
num_fontsize_8 = Number(num_fontsize_3)
int_ndiv_5 = Integer(numberofsections_3)
dom_3 = ConstructDomain(DomainStart=t0_3, DomainEnd=t1_3)
crv_outerrectangle_6 = Curve(crv_outerrectangle_5)
pt_graphcurvepts_6 = Point(pt_graphcurvepts_5)
domain_refdomain_3 = Domain(dom_3)
num_fontsize_9 = Number(num_fontsize_8)
int_ndiv_6 = Integer(int_ndiv_5)
clu_graphmapper_3 = CLU_GraphMapper(
    crv_outerrectangle=crv_outerrectangle_6,
    pt_graphcurvepts=pt_graphcurvepts_6,
    int_ndiv=int_ndiv_6,
    domain_refdomain=domain_refdomain_3,
    num_fontsize=num_fontsize_9)
num_values_3 = Number(clu_graphmapper_3)

t0_4 = Slider(0, range=0..2)
t1_4 = Slider(1.11, range=0..3)
crv_outerrectangle_7 = Curve(<curve referenced from the Rhino model>)
pt_graphcurvepts_7 = Point([<point referenced from the Rhino model> x7])
num_fontsize_10 = Number(num_fontsize_3)
int_ndiv_7 = Integer(numberofsections_3)
dom_4 = ConstructDomain(DomainStart=t0_4, DomainEnd=t1_4)
crv_outerrectangle_8 = Curve(crv_outerrectangle_7)
pt_graphcurvepts_8 = Point(pt_graphcurvepts_7)
domain_refdomain_4 = Domain(dom_4)
num_fontsize_11 = Number(num_fontsize_10)
int_ndiv_8 = Integer(int_ndiv_7)
clu_graphmapper_4 = CLU_GraphMapper(
    crv_outerrectangle=crv_outerrectangle_8,
    pt_graphcurvepts=pt_graphcurvepts_8,
    int_ndiv=int_ndiv_8,
    domain_refdomain=domain_refdomain_4,
    num_fontsize=num_fontsize_11)
num_values_4 = Number(clu_graphmapper_4)

t0_5 = Slider(0, range=0..2)
t1_5 = Slider(2, range=0..3)
crv_outerrectangle_9 = Curve(<curve referenced from the Rhino model>)
pt_graphcurvepts_9 = Point([<point referenced from the Rhino model> x7])
num_fontsize_12 = Number(num_fontsize_3)
int_ndiv_9 = Integer(numberofsections_3)
dom_5 = ConstructDomain(DomainStart=t0_5, DomainEnd=t1_5)
crv_outerrectangle_10 = Curve(crv_outerrectangle_9)
pt_graphcurvepts_10 = Point(pt_graphcurvepts_9)
domain_refdomain_5 = Domain(dom_5)
num_fontsize_13 = Number(num_fontsize_12)
int_ndiv_10 = Integer(int_ndiv_9)
clu_graphmapper_5 = CLU_GraphMapper(
    crv_outerrectangle=crv_outerrectangle_10,
    pt_graphcurvepts=pt_graphcurvepts_10,
    int_ndiv=int_ndiv_10,
    domain_refdomain=domain_refdomain_5,
    num_fontsize=num_fontsize_13)
num_values_5 = Number(clu_graphmapper_5)

t0_6 = Slider(0, range=0..2)
t1_6 = Slider(1.55, range=0..3)
crv_outerrectangle_11 = Curve(<curve referenced from the Rhino model>)
pt_graphcurvepts_11 = Point([<point referenced from the Rhino model> x7])
num_fontsize_14 = Number(num_fontsize_3)
int_ndiv_11 = Integer(numberofsections_3)
dom_6 = ConstructDomain(DomainStart=t0_6, DomainEnd=t1_6)
crv_outerrectangle_12 = Curve(crv_outerrectangle_11)
pt_graphcurvepts_12 = Point(pt_graphcurvepts_11)
domain_refdomain_6 = Domain(dom_6)
num_fontsize_15 = Number(num_fontsize_14)
int_ndiv_12 = Integer(int_ndiv_11)
clu_graphmapper_6 = CLU_GraphMapper(
    crv_outerrectangle=crv_outerrectangle_12,
    pt_graphcurvepts=pt_graphcurvepts_12,
    int_ndiv=int_ndiv_12,
    domain_refdomain=domain_refdomain_6,
    num_fontsize=num_fontsize_15)
num_values_6 = Number(clu_graphmapper_6)

num_valuesa = Number(num_values)
num_valuesb = Number(num_values_2)
num_valuesc = Number(num_values_3)
num_valuesb_2 = Number(num_values_5)
num_valuesa_2 = Number(num_values_4)
num_valuesc_2 = Number(num_values_6)
merge = Merge(Data1=num_valuesa, Data2=num_valuesb, Data3=num_valuesc)
merge_2 = Merge(Data1=num_valuesa_2, Data2=num_valuesb_2, Data3=num_valuesc_2)
num_translateamplitude = Number(merge)
num_charges = Number(merge_2)
multiplier = Slider(30, range=0..30)
num_translateamplitude_2 = Number(num_translateamplitude)
multiplier_2 = Slider(1, range=0..30)
num_charges_2 = Number(num_charges)
multiplication = Multiplication(A=num_translateamplitude_2, B=multiplier_2)
multiplication_2 = Multiplication(A=num_charges_2, B=multiplier)
num_translateamplitude_3 = Number(multiplication)
numberofverticals_3 = Number(numberofverticals_2)
numberofsections_4 = Number(numberofsections_2)
num_fontsize_16 = Number(num_fontsize_2)
num_charges_3 = Number(multiplication_2)
height_4 = Number(height_3)
pta_3 = Point(pta_2)
ptb_3 = Point(ptb_2)
ptc_3 = Point(ptc_2)
num_translateamplitude_4 = Number(num_translateamplitude_3)
numberofverticals_4 = Number(numberofverticals_3)
numberofsections_5 = Number(numberofsections_4)
num_fontsize_17 = Number(num_fontsize_16)
num_charges_4 = Number(num_charges_3)
height_5 = Number(height_4)
pta_4 = Point(pta_3)
ptb_4 = Point(ptb_3)
ptc_4 = Point(ptc_3)
num_translateamplitude_5 = Number(num_translateamplitude_4)
numberofverticals_5 = Number(numberofverticals_4)
numberofsections_6 = Number(numberofsections_5)
num_fontsize_18 = Number(num_fontsize_17)
num_charges_5 = Number(num_charges_4)
height_6 = Number(height_5)
pta_5 = Point(pta_4)
ptb_5 = Point(ptb_4)
ptc_5 = Point(ptc_4)
num_translateamplitude_6 = Number(num_translateamplitude_5)
numberofverticals_6 = Number(numberofverticals_5)
numberofsections_7 = Number(numberofsections_6)
num_fontsize_19 = Number(num_fontsize_18)
num_charges_6 = Number(num_charges_5)
height_7 = Number(height_6)
pta_6 = Point(pta_5)
ptb_6 = Point(ptb_5)
ptc_6 = Point(ptc_5)
numberofsections_8 = Number(numberofsections_7)
num_fontsize_20 = Number(num_fontsize_19)

crv_outerrectangle_13 = Curve(<curve referenced from the Rhino model>)
t0_7 = Slider(0.34, range=0..2)
t1_7 = Slider(2.18, range=0..3)
pt_graphcurvepts_13 = Point([<point referenced from the Rhino model> x7])
num_fontsize_21 = Number(num_fontsize_20)
int_ndiv_13 = Integer(numberofsections_8)
dom_7 = ConstructDomain(DomainStart=t0_7, DomainEnd=t1_7)
crv_outerrectangle_14 = Curve(crv_outerrectangle_13)
pt_graphcurvepts_14 = Point(pt_graphcurvepts_13)
domain_refdomain_7 = Domain(dom_7)
num_fontsize_22 = Number(num_fontsize_21)
int_ndiv_14 = Integer(int_ndiv_13)
clu_graphmapper_7 = CLU_GraphMapper(
    crv_outerrectangle=crv_outerrectangle_14,
    pt_graphcurvepts=pt_graphcurvepts_14,
    int_ndiv=int_ndiv_14,
    domain_refdomain=domain_refdomain_7,
    num_fontsize=num_fontsize_22)
num_values_7 = Number(clu_graphmapper_7)

num_valuesa_3 = Number(num_values_7)
num_translateamplitude_7 = Number(num_translateamplitude_6)
numberofverticals_7 = Number(numberofverticals_6)
numberofsections_9 = Number(numberofsections_7)
num_fontsize_23 = Number(num_fontsize_19)
num_charges_7 = Number(num_charges_6)
height_8 = Number(height_7)
pta_7 = Point(pta_6)
ptb_7 = Point(ptb_6)
ptc_7 = Point(ptc_6)

hframeheight = Slider(0.09, range=0..0.3)
hframewidth = Slider(0.23, range=0..0.25)
nsections_2 = Slider(10, range=0..25)
maxr = Slider(0.12, range=0..1)
minr = Slider(0.06, range=0..1)
radius = Slider(0.08, range=0..0.25)

dom_8 = ConstructDomain(DomainStart=maxr, DomainEnd=minr)
hframeheight_2 = Number(hframeheight)
hframewidth_2 = Number(hframewidth)
domain_radii = Domain(dom_8)
nsections_3 = Integer(nsections_2)
radius_2 = Number(radius)
iters = Slider(1, range=0..2)

fisrtsrfoffset = Slider(0.11, range=0..1)
secondsrfoffset = Slider(0.51, range=0..1)
curlysrf_d0 = Slider(0.21, range=0..1)
ndivs = Slider(7, range=1..21)
curlysrf_d1 = Slider(1.03, range=0..2)
dom_9 = ConstructDomain(DomainStart=curlysrf_d0, DomainEnd=curlysrf_d1)

domain = Domain(dom_9)
num = Number(fisrtsrfoffset)
num_2 = Number(secondsrfoffset)
int = Integer(ndivs)

domain_2 = Domain(domain)
ndivs_2 = Integer(int)
series = Series(Start=0, Step=1, Count=expr("x+1", ndivs_2))
bnd = Bounds(Numbers=series)
remap = RemapNumbers(Value=series, Source=bnd, Target=Domain(0, 1))  # -> Mapped, Clipped
graph = GraphMapper(remap.Mapped, x0=0, x1=1, y0=0, y1=1, container_name="Gaussian", factor=0.2042572498, mean=0.5, sdev=0.1920289993)
remap_2 = RemapNumbers(Value=graph, Source=Domain(0, 1), Target=domain_2)  # -> Mapped, Clipped
num_3 = Number(remap_2.Mapped)

number_slider = Slider(110, range=0..255)
panel = Panel("0")
rgb = ColourRGB(Alpha=number_slider, Red="255", Green=0, Blue=0)
rgb_2 = ColourRGB(Alpha=number_slider, Red=0, Green="255", Blue=0)
rgb_3 = ColourRGB(Alpha=number_slider, Red=0, Green=0, Blue=0)

numberofsections_10 = Number(numberofsections)
height_9 = Number(height_2)
pta_8 = Point(pta)
ptb_8 = Point(ptb)
ptc_8 = Point(ptc)
merge_3 = Merge(Data1=pta_8, Data2=ptb_8, Data3=ptc_8)
avr = Average(Input=merge_3)
inpoints = Point(simplify(merge_3))
cpoint = Point(avr)
graft = GraftTree(Tree=inpoints, IncludeEmptyLists=True, IncludeNullItems=True)
simplify = SimplifyTree(Tree=graft, Front=False)
pttree = Point(simplify)
cpoint_2 = Point(cpoint)

domain_3 = Domain(height_9)
int_n = Integer(numberofsections_10)
series_2 = Series(Start=0, Step=1, Count=expr("x+1", int_n))
bnd_2 = Bounds(Numbers=series_2)
remap_3 = RemapNumbers(Value=series_2, Source=bnd_2, Target=domain_3)  # -> Mapped, Clipped
num_4 = Number(remap_3.Mapped)

Z = UnitZ(Factor=num_4)
vec = Vector(Z)
move = Move(Geometry=cpoint_2, Motion=vec)  # -> simplify(Geometry), Transform
move_2 = Move(Geometry=pttree, Motion=vec)  # -> simplify(Geometry), Transform
pt_centerpts = Point(simplify(graft(move.Geometry)))
pt_outerpts = Point(simplify(move_2.Geometry))

pt_centerpts_2 = Point(pt_centerpts)
pt_outerpts_2 = Point(pt_outerpts)
pt_centerpts_3 = Point(pt_centerpts_2)
pt_outerpts_3 = Point(pt_outerpts_2)

num_translateamplitude_8 = Number(num_translateamplitude_3)
num_charges_8 = Number(num_charges_3)
pt_centerpts_4 = Point(pt_centerpts_3)
pt_outerpts_4 = Point(pt_outerpts_3)
flip = FlipMatrix(Data=pt_outerpts_4)
vec2pt = Vector2Pt(PointA=pt_centerpts_4, PointB=flip, Unitize=False)  # -> Vector, Length
amp = Amplitude(Vector=vec2pt.Vector, Amplitude=num_translateamplitude_8)
move_3 = Move(Geometry=flip, Motion=amp)  # -> Geometry, Transform
xy = XYPlane(Origin=pt_centerpts_4)
pln_metaballplanes = Plane(xy)
pt_metaballpoints = Point(move_3.Geometry)
num_charges_9 = Number(num_charges_8)
metaball_t = MetaBallTCustom(Points=pt_metaballpoints, Charge=num_charges_9, Plane=pln_metaballplanes, Threshold=0.5)
crv_metaballs = Curve(simplify(metaball_t))

crv_metaballs_2 = Curve(crv_metaballs)
pt_centerpts_5 = Point(pt_centerpts_3)
pt_outerpts_5 = Point(pt_outerpts_3)
pt_centerpts_6 = Point(pt_centerpts_5)
pt_outerpts_6 = Point(pt_outerpts_5)

pt_centerpts_7 = Point(pt_centerpts_6)

pt_centerpts_8 = Point(pt_centerpts_6)
pt_outerpts_7 = Point(pt_outerpts_6)
pt_centerpts_9 = Point(pt_centerpts_8)
pt_centerpts_10 = Point(pt_centerpts_9)

pt_centerpts_11 = Point(pt_centerpts_10)

pt_centerpts_12 = Point(pt_centerpts_8)
pt_outerpts_8 = Point(pt_outerpts_7)

domain_rotationangle = Domain(Slider(0.49, range=0..1))
numberofsections_11 = Number(numberofsections_5)
crv_metaballs_3 = Curve(crv_metaballs_2)
pt_centerpts_13 = Point(pt_centerpts_5)

domain_4 = Domain(domain_rotationangle)
int_n_2 = Integer(numberofsections_11)
series_3 = Series(Start=0, Step=1, Count=expr("x+1", int_n_2))
bnd_3 = Bounds(Numbers=series_3)
remap_4 = RemapNumbers(Value=series_3, Source=bnd_3, Target=domain_4)  # -> Mapped, Clipped
num_5 = Number(remap_4.Mapped)

pi = Pi(Factor=simplify(graft(num_5)))
rotate = Rotate(Geometry=crv_metaballs_3, Angle=pi, Plane=pt_centerpts_13)  # -> Geometry, Transform
crv_metaballs_rotate = Curve(rotate.Geometry)

crv_metaballs_rotate_2 = Curve(crv_metaballs_rotate)

crv_metaballs_rotate_3 = Curve(crv_metaballs_rotate_2)
num_cpfactor = Number(Slider(0.05, range=0..1))
cp = ControlPoints(Curve=crv_metaballs_rotate_3)  # -> Points, Weights, Knots
lng = ListLength(List=cp.Points)
multiplication_3 = Multiplication(A=lng, B=num_cpfactor)
reb = RebuildCurve(Curve=crv_metaballs_rotate_3, Degree=3, Count=multiplication_3, Tangents=False)
py_checkorientation = PythonScript(curve=reb)  # -> out, a; inputs curve: Curve
# ---------- py_checkorientation: Python ----------
import Rhino.Geometry as rg

if(rg.Curve.ClosedCurveOrientation(curve, rg.Vector3d.ZAxis) != rg.CurveOrientation.CounterClockwise):
    rg.Curve.Reverse(curve)

a = curve
# ---------- end py_checkorientation ----------
crv = Curve(simplify(py_checkorientation.a))

pt_centerpts_14 = Point(pt_centerpts_7)
crv_2 = Curve(crv)
item = ListItem(List=flatten(pt_centerpts_14), Index=0, Wrap=True)
xz = XZPlane(Origin=item)
pdecon = Deconstruct(Point=item)  # -> XComponent, YComponent, ZComponent
pcx = CurvePlane(Curve=crv_2, Plane=xz)  # -> Points, ParamsC, ParamsP
devec = DeconstructVector(Vector=pcx.Points)  # -> XComponent, YComponent, ZComponent
smaller = SmallerThan(FirstNumber=pdecon.XComponent, SecondNumber=devec.XComponent)  # -> SmallerThan, OrEqualTo
dispatch = Dispatch(List=pcx.ParamsC, DispatchPattern=smaller.SmallerThan)  # -> ListA, ListB
seam = Seam(Curve=crv_2, Seam=dispatch.ListA)
crv_3 = Curve(seam)

crv_metaballs_rotate_4 = Curve(crv_3)
crv_metaballs_rotate_5 = Curve(crv_metaballs_rotate_4)
offset = Offset(Curve=crv_metaballs_rotate_5, Distance=num_valuesa_3, Plane=PlaneXY(0, 0, 0), Corners=1)
cp_2 = ControlPoints(Curve=crv_metaballs_rotate_5)  # -> Points, Weights, Knots
lng_2 = ListLength(List=cp_2.Points)
crv_metaballs_interior = Curve(offset)
int_ncp = Integer(lng_2)

crv_metaballs_rotate_6 = Curve(crv_metaballs_interior)
int_ncp_2 = Integer(int_ncp)
reb_2 = RebuildCurve(Curve=crv_metaballs_rotate_6, Degree=3, Count=int_ncp_2, Tangents=False)
py_checkorientation_2 = PythonScript(curve=reb_2)  # -> out, a; inputs curve: Curve; same code as py_checkorientation
crv_4 = Curve(simplify(py_checkorientation_2.a))

pt_centerpts_15 = Point(pt_centerpts_11)
crv_5 = Curve(crv_4)
item_2 = ListItem(List=flatten(pt_centerpts_15), Index=0, Wrap=True)
xz_2 = XZPlane(Origin=item_2)
pdecon_2 = Deconstruct(Point=item_2)  # -> XComponent, YComponent, ZComponent
pcx_2 = CurvePlane(Curve=crv_5, Plane=xz_2)  # -> Points, ParamsC, ParamsP
devec_2 = DeconstructVector(Vector=pcx_2.Points)  # -> XComponent, YComponent, ZComponent
smaller_2 = SmallerThan(FirstNumber=pdecon_2.XComponent, SecondNumber=devec_2.XComponent)  # -> SmallerThan, OrEqualTo
dispatch_2 = Dispatch(List=pcx_2.ParamsC, DispatchPattern=smaller_2.SmallerThan)  # -> ListA, ListB
seam_2 = Seam(Curve=crv_5, Seam=dispatch_2.ListA)
crv_6 = Curve(seam_2)

crv_metaballs_outer = Curve(crv_metaballs_rotate_4)
crv_metaballs_inner = Curve(crv_6)
crv_metaballs_outer_2 = Curve(crv_metaballs_outer)
crv_metaballs_inner_2 = Curve(crv_metaballs_inner)
crv_horizontal_outer = Curve(simplify(crv_metaballs_outer_2))
crv_horizontal_inner = Curve(simplify(crv_metaballs_inner_2))
crv_horizontal_outer_2 = Curve(crv_horizontal_outer)
crv_horizontal_inner_2 = Curve(crv_horizontal_inner)

crv_horizontal_inner_3 = Curve(crv_horizontal_inner_2)
hframeheight_3 = Number(hframeheight_2)
hframewidth_3 = Number(hframewidth_2)
division = Division(A=hframeheight_3, B="2")
division_2 = Division(A=hframewidth_3, B="2")
neg = Negative(Value=division_2)
offset_2 = Offset(Curve=crv_horizontal_inner_3, Distance=division_2, Plane=PlaneXY(0, 0, 0), Corners=1)
offset_3 = Offset(Curve=crv_horizontal_inner_3, Distance=neg, Plane=PlaneXY(0, 0, 0), Corners=1)
Z_2 = UnitZ(Factor=division)
rev = Reverse(Vector=Z_2)
rev_2 = Reverse(Vector=Z_2)
move_4 = Move(Geometry=offset_2, Motion=Z_2)  # -> Geometry, Transform
move_5 = Move(Geometry=offset_2, Motion=rev)  # -> Geometry, Transform
move_6 = Move(Geometry=offset_3, Motion=Z_2)  # -> Geometry, Transform
move_7 = Move(Geometry=offset_3, Motion=rev_2)  # -> Geometry, Transform
merge_4 = Merge(Data1=move_4.Geometry, Data2=move_5.Geometry, Data3=move_7.Geometry, Data4=move_6.Geometry)  # -> simplify(Result)
loft = Loft(Curves=merge_4, Options={Adjust=False, Closed=True, LoftEnds=0, LoftSimp=0, LoftType=3, Rebuild=10, Refit=0.01})
brep = Brep(loft)

crv_horizontal_outer_3 = Curve(crv_horizontal_outer_2)
hframeheight_4 = Number(hframeheight_2)
hframewidth_4 = Number(hframewidth_2)
division_3 = Division(A=hframeheight_4, B="2")
division_4 = Division(A=hframewidth_4, B="2")
neg_2 = Negative(Value=division_4)
offset_4 = Offset(Curve=crv_horizontal_outer_3, Distance=division_4, Plane=PlaneXY(0, 0, 0), Corners=1)
offset_5 = Offset(Curve=crv_horizontal_outer_3, Distance=neg_2, Plane=PlaneXY(0, 0, 0), Corners=1)
Z_3 = UnitZ(Factor=division_3)
rev_3 = Reverse(Vector=Z_3)
rev_4 = Reverse(Vector=Z_3)
move_8 = Move(Geometry=offset_4, Motion=Z_3)  # -> Geometry, Transform
move_9 = Move(Geometry=offset_4, Motion=rev_3)  # -> Geometry, Transform
move_10 = Move(Geometry=offset_5, Motion=Z_3)  # -> Geometry, Transform
move_11 = Move(Geometry=offset_5, Motion=rev_4)  # -> Geometry, Transform
merge_5 = Merge(Data1=move_8.Geometry, Data2=move_9.Geometry, Data3=move_11.Geometry, Data4=move_10.Geometry)  # -> simplify(Result)
loft_2 = Loft(Curves=merge_5, Options={Adjust=False, Closed=True, LoftEnds=0, LoftSimp=0, LoftType=3, Rebuild=10, Refit=0.01})
brep_2 = Brep(loft_2)

brep_hframe_outer = Brep(brep_2)
brep_hframe_inner = Brep(brep)
brep_hframe_outer_2 = Brep(brep_hframe_outer)
brep_hframe_inner_2 = Brep(brep_hframe_inner)

crv_metaballs_inner_3 = Curve(crv_metaballs_inner)
numberofverticals_8 = Number(numberofverticals_7)
pt_centerpts_16 = Point(pt_centerpts_12)
item_3 = ListItem(List=flatten(pt_centerpts_16), Index=0, Wrap=True)
loft_3 = Loft(
    Curves=flatten(crv_metaballs_inner_3),
    Options={Adjust=False, Closed=False, LoftEnds=0, LoftSimp=0, LoftType=0, Rebuild=10, Refit=0.01})
srf = Surface(loft_3)
srf_2 = Surface(srf)

geo = Geometry(crv_metaballs_inner_3)
bbox = BoundingBox(Content=geo, Plane=PlaneXY(0, 0, 0))  # -> Box, Box_2
debox = DeconstructBox(Box=bbox.Box)  # -> Plane, X, Y, Z
num_6 = Number(debox.X)
num_7 = Number(debox.Y)
multiplication_4 = Multiplication(A=num_6, B=num_7)  # -> flatten(Result)
sort = SortList(Keys=multiplication_4)  # -> Keys, ValuesA
item_4 = ListItem(List=sort.Keys, Index=0, Wrap=True)
eval = Evaluate(F="Sqrt(x)", x=item_4)
num_8 = Number(eval)

cir = Circle(Plane=item_3, Radius=num_8)
divide = DivideCurve(Curve=cir, Count=numberofverticals_8, Kinks=False)  # -> Points, Tangents, Parameters
ln = Line(StartPoint=item_3, EndPoint=divide.Points)
project = Project(Curve=ln, Brep=srf, Direction=Vector(0, 0, 1))
crv_7 = Curve(simplify(project))

crv_verticals_inner = Curve(crv_7)
srf_inner = Surface(srf_2)
crv_verticals_inner_2 = Curve(simplify(crv_verticals_inner))
srf_inner_2 = Surface(srf_inner)
crv_verticals_inner_3 = Curve(crv_verticals_inner_2)
srf_inner_3 = Surface(srf_inner_2)

crv_verticals_inner_4 = Curve(crv_verticals_inner_3)
domain_radii_2 = Domain(domain_radii)
nsections_4 = Integer(nsections_3)
pframes = PerpFrames(Curve=crv_verticals_inner_4, Count=nsections_4, Align=True)  # -> simplify(Frames), Parameters
domain_radii_3 = Domain(domain_radii_2)
pt = Point(pframes.Frames)
pdecon_3 = Deconstruct(Point=pt)  # -> XComponent, YComponent, ZComponent
bnd_4 = Bounds(Numbers=pdecon_3.ZComponent)
remap_5 = RemapNumbers(Value=pdecon_3.ZComponent, Source=bnd_4, Target=domain_radii_3)  # -> Mapped, Clipped
cir_2 = Circle(Plane=pframes.Frames, Radius=remap_5.Mapped)
item_5 = ListItem(List=cir_2, Index=0, Wrap=True)  # -> Item1, Item
lng_3 = ListLength(List=cir_2)
pt_2 = Point(item_5.Item1)
pt_3 = Point(item_5.Item)
xy_2 = XYPlane(Origin=pt_2)
xy_3 = XYPlane(Origin=pt_3)
project_2 = Project(Geometry=item_5.Item, Plane=xy_3)  # -> Geometry, Transform
project_3 = Project(Geometry=item_5.Item1, Plane=xy_2)  # -> Geometry, Transform
replace = ReplaceItems(List=cir_2, Item=project_3.Geometry, Indices=expr("x-1", lng_3), Wrap=False)  # -> simplify(List)
replace_2 = ReplaceItems(List=replace, Item=project_2.Geometry, Indices="0", Wrap=False)  # -> simplify(List)
loft_4 = Loft(Curves=replace_2, Options={Adjust=False, Closed=False, LoftEnds=0, LoftSimp=0, LoftType=0, Rebuild=10, Refit=0.01})
cap = CapHoles(Brep=loft_4)
brep_3 = Brep(cap)

brep_vframe_inner = Brep(brep_3)
srf_inner_4 = Surface(srf_inner_3)
brep_vframe_inner_2 = Brep(brep_vframe_inner)
srf_inner_5 = Surface(srf_inner_4)

crv_metaballs_outer_3 = Curve(crv_metaballs_outer)
numberofverticals_9 = Number(numberofverticals_7)
pt_centerpts_17 = Point(pt_centerpts_12)
item_6 = ListItem(List=flatten(pt_centerpts_17), Index=0, Wrap=True)
loft_5 = Loft(
    Curves=flatten(crv_metaballs_outer_3),
    Options={Adjust=False, Closed=False, LoftEnds=0, LoftSimp=0, LoftType=0, Rebuild=10, Refit=0.01})
srf_3 = Surface(loft_5)
srf_4 = Surface(srf_3)

geo_2 = Geometry(crv_metaballs_outer_3)
bbox_2 = BoundingBox(Content=geo_2, Plane=PlaneXY(0, 0, 0))  # -> Box, Box_2
debox_2 = DeconstructBox(Box=bbox_2.Box)  # -> Plane, X, Y, Z
num_9 = Number(debox_2.X)
num_10 = Number(debox_2.Y)
multiplication_5 = Multiplication(A=num_9, B=num_10)  # -> flatten(Result)
sort_2 = SortList(Keys=multiplication_5)  # -> Keys, ValuesA
item_7 = ListItem(List=sort_2.Keys, Index=0, Wrap=True)
eval_2 = Evaluate(F="Sqrt(x)", x=item_7)
num_11 = Number(eval_2)

cir_3 = Circle(Plane=item_6, Radius=num_11)
divide_2 = DivideCurve(Curve=cir_3, Count=numberofverticals_9, Kinks=False)  # -> Points, Tangents, Parameters
ln_2 = Line(StartPoint=item_6, EndPoint=divide_2.Points)
project_4 = Project(Curve=ln_2, Brep=srf_3, Direction=Vector(0, 0, 1))
crv_8 = Curve(simplify(project_4))

crv_verticals_outer = Curve(crv_8)
srf_outer = Surface(srf_4)
crv_verticals_outer_2 = Curve(simplify(crv_verticals_outer))
srf_outer_2 = Surface(srf_outer)

crv_horizontal_inner_4 = Curve(crv_horizontal_inner)
crv_verticals_inner_5 = Curve(crv_verticals_inner_2)
crv_verticals_outer_3 = Curve(crv_verticals_outer_2)
planar = Planar(Curve=crv_horizontal_inner_4)  # -> Planar, Plane, Deviation
pln = Plane(flatten(planar.Plane))
pcx_3 = CurvePlane(Curve=crv_verticals_inner_5, Plane=pln)  # -> Points, ParamsC, ParamsP
pcx_4 = CurvePlane(Curve=crv_verticals_outer_3, Plane=pln)  # -> Points, ParamsC, ParamsP
item_8 = ListItem(List=pcx_4.Points, Index=0, Wrap=True)
item_9 = ListItem(List=pcx_3.Points, Index=0, Wrap=True)
pt_outersrfpoints = Point(item_8)
pt_innersrfpoints = Point(item_9)

crv_verticals_outer_4 = Curve(crv_verticals_outer_2)
pt_outersrfpoints_2 = Point(pt_outersrfpoints)
pt_innersrfpoints_2 = Point(pt_innersrfpoints)
srf_outer_3 = Surface(srf_outer_2)

crv_verticals_outer_5 = Curve(crv_verticals_outer_4)
domain_radii_4 = Domain(domain_radii)
nsections_5 = Integer(nsections_3)
pframes_2 = PerpFrames(Curve=crv_verticals_outer_5, Count=nsections_5, Align=True)  # -> simplify(Frames), Parameters
domain_radii_5 = Domain(domain_radii_4)
pt_4 = Point(pframes_2.Frames)
pdecon_4 = Deconstruct(Point=pt_4)  # -> XComponent, YComponent, ZComponent
bnd_5 = Bounds(Numbers=pdecon_4.ZComponent)
remap_6 = RemapNumbers(Value=pdecon_4.ZComponent, Source=bnd_5, Target=domain_radii_5)  # -> Mapped, Clipped
cir_4 = Circle(Plane=pframes_2.Frames, Radius=remap_6.Mapped)
item_10 = ListItem(List=cir_4, Index=0, Wrap=True)  # -> Item1, Item
lng_4 = ListLength(List=cir_4)
pt_5 = Point(item_10.Item1)
pt_6 = Point(item_10.Item)
xy_4 = XYPlane(Origin=pt_5)
xy_5 = XYPlane(Origin=pt_6)
project_5 = Project(Geometry=item_10.Item, Plane=xy_5)  # -> Geometry, Transform
project_6 = Project(Geometry=item_10.Item1, Plane=xy_4)  # -> Geometry, Transform
replace_3 = ReplaceItems(List=cir_4, Item=project_6.Geometry, Indices=expr("x-1", lng_4), Wrap=False)  # -> simplify(List)
replace_4 = ReplaceItems(List=replace_3, Item=project_5.Geometry, Indices="0", Wrap=False)  # -> simplify(List)
loft_6 = Loft(Curves=replace_4, Options={Adjust=False, Closed=False, LoftEnds=0, LoftSimp=0, LoftType=0, Rebuild=10, Refit=0.01})
cap_2 = CapHoles(Brep=loft_6)
brep_4 = Brep(cap_2)

pt_outersrfpoints_3 = Point(pt_outersrfpoints_2)
pt_innersrfpoints_3 = Point(pt_innersrfpoints_2)
radius_3 = Number(radius_2)
ln_3 = Line(StartPoint=pt_innersrfpoints_3, EndPoint=pt_outersrfpoints_3)
pipe = Pipe(Curve=ln_3, Radius=radius_3, Caps=0)
cap_3 = CapHoles(Brep=pipe)
brep_5 = Brep(cap_3)

brep_vframe_outer = Brep(brep_4)
pt_outersrfpoints_4 = Point(pt_outersrfpoints_2)
pt_innersrfpoints_4 = Point(pt_innersrfpoints_2)
brep_mframe = Brep(brep_5)
srf_outer_4 = Surface(srf_outer_3)

pt_outersrfpoints_5 = Point(pt_outersrfpoints_4)
int_iters = Integer(iters)
shift = ShiftPaths(Data=pt_outersrfpoints_5, Offset=-1)
c_subdividetree = CSharpScript(pT=shift, iters=int_iters)  # -> out, A; inputs pT: tree of Point3d, iters: Int32
# ---------- c_subdividetree: C# ----------
    //Subdivide horizontal direction
    foreach(var path in pT.Paths){
      var branch = new List<Point3d>(pT.Branch(path));
      pT.Branch(path).Clear();
      pT.AddRange(SubDividePointList(branch, iters, false), path);
    }
    //Subdivide vertical direction
    var counts = pT.Paths.Select(v => pT.Branch(v).Count).Distinct().ToList();
    if(counts.Count != 1){
      throw new Exception("counts.Count != 1 (" + counts.Count + ")");
    }
    var count = counts.Single();
    var tree = new DataTree<Point3d>();
    for(var i = 0; i < count; i++){
      var pts = SubDividePointList(pT.Paths.Select(v => pT.Branch(v)[i]).ToList(), iters, true);
      tree.AddRange(SubDividePointList(pT.Paths.Select(v => pT.Branch(v)[i]).ToList(), iters, true), new GH_Path(i));
    }
    //Flip tree back to original topology
    counts = tree.Paths.Select(v => tree.Branch(v).Count).Distinct().ToList();
    if(counts.Count != 1){
      throw new Exception("counts.Count != 1 (" + counts.Count + ")");
    }
    count = counts.Single();
    var newTree = new DataTree<Point3d>();
    for(var i = 0; i < count; i++){
      newTree.AddRange(tree.Paths.Select(v => tree.Branch(v)[i]).ToList(), new GH_Path(i));
    }

    A = newTree;
# ---------- c_subdividetree: C# additional code ----------
  public List<Point3d>SubDividePointList(List<Point3d> points, int iters, bool closed){
    if(iters <= 0){
      return points;
    }
    var newPoints = new List<Point3d>();
    for(var i = 0; i < points.Count; i++){
      newPoints.Add(points[i]);
      if(!closed && i == points.Count - 1){
        continue;
      }
      var nextI = (i + 1) % points.Count;
      var midPt = new Point3d((points[i].X + points[nextI].X) / 2,
        (points[i].Y + points[nextI].Y) / 2,
        (points[i].Z + points[nextI].Z) / 2);
      newPoints.Add(midPt);
    }
    return SubDividePointList(newPoints, iters - 1, closed);
  }
# ---------- end c_subdividetree ----------
pt_7 = Point(c_subdividetree.A)
c_script = CSharpScript(pT=pt_7, flip=Toggle(True))  # -> out, A; inputs pT: tree of Point3d, flip: Boolean
# ---------- c_script: C# ----------
    var lines = new DataTree<Line>();
    for(var i = 0; i < pT.Paths.Count; i++){
      var nextI = flip ? (i + 1) % pT.Paths.Count : (i - 1) < 0 ? pT.Paths.Count + (i - 1) : i - 1;
      var currPath = pT.Paths[i];
      var nextPath = pT.Paths[nextI];
      var currBranch = pT.Branch(currPath);
      var nextBranch = pT.Branch(nextPath);
      for(var j = 0; j < currBranch.Count; j++){
        if(j == currBranch.Count - 1 || j % 2 == 0){
          continue;
        }
        lines.Add(new Line(currBranch[j], nextBranch[j + 1]), currPath);
      }
    }

    var doubleLines = new DataTree<Line>();

    for(var i = 0; i < lines.Paths.Count; i++){
      var nextI = !flip ? (i + 2) % lines.Paths.Count : (i - 2) < 0 ? lines.Paths.Count + (i - 2) : i - 2;
      var currPath = lines.Paths[i];
      var nextPath = lines.Paths[nextI];
      var currBranch = lines.Branch(currPath);
      var nextBranch = lines.Branch(nextPath);
      for(var j = 0; j < currBranch.Count; j++){
        if(j == currBranch.Count - 1){
          continue;
        }
        var nextJ = j + 1;
        doubleLines.Add(currBranch[j], currPath.AppendElement(j));
        doubleLines.Add(nextBranch[nextJ], currPath.AppendElement(j));
      }
    }
    A = doubleLines;
# ---------- end c_script ----------
loft_7 = Loft(Curves=c_script.A, Options={Adjust=False, Closed=False, LoftEnds=0, LoftSimp=0, LoftType=0, Rebuild=10, Refit=0.01})
srf_5 = Surface(loft_7)
shift_2 = ShiftPaths(Data=srf_5, Offset=-1)
panel_2 = Panel("""True
False""")
flip_2 = FlipMatrix(Data=shift_2)
rev_5 = ReverseList(List=panel_2)
cull = CullPattern(List=flip_2, CullPattern=panel_2)
cull_2 = CullPattern(List=flip_2, CullPattern=rev_5)
flip_3 = FlipMatrix(Data=cull)
flip_4 = FlipMatrix(Data=cull_2)
srf_6 = Surface(graft(flip_3))
srf_7 = Surface(graft(flip_4))

offsetdist = Number(num_2)
ndivs_3 = Integer(int)
num_12 = Number(num_3)
srf_8 = Surface(srf_7)
evalsrf = EvaluateSurface(Surface=srf_8, Point="{0.5,0.5,0}")  # -> Point, Normal, Frame
vec_2 = Vector(evalsrf.Normal)
amp_2 = Amplitude(Vector=vec_2, Amplitude=offsetdist)
move_12 = Move(Geometry=srf_8, Motion=amp_2)  # -> Geometry, Transform
edges = BrepEdges(Brep=move_12.Geometry)  # -> Naked, Interior, NonManifold
sort_3 = SortList(Keys=edges.Naked, ValuesA=edges.Naked)  # -> Keys, reverse(ValuesA)
item_11 = ListItem(List=sort_3.ValuesA, Index=0, Wrap=True)  # -> Item, Item1
ndivs_4 = Integer(ndivs_3)
amp_3 = Amplitude(Vector=vec_2, Amplitude=num_12)
divide_3 = DivideCurve(Curve=item_11.Item, Count=ndivs_4, Kinks=False)  # -> Points, Tangents, Parameters
divide_4 = DivideCurve(Curve=item_11.Item1, Count=ndivs_4, Kinks=False)  # -> Points, Tangents, Parameters
move_13 = Move(Geometry=divide_3.Points, Motion=amp_3)  # -> Geometry, Transform
move_14 = Move(Geometry=divide_4.Points, Motion=amp_3)  # -> Geometry, Transform
intcrv = Interpolate(Vertices=move_14.Geometry, Degree=3, Periodic=False, KnotStyle=1)  # -> Curve, Length, Domain
intcrv_2 = Interpolate(Vertices=move_13.Geometry, Degree=3, Periodic=False, KnotStyle=1)  # -> Curve, Length, Domain
flip_5 = FlipCurve(Curve=intcrv.Curve)  # -> Curve, Flag
loft_8 = Loft(
    Curves=[intcrv_2.Curve, flip_5.Curve],
    Options={Adjust=False, Closed=False, LoftEnds=0, LoftSimp=0, LoftType=0, Rebuild=10, Refit=0.01})
srf_9 = Surface(loft_8)

offsetdist_2 = Number(num)
ndivs_5 = Integer(int)
num_13 = Number(num_3)
srf_10 = Surface(srf_6)
evalsrf_2 = EvaluateSurface(Surface=srf_10, Point="{0.5,0.5,0}")  # -> Point, Normal, Frame
vec_3 = Vector(evalsrf_2.Normal)
amp_4 = Amplitude(Vector=vec_3, Amplitude=offsetdist_2)
move_15 = Move(Geometry=srf_10, Motion=amp_4)  # -> Geometry, Transform
edges_2 = BrepEdges(Brep=move_15.Geometry)  # -> Naked, Interior, NonManifold
sort_4 = SortList(Keys=edges_2.Naked, ValuesA=edges_2.Naked)  # -> Keys, reverse(ValuesA)
item_12 = ListItem(List=sort_4.ValuesA, Index=0, Wrap=True)  # -> Item, Item1
ndivs_6 = Integer(ndivs_5)
amp_5 = Amplitude(Vector=vec_3, Amplitude=num_13)
divide_5 = DivideCurve(Curve=item_12.Item, Count=ndivs_6, Kinks=False)  # -> Points, Tangents, Parameters
divide_6 = DivideCurve(Curve=item_12.Item1, Count=ndivs_6, Kinks=False)  # -> Points, Tangents, Parameters
move_16 = Move(Geometry=divide_5.Points, Motion=amp_5)  # -> Geometry, Transform
move_17 = Move(Geometry=divide_6.Points, Motion=amp_5)  # -> Geometry, Transform
intcrv_3 = Interpolate(Vertices=move_17.Geometry, Degree=3, Periodic=False, KnotStyle=1)  # -> Curve, Length, Domain
intcrv_4 = Interpolate(Vertices=move_16.Geometry, Degree=3, Periodic=False, KnotStyle=1)  # -> Curve, Length, Domain
flip_6 = FlipCurve(Curve=intcrv_3.Curve)  # -> Curve, Flag
loft_9 = Loft(
    Curves=[intcrv_4.Curve, flip_6.Curve],
    Options={Adjust=False, Closed=False, LoftEnds=0, LoftSimp=0, LoftType=0, Rebuild=10, Refit=0.01})
srf_11 = Surface(loft_9)

brep_vframe_outer_2 = Brep(brep_vframe_outer)
pt_outersrfpoints_6 = Point(pt_outersrfpoints_4)
pt_innersrfpoints_5 = Point(pt_innersrfpoints_4)
srf_panelsouter = Surface(srf_11)
srf_panelsinner = Surface(srf_9)
brep_mframe_2 = Brep(brep_mframe)
srf_outer_5 = Surface(srf_outer_4)

seed1 = Slider(85, range=0..100)
seed2 = Slider(37, range=0..100)
split = Slider(0.65, range=0..1)
srf_12 = Surface(flatten(srf_panelsouter))
randomsplit = RandomSplitList(MasterList=srf_12, Seed=seed1, Split=split)  # -> ListA, ListB
eval_3 = Evaluate(F="1-x", x=split)
randomsplit_2 = RandomSplitList(MasterList=randomsplit.ListB, Seed=seed2, Split=eval_3)  # -> ListA, ListB

seed2_2 = Slider(55, range=0..100)
seed1_2 = Slider(67, range=0..100)
split_2 = Slider(0.65, range=0..1)
srf_13 = Surface(flatten(srf_panelsinner))
randomsplit_3 = RandomSplitList(MasterList=srf_13, Seed=seed1_2, Split=split_2)  # -> ListA, ListB
eval_4 = Evaluate(F="1-x", x=split_2)
randomsplit_4 = RandomSplitList(MasterList=randomsplit_3.ListB, Seed=seed2_2, Split=eval_4)  # -> ListA, ListB

srf_panelsc = Surface(randomsplit_2.ListB)
srf_panelsa = Surface(randomsplit.ListA)
srf_panelsb = Surface(randomsplit_2.ListA)
srf_panelsc_2 = Surface(randomsplit_4.ListB)
srf_panelsa_2 = Surface(randomsplit_3.ListA)
srf_panelsb_2 = Surface(randomsplit_4.ListA)
preview = CustomPreview(Geometry=srf_panelsa, Shader=rgb)
preview_2 = CustomPreview(Geometry=srf_panelsb, Shader=rgb_2)
preview_3 = CustomPreview(Geometry=srf_panelsc, Shader=rgb_3)

# ==== cluster CLU_GraphMapper
crv_outerrectangle = ClusterInput()
domain_refdomain = ClusterInput()
pt_graphcurvepts = ClusterInput()
num_fontsize = ClusterInput()
int_ndiv = ClusterInput()
crv_outerrectangle_2 = Curve(crv_outerrectangle)
domain_refdomain_2 = Domain(domain_refdomain)
pt_graphcurvepts_2 = Point(pt_graphcurvepts)
num_fontsize_2 = Number(num_fontsize)
int_ndiv_2 = Integer(int_ndiv)
num_fontsize_3 = Number(num_fontsize_2)

crv = Curve(crv_outerrectangle_2)
disc = Discontinuity(Curve=crv, Level=1)  # -> Points, Parameters
pt = Point(disc.Points)
item = ListItem(List=pt, Index=0, Wrap=True)  # -> Item, Item1, Item2, Item3
ln = Line(StartPoint=item.Item, EndPoint=item.Item1)
ln_2 = Line(StartPoint=item.Item, EndPoint=item.Item3)
line_axisx = Line(ln)
line_axisy = Line(ln_2)
pt_origin = Point(item.Item)

domain_refdomain_3 = Domain(domain_refdomain_2)
pt_graphcurvepts_3 = Point(pt_graphcurvepts_2)
line_axisx_2 = Line(line_axisx)
line_axisy_2 = Line(ln_2)
pt_origin_2 = Point(pt_origin)
int_ndiv_3 = Integer(int_ndiv_2)

pt_ptstosort = Point(pt_graphcurvepts_3)
line_refline = Line(line_axisx_2)
python = PythonScript(line=line_refline, pt=pt_ptstosort)  # -> out, a; inputs line: Line, pt: Point3d
# ---------- python: Python ----------
import Rhino.Geometry as rg
a = rg.Line.ClosestParameter(line, pt);
# ---------- end python ----------
sort = SortList(Keys=python.a, ValuesA=pt_ptstosort)  # -> Keys, ValuesA
pt_sortedpts = Point(sort.ValuesA)
intcrv = Interpolate(Vertices=pt_sortedpts, Degree=3, Periodic=False, KnotStyle=1)  # -> Curve, Length, Domain
crv_graphcurve = Curve(intcrv.Curve)
pt_sortedpts_2 = Point(pt_sortedpts)

domain_refdomain_4 = Domain(domain_refdomain_3)
pt_graphcurvepts_4 = Point(pt_graphcurvepts_3)
crv_graphcurve_2 = Curve(crv_graphcurve)
pt_sortedpts_3 = Point(pt_sortedpts_2)
line_axisx_3 = Line(line_axisx_2)
line_axisy_3 = Line(line_axisy_2)
pt_origin_3 = Point(pt_origin_2)
int_ndiv_4 = Integer(int_ndiv_3)

domain_refdomain_5 = Domain(domain_refdomain_4)
crv_graphcurve_3 = Curve(crv_graphcurve_2)
line_axisx_4 = Line(line_axisx_3)
line_axisy_4 = Line(line_axisy_3)
int_ndiv_5 = Integer(int_ndiv_4)
Z = UnitZ(Factor=1)
xprod = CrossProduct(VectorA=Z, VectorB=line_axisx_4, Unitize=False)  # -> Vector, Length
divide = DivideCurve(Curve=line_axisx_4, Count=int_ndiv_5, Kinks=False)  # -> simplify(graft(Points)), Tangents, Parameters
line = LineSDL(Start=divide.Points, Direction=xprod.Vector, Length=1)
clx = CurveLine(Curve=crv_graphcurve_3, Line=line)  # -> Points, Params, Count
num_lengthy = Number(line_axisy_4)
ln_3 = Line(StartPoint=divide.Points, EndPoint=clx.Points)
shift = ShiftPaths(Data=clx.Points, Offset=-1)
domain_refdomain_6 = Domain(domain_refdomain_5)
num_dist = Number(ln_3)
domain = Domain(num_lengthy)
intcrv_2 = Interpolate(Vertices=flatten(shift), Degree=3, Periodic=False, KnotStyle=1)  # -> Curve, Length, Domain
remap = RemapNumbers(Value=num_dist, Source=domain, Target=domain_refdomain_6)  # -> simplify(Mapped), Clipped
crv_graphcurveremapped = Curve(intcrv_2.Curve)
num_values = Number(remap.Mapped)
line_2 = Line(ln_3)

line_axisx_5 = Line(line_axisx_3)
num_size = Number(num_fontsize_3)
line_axisy_5 = Line(line_axisy_3)
pt_origin_4 = Point(pt_origin_3)
end = EndPoints(Curve=line_axisx_5)  # -> Start, End
end_2 = EndPoints(Curve=line_axisy_5)  # -> Start, End
tag = TextTag3D(Location=pt_origin_4, Text="0", Size=num_size, Justification=3)
tag_2 = TextTag3D(Location=end.End, Text="X", Size=num_size, Justification=1)
tag_3 = TextTag3D(Location=end_2.End, Text="Y", Size=num_size, Justification=3)

crv_graphcurveremapped_2 = Curve(crv_graphcurveremapped)
domain_refdomain_7 = Domain(domain_refdomain_4)
pt_graphcurvepts_5 = Point(pt_graphcurvepts_4)
crv_graphcurve_4 = Curve(crv_graphcurve_2)
pt_sortedpts_4 = Point(pt_sortedpts_3)
num_values_2 = Number(num_values)
line_axisx_6 = Line(line_axisx_3)
line_axisy_6 = Line(line_axisy_3)
pt_origin_5 = Point(pt_origin_3)
int_ndiv_6 = Integer(int_ndiv_4)
line_3 = Line(line_2)
num_values_3 = ClusterOutput(num_values_2)
