# Grasshopper definition 2016 11 01 - Pipes.gh (Grasshopper 0.9.76)
# plug-ins: Weaverbird, Mesh Pipe, TSplinesGH

overall_height_mm = Slider(460, range=0..1000)
object_radius_mm = Slider(130, range=0..1000)
vertical_loop_count = Slider(4, range=3..10)
pipe_count = Slider(16, range=0..100)
rotation_angle = Slider(0, range=-3.142..3.142)

number_slider = Slider(3, range=0..10)

mid_point_adjustment = Slider(0.7, range=0..1)
inner_core_size_f = Slider(0.47, range=0..1)

# ----
# Skeleton
polygon = Polygon(Plane=PlaneXY(0, 0, 0), Radius=object_radius_mm, Segments=pipe_count, FilletRadius=0)  # -> Polygon, Length
series = Series(Start=0, Step=rotation_angle, Count=expr("x+1", vertical_loop_count))
range = Range(Domain=overall_height_mm, Steps=vertical_loop_count)
z = UnitZ(Factor=range)
move = Move(Geometry=polygon.Polygon, Motion=z)  # -> Geometry, Transform
move_2 = Move(Geometry="0,0,0", Motion=z)  # -> Geometry, Transform
rotate = Rotate(Geometry=move.Geometry, Angle=series, Plane=PlaneXY(0, 0, 0))  # -> Geometry, Transform
x = Panel("""0
1""")
dispatch = Dispatch(List=rotate.Geometry, DispatchPattern=x)  # -> ListA, ListB
dispatch_2 = Dispatch(List=move_2.Geometry, DispatchPattern=x)  # -> ListA, ListB
scale = Scale(Geometry=dispatch.ListA, Center=dispatch_2.ListA, Factor=mid_point_adjustment)  # -> Geometry, Transform
scale_2 = Scale(Geometry=dispatch.ListB, Center=dispatch_2.ListB, Factor=inner_core_size_f)  # -> Geometry, Transform

range_2 = Range(Domain=Slider(600, range=0..1000), Steps=number_slider)
range_3 = Range(Domain=Slider(600, range=0..1000), Steps=number_slider)
polygon_2 = Polygon(Plane=PlaneXY(0, 0, 0), Radius=Slider(170, range=0..1000), Segments=Slider(10, range=0..10), FilletRadius=0)  # -> Polygon, Length
z_2 = UnitZ(Factor=range_2)
polygon_3 = Polygon(Plane=PlaneXY(0, 0, 0), Radius=Slider(100, range=0..1000), Segments=Slider(10, range=0..10), FilletRadius=0)  # -> Polygon, Length
z_3 = UnitZ(Factor=range_3)
number_slider_2 = Slider(2.1, range=-3.14..3.14)
move_3 = Move(Geometry=polygon_2.Polygon, Motion=z_2)  # -> Geometry, Transform
move_4 = Move(Geometry=polygon_3.Polygon, Motion=z_3)  # -> Geometry, Transform
series_2 = Series(Start=0, Step=number_slider_2, Count=expr("x+1", number_slider))
series_3 = Series(Start=0, Step=number_slider_2, Count=expr("x+1", number_slider))
explode = Explode(Curve=move_3.Geometry, Recursive=True)  # -> Segments, Vertices
explode_2 = Explode(Curve=move_4.Geometry, Recursive=True)  # -> Segments, Vertices
negative = Negative(Value=series_2)
cull_index = CullIndex(List=explode.Vertices, Indices="0", Wrap=True)
negative_2 = Negative(Value=series_3)
cull_index_2 = CullIndex(List=explode_2.Vertices, Indices="0", Wrap=True)
shift_list = ShiftList(List=simplify(cull_index), Shift=simplify(graft(negative)), Wrap=True)  # -> simplify(List)
shift_list_2 = ShiftList(List=simplify(cull_index), Shift=simplify(graft(series_2)), Wrap=True)  # -> simplify(List)
shift_list_3 = ShiftList(List=simplify(cull_index_2), Shift=simplify(graft(negative_2)), Wrap=True)  # -> simplify(List)
shift_list_4 = ShiftList(List=simplify(cull_index_2), Shift=simplify(graft(series_3)), Wrap=True)  # -> simplify(List)
panel = Panel("""0
1""")
panel_2 = Panel("""1
0""")
flip_matrix = FlipMatrix(Data=shift_list)
flip_matrix_2 = FlipMatrix(Data=shift_list_2)
flip_matrix_3 = FlipMatrix(Data=shift_list_3)
flip_matrix_4 = FlipMatrix(Data=shift_list_4)
duplicate_data = DuplicateData(Data=panel, Number=expr("x-1", number_slider), Order=True)
duplicate_data_2 = DuplicateData(Data=panel_2, Number=expr("x-1", number_slider), Order=True)
unit_z = UnitZ(Factor=Slider(1.02, range=0..10))
pick_n_choose = PickNChoose(Pattern=duplicate_data_2, Stream0=flip_matrix_3, Stream1=flip_matrix)
pick_n_choose_2 = PickNChoose(Pattern=duplicate_data, Stream0=flip_matrix_3, Stream1=flip_matrix)
pick_n_choose_3 = PickNChoose(Pattern=duplicate_data_2, Stream0=flip_matrix_4, Stream1=flip_matrix_2)
pick_n_choose_4 = PickNChoose(Pattern=duplicate_data, Stream0=flip_matrix_4, Stream1=flip_matrix_2)
interpolate_t = InterpolateT(Vertices=pick_n_choose_2, Degree=3, TangentStart=unit_z, TangentEnd=unit_z, KnotStyle=1)  # -> Curve, Length, Domain
interpolate_t_2 = InterpolateT(Vertices=pick_n_choose_4, Degree=3, TangentStart=unit_z, TangentEnd=unit_z, KnotStyle=1)  # -> Curve, Length, Domain
interpolate_t_3 = InterpolateT(Vertices=pick_n_choose, Degree=3, TangentStart=unit_z, TangentEnd=unit_z, KnotStyle=1)  # -> Curve, Length, Domain
interpolate_t_4 = InterpolateT(Vertices=pick_n_choose_3, Degree=3, TangentStart=unit_z, TangentEnd=unit_z, KnotStyle=1)  # -> Curve, Length, Domain
number_slider_3 = Slider(10, range=0..10)
x_2 = Panel("Open")  # disabled
tspipe = TsPipe(JointSet=x_2, EndRadii=number_slider_3)  # disabled
mesh_pipe = MeshPipe(
    Curve=[interpolate_t_2.Curve, interpolate_t.Curve, interpolate_t_4.Curve, interpolate_t_3.Curve],
    Radius=number_slider_3,
    Accuracy=0.2,
    Rotation=0,
    Segments="4",
    Caps="0")
mesh = Mesh(mesh_pipe)
weaverbird_s_catmull_clark_subdivision = WeaverbirdsCatmullClarkSubdivision(MeshCurves=mesh, Level=1, SmoothNakedEdges=1)

# ----
# skeleton
number_slider_4 = Slider(120, range=0..1000)
number_slider_5 = Slider(4, range=0..10)
number_slider_6 = Slider(8, range=0..100)
number_slider_7 = Slider(65, range=0..1000)
shift_pattern = Slider(-5, range=-5..5)

average = Average(Input=[number_slider_4, number_slider_7])
division = Division(A=Slider(400, range=0..1000), B=number_slider_5)
polygon_4 = Polygon(Plane="0,0,0", Radius=number_slider_4, Segments=number_slider_6, FilletRadius=0)  # -> Polygon, Length
polygon_5 = Polygon(Plane="0,0,0", Radius=number_slider_7, Segments=number_slider_6, FilletRadius=0)  # -> Polygon, Length
polygon_6 = Polygon(Plane="0,0,0", Radius=average, Segments=number_slider_6, FilletRadius=0)  # -> Polygon, Length
division_2 = Division(A="pi", B=number_slider_6)
rotate_2 = Rotate(Geometry=polygon_5.Polygon, Angle=division_2, Plane=PlaneXY(0, 0, 0))  # -> Geometry, Transform
rotate_3 = Rotate(Geometry=polygon_5.Polygon, Angle=division_2, Plane=PlaneXY(0, 0, 0))  # -> Geometry, Transform
rotate_4 = Rotate(Geometry=polygon_6.Polygon, Angle=division_2, Plane=PlaneXY(0, 0, 0))  # -> Geometry, Transform
z_4 = UnitZ(Factor=division)
move_5 = Move(Geometry=rotate_4.Geometry, Motion=z_4)  # -> Geometry, Transform

# ----
# Outer curves
number_slider_8 = Slider(50, range=0..100)
explode_3 = Explode(Curve=rotate_3.Geometry, Recursive=True)  # -> Segments, Vertices
explode_4 = Explode(Curve=move_5.Geometry, Recursive=True)  # -> Segments, Vertices
explode_5 = Explode(Curve=polygon_4.Polygon, Recursive=True)  # -> Segments, Vertices
z_5 = UnitZ(Factor=number_slider_8)
shift_list_5 = ShiftList(List=explode_5.Vertices, Shift=1, Wrap=True)
negative_3 = Negative(Value=z_5)
bezier_span = BezierSpan(StartPoint=shift_list_5, StartTangent=z_5, EndPoint=explode_4.Vertices, EndTangent=negative_3)  # -> graft(Curve), Length, Domain
bezier_span_2 = BezierSpan(StartPoint=explode_5.Vertices, StartTangent=z_5, EndPoint=explode_4.Vertices, EndTangent=negative_3)  # -> graft(Curve), Length, Domain
bezier_span_3 = BezierSpan(StartPoint=explode_3.Vertices, StartTangent=z_5, EndPoint=explode_4.Vertices, EndTangent=negative_3)  # -> graft(Curve), Length, Domain
end_points = EndPoints(Curve=bezier_span.Curve)  # -> Start, End
end_points_2 = EndPoints(Curve=bezier_span_2.Curve)  # -> Start, End
end_points_3 = EndPoints(Curve=bezier_span_3.Curve)  # -> Start, End
xy_plane = XYPlane(Origin=end_points_2.End)
xy_plane_2 = XYPlane(Origin=end_points.End)
xy_plane_3 = XYPlane(Origin=end_points_3.End)
mirror = Mirror(Geometry=bezier_span_2.Curve, Plane=xy_plane)  # -> Geometry, Transform
mirror_2 = Mirror(Geometry=bezier_span.Curve, Plane=xy_plane_2)  # -> Geometry, Transform
mirror_3 = Mirror(Geometry=bezier_span_3.Curve, Plane=xy_plane_3)  # -> Geometry, Transform
join_curves = JoinCurves(Curves=[mirror.Geometry, bezier_span_2.Curve], Preserve=False)
join_curves_2 = JoinCurves(Curves=[mirror_3.Geometry, bezier_span_3.Curve], Preserve=False)
join_curves_3 = JoinCurves(Curves=[mirror_2.Geometry, bezier_span.Curve], Preserve=False)
entwine = Entwine(Branch00=join_curves, Branch01=join_curves_2, Branch02=join_curves_3, FlattenInputs=True)
series_4 = Series(Start=0, Step=expr("x*2", division), Count=expr("x/2", number_slider_5))
move_6 = Move(Geometry=simplify(graft(entwine)), Motion=Vector(0, 0, 10))  # -> Geometry, Transform
unit_z_2 = UnitZ(Factor=series_4)
move_7 = Move(Geometry=move_6.Geometry, Motion=unit_z_2)  # -> Geometry, Transform
ungroup = Ungroup(Group=move_7.Geometry)  # -> simplify(Objects)
trim_tree = TrimTree(Tree=ungroup, Depth=1)
join_curves_4 = JoinCurves(Curves=trim_tree, Preserve=False)  # -> simplify(Curves)

# ----
# Inner woven Guidelines
series_5 = Series(Start=0, Step=expr("x*2", division), Count=expr("x/2", number_slider_5))
z_6 = UnitZ(Factor=series_5)
move_8 = Move(Geometry=rotate_3.Geometry, Motion=z_6)  # -> Geometry, Transform
z_7 = UnitZ(Factor=Slider(50, range=0..100))
explode_6 = Explode(Curve=move_8.Geometry, Recursive=True)  # -> Segments, Vertices
negative_4 = Negative(Value=z_7)
cull_index_3 = CullIndex(List=explode_6.Vertices, Indices="0", Wrap=True)
flip_matrix_5 = FlipMatrix(Data=cull_index_3)
negative_5 = Negative(Value=shift_pattern)
list_item = ListItem(List=flip_matrix_5, Index=0, Wrap=True)  # -> flatten(Item), flatten(Item1)
shift_list_6 = ShiftList(List=list_item.Item1, Shift=negative_5, Wrap=True)
shift_list_7 = ShiftList(List=list_item.Item1, Shift=shift_pattern, Wrap=True)
bezier_span_4 = BezierSpan(StartPoint=list_item.Item, StartTangent=z_7, EndPoint=shift_list_7, EndTangent=negative_4)  # -> graft(Curve), Length, Domain
bezier_span_5 = BezierSpan(StartPoint=list_item.Item, StartTangent=z_7, EndPoint=shift_list_6, EndTangent=negative_4)  # -> graft(Curve), Length, Domain

explode_7 = Explode(Curve=scale_2.Geometry, Recursive=True)  # -> Segments, simplify(Vertices)
explode_8 = Explode(Curve=dispatch.ListB, Recursive=True)  # -> Segments, simplify(Vertices)
explode_9 = Explode(Curve=scale.Geometry, Recursive=True)  # -> Segments, simplify(Vertices)
cull_index_4 = CullIndex(List=explode_8.Vertices, Indices="-1", Wrap=True)  # -> simplify(List)
cull_index_5 = CullIndex(List=explode_7.Vertices, Indices="-1", Wrap=True)  # -> simplify(List)
cull_index_6 = CullIndex(List=explode_9.Vertices, Indices="-1", Wrap=True)  # -> simplify(List)
path_mapper = PathMapper(cull_index_4, source="{A}", target="{A*2}")
path_mapper_2 = PathMapper(cull_index_6, source="{A}", target="{A*2+1}")
path_mapper_3 = PathMapper(cull_index_5, source="{A}", target="{A*2}")
shift_list_8 = ShiftList(List=path_mapper_2, Shift="1", Wrap=True)
shift_list_9 = ShiftList(List=path_mapper, Shift=1, Wrap=True)
straight_extensions_top_and_bottom_mm = Slider(10, range=-100..100)
pipe_radii_mm = Slider(10, range=0..100)
z_8 = UnitZ(Factor=straight_extensions_top_and_bottom_mm)
value_list = ValueList({"Square", "Open", "Spikes", "Bendy", "Diamond"}, selected="Open")
cc_subdivision_count = Slider(2, range=0..10)

# ----
# Outer Double Guide Lines
dispatch_3 = Dispatch(List=cull_index_4, DispatchPattern=[True, False])  # -> ListA, ListB
split_tree = SplitTree(Data=dispatch_3.ListA, Masks=flatten("{0,2,...}"))  # -> Positive, Negative
shift_list_10 = ShiftList(List=split_tree.Positive, Shift="-1", Wrap=True)  # -> simplify(List)
shift_list_11 = ShiftList(List=split_tree.Positive, Shift=1, Wrap=True)  # -> simplify(List)
merge = Merge(Data1=shift_list_11, Data2=split_tree.Negative)
merge_2 = Merge(Data1=shift_list_10, Data2=split_tree.Negative)
z_9 = UnitZ(Factor=1)
z_10 = UnitZ(Factor=1)
flip_matrix_6 = FlipMatrix(Data=merge)
flip_matrix_7 = FlipMatrix(Data=merge_2)
interpolate_t_5 = InterpolateT(Vertices=flip_matrix_6, Degree=3, TangentStart=z_9, TangentEnd=z_9, KnotStyle=1)  # -> Curve, Length, Domain
interpolate_t_6 = InterpolateT(Vertices=flip_matrix_7, Degree=3, TangentStart=z_10, TangentEnd=z_10, KnotStyle=1)  # -> Curve, Length, Domain
dispatch_4 = Dispatch(List=flatten(interpolate_t_5.Curve), DispatchPattern=[True, False])  # -> ListA, ListB
dispatch_5 = Dispatch(List=flatten(interpolate_t_6.Curve), DispatchPattern=[True, False])  # -> ListA, ListB

# ----
# Inner Double Guide Lines
dispatch_6 = Dispatch(List=cull_index_5, DispatchPattern=[True, False])  # -> ListA, ListB
split_tree_2 = SplitTree(Data=dispatch_6.ListA, Masks=flatten("{0,2,...}"))  # -> Positive, Negative
shift_list_12 = ShiftList(List=split_tree_2.Positive, Shift="-1", Wrap=True)  # -> simplify(List)
shift_list_13 = ShiftList(List=split_tree_2.Positive, Shift=1, Wrap=True)  # -> simplify(List)
merge_3 = Merge(Data1=shift_list_13, Data2=split_tree_2.Negative)
merge_4 = Merge(Data1=shift_list_12, Data2=split_tree_2.Negative)
z_11 = UnitZ(Factor=1)
z_12 = UnitZ(Factor=1)
flip_matrix_8 = FlipMatrix(Data=merge_3)
flip_matrix_9 = FlipMatrix(Data=merge_4)
interpolate_t_7 = InterpolateT(Vertices=flip_matrix_8, Degree=3, TangentStart=z_11, TangentEnd=z_11, KnotStyle=1)  # -> Curve, Length, Domain
interpolate_t_8 = InterpolateT(Vertices=flip_matrix_9, Degree=3, TangentStart=z_12, TangentEnd=z_12, KnotStyle=1)  # -> Curve, Length, Domain
dispatch_7 = Dispatch(List=flatten(interpolate_t_7.Curve), DispatchPattern=[True, False])  # -> ListA, ListB
dispatch_8 = Dispatch(List=flatten(interpolate_t_8.Curve), DispatchPattern=[True, False])  # -> ListA, ListB

# ----
# Inner Guide Curves
shift_list_14 = ShiftList(List=path_mapper_3, Shift=1, Wrap=True)
merge_5 = Merge(Data1=simplify(path_mapper_2), Data2=simplify(shift_list_14))
flip_matrix_10 = FlipMatrix(Data=merge_5)
merge_6 = Merge(Data1=simplify(shift_list_8), Data2=path_mapper_3)
flip_matrix_11 = FlipMatrix(Data=merge_6)
split_tree_3 = SplitTree(Data=flip_matrix_11, Masks=flatten("{0,2,...}"))  # -> Positive, Negative
z_13 = UnitZ(Factor=1)
split_tree_4 = SplitTree(Data=flip_matrix_10, Masks=flatten("{1,3,...}"))  # -> Positive, Negative
z_14 = UnitZ(Factor=1)
interpolate_t_9 = InterpolateT(Vertices=split_tree_4.Positive, Degree=3, TangentStart=z_14, TangentEnd=z_14, KnotStyle=1)  # -> Curve, Length, Domain
interpolate_t_10 = InterpolateT(Vertices=split_tree_3.Positive, Degree=3, TangentStart=z_13, TangentEnd=z_13, KnotStyle=1)  # -> Curve, Length, Domain

# ----
# Outer Guide Lines
merge_7 = Merge(Data1=simplify(path_mapper_2), Data2=simplify(shift_list_9))
merge_8 = Merge(Data1=simplify(shift_list_8), Data2=path_mapper)
flip_matrix_12 = FlipMatrix(Data=merge_8)
flip_matrix_13 = FlipMatrix(Data=merge_7)
split_tree_5 = SplitTree(Data=flip_matrix_13, Masks=flatten("{1,3,...}"))  # -> Positive, Negative
split_tree_6 = SplitTree(Data=flip_matrix_12, Masks=flatten("{0,2,...}"))  # -> Positive, Negative
z_15 = UnitZ(Factor=1)
interpolate_t_11 = InterpolateT(Vertices=split_tree_6.Positive, Degree=3, TangentStart=z_15, TangentEnd=z_15, KnotStyle=1)  # -> Curve, Length, Domain
interpolate_t_12 = InterpolateT(Vertices=split_tree_5.Positive, Degree=3, TangentStart=z_15, TangentEnd=z_15, KnotStyle=1)  # -> Curve, Length, Domain

end_points_4 = EndPoints(Curve=join_curves_2)  # -> Start, End
shift_list_15 = ShiftList(List=flatten(end_points_4.End), Shift="1", Wrap=True)  # -> graft(List)
shift_list_16 = ShiftList(List=flatten(end_points_4.End), Shift="-1", Wrap=True)  # -> graft(List)
x_3 = Multiplication(A=z_5, B="2")
x_4 = Multiplication(A=negative_3, B="2")
bezier_span_6 = BezierSpan(StartPoint=shift_list_15, StartTangent=x_3, EndPoint=end_points_4.Start, EndTangent=x_4)  # -> simplify(graft(Curve)), Length, Domain
bezier_span_7 = BezierSpan(StartPoint=shift_list_16, StartTangent=x_3, EndPoint=end_points_4.Start, EndTangent=x_4)  # -> simplify(graft(Curve)), Length, Domain

list_item_2 = ListItem(List=flatten(end_points_4.Start), Index=0, Wrap=True)
xy_plane_4 = XYPlane(Origin=list_item_2)
merge_9 = Merge(Data1=flatten([bezier_span_4.Curve, bezier_span_5.Curve]))  # -> graft(Result)
merge_10 = Merge(Data1=flatten([bezier_span_6.Curve, bezier_span_7.Curve]))  # -> graft(Result)
mirror_4 = Mirror(Geometry=merge_9, Plane=xy_plane_4)  # -> Geometry, Transform
mirror_5 = Mirror(Geometry=merge_10, Plane=xy_plane_4)  # -> Geometry, Transform
number_slider_9 = Slider(20, range=-100..100)
join_curves_5 = JoinCurves(Curves=[merge_9, mirror_4.Geometry], Preserve=False)
z_16 = UnitZ(Factor=Slider(10, range=0..100))
z_17 = UnitZ(Factor=number_slider_9)
join_curves_6 = JoinCurves(Curves=[merge_10, mirror_5.Geometry], Preserve=False)
extend_curve = ExtendCurve(Curve=join_curves_5, Type=0, Start=number_slider_9, End=number_slider_9)
move_9 = Move(Geometry=extend_curve, Motion=z_17)  # -> Geometry, Transform
move_10 = Move(Geometry=join_curves_6, Motion=z_16)  # -> Geometry, Transform

trim_tree_2 = TrimTree(Tree=join_curves_4, Depth=1)
number_slider_10 = Slider(20, range=-100..100)
number_slider_11 = Slider(20, range=-100..100)
number_slider_12 = Slider(20, range=-100..100)
explode_tree = ExplodeTree(Data=trim_tree_2)  # -> Branch0, Branch1, Branch2
number_slider_13 = Slider(5, range=0..100)
number_slider_14 = Slider(10, range=0..100)
z_18 = UnitZ(Factor=number_slider_10)
z_19 = UnitZ(Factor=number_slider_11)
extend_curve_2 = ExtendCurve(Curve=move_10.Geometry, Type=0, Start=number_slider_10, End=number_slider_10)
number_slider_15 = Slider(7.5, range=0..100)
z_20 = UnitZ(Factor=number_slider_12)
extend_curve_3 = ExtendCurve(Curve=[explode_tree.Branch0, explode_tree.Branch2], Type=0, Start=number_slider_11, End=number_slider_11)
extend_curve_4 = ExtendCurve(Curve=explode_tree.Branch1, Type=0, Start=number_slider_12, End=number_slider_12)
number_slider_16 = Slider(12.5, range=0..100)
value_list_2 = ValueList({"Square", "Open", "Spikes", "Bendy", "Diamond"}, selected="Open")
move_11 = Move(Geometry=extend_curve_2, Motion=z_18)  # -> Geometry, Transform
value_list_3 = ValueList({"Square", "Open", "Spikes", "Bendy", "Diamond"}, selected="Open")
move_12 = Move(Geometry=extend_curve_3, Motion=z_19)  # -> Geometry, Transform
value_list_4 = ValueList({"Square", "Open", "Spikes", "Bendy", "Diamond"}, selected="Open")
move_13 = Move(Geometry=extend_curve_4, Motion=z_20)  # -> Geometry, Transform
value_list_5 = ValueList({"Square", "Open", "Spikes", "Bendy", "Diamond"}, selected="Open")
tspipe_2 = TsPipe(InCurves=graft(move_9.Geometry), JointSet=value_list_2, EndRadii=number_slider_13)
tspipe_3 = TsPipe(InCurves=graft(move_11.Geometry), JointSet=value_list_3, EndRadii=number_slider_15)
tspipe_4 = TsPipe(InCurves=graft(move_12.Geometry), JointSet=value_list_4, EndRadii=number_slider_14)
unit_z_3 = UnitZ(Factor=Slider(10, range=0..10))
tspipe_5 = TsPipe(InCurves=graft(move_13.Geometry), JointSet=value_list_5, EndRadii=number_slider_16)
mesh_2 = Mesh(tspipe_2)
mesh_3 = Mesh(tspipe_3)
mesh_4 = Mesh(tspipe_4)
move_14 = Move(Geometry=mesh_2, Motion=unit_z_3)  # -> Geometry, Transform
mesh_5 = Mesh(tspipe_5)

mesh_pipe_2 = MeshPipe(Curve=move_9.Geometry, Radius=number_slider_13, Accuracy=0.2, Rotation=0, Segments="4", Caps="0")
mesh_pipe_3 = MeshPipe(Curve=move_11.Geometry, Radius=number_slider_15, Accuracy=0.2, Rotation=0, Segments="4", Caps="0")
mesh_pipe_4 = MeshPipe(Curve=move_12.Geometry, Radius=number_slider_14, Accuracy=0.2, Rotation=0, Segments="4", Caps="0")
mesh_pipe_5 = MeshPipe(Curve=move_13.Geometry, Radius=number_slider_16, Accuracy=0.2, Rotation=0, Segments="4", Caps="0")
mesh_6 = Mesh([mesh_pipe_4, mesh_pipe_5, mesh_pipe_3, mesh_pipe_2])
mesh_7 = Mesh([mesh_5, mesh_4, mesh_3, move_14.Geometry])

weaverbird_s_catmull_clark_subdivision_2 = WeaverbirdsCatmullClarkSubdivision(MeshCurves=mesh_6, Level=Slider(2, range=0..10), SmoothNakedEdges="0")

extend_curve_5 = ExtendCurve(
    Curve=[interpolate_t_11.Curve, interpolate_t_12.Curve, interpolate_t_10.Curve, interpolate_t_9.Curve, dispatch_4.ListA, dispatch_5.ListA, dispatch_7.ListB, dispatch_8.ListB],
    Type=0,
    Start=straight_extensions_top_and_bottom_mm,
    End=straight_extensions_top_and_bottom_mm)
move_15 = Move(Geometry=extend_curve_5, Motion=z_8)  # -> Geometry, Transform
tspipe_6 = TsPipe(InCurves=graft(move_15.Geometry), JointSet=value_list, EndRadii=pipe_radii_mm)

mesh_pipe_6 = MeshPipe(Curve=move_15.Geometry, Radius=pipe_radii_mm, Accuracy=0.2, Rotation=0, Segments="4", Caps="0")

mesh_8 = Mesh(mesh_pipe_6)
weaverbird_s_catmull_clark_subdivision_3 = WeaverbirdsCatmullClarkSubdivision(MeshCurves=mesh_8, Level=cc_subdivision_count, SmoothNakedEdges="0")
