# Grasshopper definition 2017 11 28 - MAS Class 01.gh (Grasshopper 0.9.76)

A = Slider(3, range=0..10)  # disabled
B = Slider(5, range=0..10)  # disabled
panel = Panel("true")  # disabled
panel_2 = Panel("false")  # disabled
panel_3 = Panel("0")  # disabled
panel_4 = Panel("10")  # disabled
panel_5 = Panel("2*pi")  # disabled
panel_6 = Panel("0")  # disabled
# 01.02. booleans (1-true / 0-false)
boolean_toggle = BooleanToggle(True)  # disabled
# 01.03. Boolean operations (and, or, not)
boolean_toggle_2 = BooleanToggle(False)  # disabled
panel_7 = Panel("0")  # disabled
panel_8 = Panel("10")  # disabled
panel_9 = Panel("0")  # disabled
panel_10 = Panel("10")  # disabled
panel_11 = Panel("10")  # disabled
# (c) Andrei Jipa 2014 @ JAM.design
# Mihail-Andrei Jipa
# RIBA II, MArch (distinction);
# parametric design and digital manufacturing consultant
# www.jam-d.com
# ma.jipa@yahoo.com
# Project Name:
# File Name:
# Date:
# Version:
# 
# Revisions:
number_slider = Slider(9, range=0..10)  # disabled
# 01.06. Rational numbers: operations
number_slider_2 = Slider(4, range=0..10)  # disabled
panel_12 = Panel("0")  # disabled
number_slider_3 = Slider(44, range=0..100)  # disabled
number_slider_4 = Slider(128, range=0..1000)  # disabled
number_slider_5 = Slider(128, range=0..1000)  # disabled
number_slider_6 = Slider(128, range=0..1000)  # disabled
number_slider_7 = Slider(128, range=0..1000)  # disabled
number_slider_8 = Slider(128, range=0..1000)  # disabled
# LIST MANAGEMENT
number_slider_9 = Slider(0, range=0..100)  # disabled
# list management
number_slider_10 = Slider(10, range=0..100)  # disabled
number_slider_11 = Slider(1, range=0..1)  # disabled
number_slider_12 = Slider(10, range=0..10)  # disabled
number_slider_13 = Slider(0, range=0..1)  # disabled
number_slider_14 = Slider(15, range=0..100)  # disabled
number_slider_15 = Slider(1.4, range=0..3)  # disabled
layer_height_mm = Slider(1, range=0..10)  # disabled
panel_13 = Panel("2*pi")  # disabled
# 01.13. PARAMETRIC CURVES
panel_14 = Panel("0")  # disabled

panel_15 = Panel("0")  # disabled
# list management: item shifting
construct_point = ConstructPoint(XCoordinate=panel_15, YCoordinate=panel_15, ZCoordinate=panel_15)  # disabled
panel_16 = Panel(construct_point)  # disabled
panel_17 = Panel("0,0,0")  # disabled

number_slider_16 = Slider(10, range=0..100)  # disabled
number_slider_17 = Slider(0, range=0..1)  # disabled
number_slider_18 = Slider(1.4, range=0..3)  # disabled
# 01.13. Matching data streams (lists with different numbers of items):
# Longest List; Shortest List; Cross Referencing
number_slider_19 = Slider(0, range=0..1)  # disabled
number_slider_20 = Slider(10, range=0..100)  # disabled
number_slider_21 = Slider(1.4, range=0..3)  # disabled
object_height = Slider(180, range=0..1000)  # disabled
panel_18 = Panel("0")  # disabled
panel_19 = Panel("2*pi")  # disabled
# 01.10. Point from coordinates
X = Slider(5.55, range=0..10)  # disabled
# 0 is the default value
# 01.11. Series of values for point coordinates
Y = Slider(6.6, range=0..10)  # disabled
number_slider_22 = Slider(0, range=0..1)  # disabled
number_slider_23 = Slider(1.4, range=0..3)  # disabled
number_slider_24 = Slider(10, range=0..100)  # disabled
number_slider_25 = Slider(128, range=0..1000)  # disabled
number_slider_26 = Slider(15, range=0..100)  # disabled
number_slider_27 = Slider(0, range=0..1)  # disabled
number_slider_28 = Slider(1.4, range=0..3)  # disabled
# 01.08. Domains (1D)
number_slider_29 = Slider(0, range=0..10)  # disabled
# 01.09. SERIES vs RANGE
number_slider_30 = Slider(23, range=0..100)  # disabled
# Class #01 (30.09.2014)
# 01.01. draw points in rhino & import in gh
# (set multiple points) + make a polyline
point = Point([<point referenced from the Rhino model> x3])  # disabled
construct_domain = ConstructDomain(DomainStart=panel_6, DomainEnd=panel_5)  # disabled
# 01.13. FUNCTIONS
construct_domain_2 = ConstructDomain(DomainStart=panel_3, DomainEnd=panel_4)  # disabled
number_slider_31 = Slider(0, range=0..1)  # disabled
number_slider_32 = Slider(1.4, range=0..3)  # disabled
# 01.04. Boolean operations with more than two operands (and, or)
panel_20 = Panel("false")  # disabled
panel_21 = Panel("true")  # disabled
panel_22 = Panel("true")  # disabled
panel_23 = Panel("false")  # disabled
# 01.05. Integer operations: Integer division
# (9 / 4 = 2.25); 2.25 is not an integer (whole number)
# 
# or:
# 9 / 4 = 2 r 1  i.e. 4 * 2 + 1 = 9
# quotient 2; remainder 1
# 
# in computation:
# \ - integer division returns the quotient as a whole number
# mod - modulo/modulus returns the remainder
panel_24 = Panel("false")  # disabled
number_slider_33 = Slider(15, range=0..100)  # disabled
construct_domain_3 = ConstructDomain(DomainStart=panel_7, DomainEnd=panel_8)  # disabled
# Cross referencing 2d grids of points
number_slider_34 = Slider(0, range=0..1)  # disabled
number_slider_35 = Slider(1.4, range=0..3)  # disabled
construct_domain_4 = ConstructDomain(DomainStart=panel_9, DomainEnd=panel_10)  # disabled
construct_domain_5 = ConstructDomain(DomainStart=panel_12, DomainEnd=panel_11)  # disabled
number_slider_36 = Slider(0, range=0..10)  # disabled
number_slider_37 = Slider(128, range=0..1000)  # disabled
number_slider_38 = Slider(9, range=0..100)  # disabled
# 01.07. Rational numbers: NEGATIVE vs ABSOLUTE
panel_25 = Panel("0.544")  # disabled
panel_26 = Panel("-0.544")  # disabled
panel_27 = Panel("2*pi")  # disabled
# 01.14. PARAMETRIC surfaces
panel_28 = Panel("0")  # disabled
construct_domain_6 = ConstructDomain(DomainStart=panel_14, DomainEnd=panel_13)  # disabled
panel_29 = Panel("-1")  # disabled
panel_30 = Panel("1")  # disabled
construct_domain_7 = ConstructDomain(DomainStart=panel_18, DomainEnd=panel_19)  # disabled
panel_31 = Panel("0,0,0")  # disabled

# ---- group: Grid of points
number_slider_39 = Slider(24, range=0..100)  # disabled
number_slider_40 = Slider(1.55, range=0..10)  # disabled
number_slider_41 = Slider(24, range=0..100)  # disabled
number_slider_42 = Slider(1.55, range=0..10)  # disabled
panel_32 = Panel("0")  # disabled
panel_33 = Panel("0")  # disabled
series = Series(Start=panel_32, Step=number_slider_42, Count=number_slider_39)  # disabled
series_2 = Series(Start=panel_33, Step=number_slider_40, Count=number_slider_41)  # disabled
cross_reference = CrossReference(ListListA=series, ListListB=series_2, CrossMode=1)  # -> ListListA, ListListB; disabled
construct_point_2 = ConstructPoint(XCoordinate=cross_reference.ListListA, YCoordinate=cross_reference.ListListB, ZCoordinate=0)  # disabled

# ----
number_slider_43 = Slider(0.05, range=0..0.1)  # disabled
number_slider_44 = Slider(15000, range=0..100000)  # disabled
# 01.12. Matching data streams
# Line from end points
point_01 = Point(<point referenced from the Rhino model>)  # disabled
# ATTRACTORS
# attach attractor from rhino here
attractor = Point(Point(-3.248207313, 16.51434391, 0))  # disabled
number_slider_45 = Slider(1.55, range=0..10)  # disabled

# ---- group: Grid of points
number_slider_46 = Slider(7, range=0..100)  # disabled
brick_height = Slider(150, range=0..500)  # disabled
number_slider_47 = Slider(8, range=0..100)  # disabled
brick_length = Slider(150, range=0..1000)  # disabled
panel_34 = Panel("0")  # disabled
panel_35 = Panel("0")  # disabled
series_3 = Series(Start=panel_34, Step=brick_length, Count=number_slider_46)  # disabled
series_4 = Series(Start=panel_35, Step=brick_height, Count=number_slider_47)  # disabled
cross_reference_2 = CrossReference(ListListA=series_3, ListListB=series_4, CrossMode=1)  # -> ListListA, ListListB; disabled
construct_point_3 = ConstructPoint(XCoordinate=cross_reference_2.ListListA, YCoordinate=0, ZCoordinate=cross_reference_2.ListListB)  # disabled

# ----
point_02 = Point(<point referenced from the Rhino model>)  # disabled
# attach attractor from rhino here
number_slider_48 = Slider(27, range=0..100)  # disabled

# ---- group: grid of points
number_slider_49 = Slider(150, range=0..1000)  # disabled
number_slider_50 = Slider(16, range=0..100)  # disabled
number_slider_51 = Slider(150, range=0..500)  # disabled
number_slider_52 = Slider(24, range=0..100)  # disabled
panel_36 = Panel("0")  # disabled
panel_37 = Panel("0")  # disabled
series_5 = Series(Start=panel_36, Step=number_slider_49, Count=number_slider_50)  # disabled
series_6 = Series(Start=panel_37, Step=number_slider_51, Count=number_slider_52)  # disabled
cross_reference_3 = CrossReference(ListListA=series_5, ListListB=series_6, CrossMode=1)  # -> ListListA, ListListB; disabled
construct_point_4 = ConstructPoint(XCoordinate=cross_reference_3.ListListA, YCoordinate=0, ZCoordinate=cross_reference_3.ListListB)  # disabled

# ----
polyline = PolyLine(Vertices=point, Closed=False)  # disabled
# NOT
not = GateNot(A=panel_2)  # disabled
not_2 = GateNot(A=panel)  # disabled
number_slider_53 = Slider(128, range=0..1000)  # disabled

# ---- group: grid of points
number_slider_54 = Slider(24, range=0..100)  # disabled
number_slider_55 = Slider(1.55, range=0..10)  # disabled
number_slider_56 = Slider(1.55, range=0..10)  # disabled
number_slider_57 = Slider(24, range=0..100)  # disabled
panel_38 = Panel("0")  # disabled
panel_39 = Panel("0")  # disabled
series_7 = Series(Start=panel_39, Step=number_slider_56, Count=number_slider_54)  # disabled
series_8 = Series(Start=panel_38, Step=number_slider_55, Count=number_slider_57)  # disabled
cross_reference_4 = CrossReference(ListListA=series_7, ListListB=series_8, CrossMode=1)  # -> ListListA, ListListB; disabled
construct_point_5 = ConstructPoint(XCoordinate=cross_reference_4.ListListA, YCoordinate=cross_reference_4.ListListB, ZCoordinate=0)  # disabled

# ----
panel_40 = Panel("true")  # disabled
panel_41 = Panel("false")  # disabled
number_slider_58 = Slider(2, range=0..10)  # disabled
number_slider_59 = Slider(10, range=0..10)  # disabled
number_slider_60 = Slider(10, range=0..10)  # disabled
number_slider_61 = Slider(10, range=0..10)  # disabled
number_slider_62 = Slider(5.2, range=0..10)  # disabled
number_slider_63 = Slider(7.6, range=0..10)  # disabled
construct_domain_8 = ConstructDomain(DomainStart=panel_28, DomainEnd=panel_27)  # disabled
construct_domain_9 = ConstructDomain(DomainStart=panel_29, DomainEnd=panel_30)  # disabled
number_slider_64 = Slider(6.6, range=0..10)  # disabled
panel_42 = Panel("true")  # disabled
panel_43 = Panel("false")  # disabled
number_slider_65 = Slider(5.2, range=0..10)  # disabled
line = Line(StartPoint=point_01, EndPoint=point_02)  # disabled
number_slider_66 = Slider(7.6, range=0..10)  # disabled
and = GateAnd(A=panel_20, B=panel_21, C=panel_22, D=panel_23, E=panel_24)  # disabled
number_slider_67 = Slider(1.5, range=0..10)  # disabled
number_slider_68 = Slider(5, range=0..10)  # disabled
number_slider_69 = Slider(7, range=0..10)  # disabled
panel_44 = Panel("1")  # disabled
panel_45 = Panel("0")  # disabled
negative = Negative(Value=panel_26)  # disabled
absolute = Absolute(Value=panel_26)  # disabled
negative_2 = Negative(Value=panel_25)  # disabled
absolute_2 = Absolute(Value=panel_25)  # disabled
number_slider_70 = Slider(15, range=0..100)  # disabled
point_2 = Point(Point(920.250884, -4.213205404, 0))  # disabled
construct_domain_10 = ConstructDomain(DomainStart=number_slider_9, DomainEnd=number_slider_3)  # disabled
series_9 = Series(Start=number_slider_10, Step=number_slider_11, Count=number_slider_12)  # disabled
panel_46 = Panel(not)  # disabled
panel_47 = Panel(not_2)  # disabled
number_slider_71 = Slider(4.35, range=0..10)  # disabled
number_slider_72 = Slider(10, range=0..10)  # disabled
number_slider_73 = Slider(5.71, range=0..10)  # disabled
number_slider_74 = Slider(0.94, range=-1.57..1.57)  # disabled
series_10 = Series(Start=number_slider_13, Step=number_slider_15, Count=number_slider_14)  # disabled
curve = Curve(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)  # disabled
construct_point_6 = ConstructPoint(XCoordinate=X, YCoordinate=Y, ZCoordinate=0)  # disabled
series_11 = Series(Start=number_slider_19, Step=number_slider_21, Count=number_slider_20)  # disabled
panel_48 = Panel("0,0,0")  # disabled
number_slider_75 = Slider(90, range=0..100)  # disabled
series_12 = Series(Start=number_slider_22, Step=number_slider_23, Count=number_slider_24)  # disabled
# f(x) = sin(x) + cos(x)
range = Range(Domain=construct_domain, Steps=number_slider_5)  # disabled
series_13 = Series(Start=number_slider_17, Step=number_slider_18, Count=number_slider_16)  # disabled
# f(x) = 8.56
range_2 = Range(Domain=construct_domain_2, Steps=number_slider_4)  # disabled
panel_49 = Panel("sin(x)+cos(x)")  # disabled
number_slider_76 = Slider(0, range=0..1)  # disabled
number_slider_77 = Slider(1, range=0..3)  # disabled
number_slider_78 = Slider(10, range=0..100)  # disabled
# f(x) = x
range_3 = Range(Domain=construct_domain_3, Steps=number_slider_6)  # disabled
# f(x) = x+5
range_4 = Range(Domain=construct_domain_4, Steps=number_slider_7)  # disabled
# f(x) = 0.5*x^1.56-0.2
range_5 = Range(Domain=construct_domain_5, Steps=number_slider_8)  # disabled
panel_50 = Panel("0.5*x^1.56-0.2")  # disabled
number_slider_79 = Slider(45, range=0..100)  # disabled
series_14 = Series(Start=number_slider_31, Step=number_slider_32, Count=number_slider_16)  # disabled
construct_domain_11 = ConstructDomain(DomainStart=number_slider_29, DomainEnd=number_slider_30)  # disabled
range_6 = Range(Domain=construct_domain_6, Steps=number_slider_25)  # disabled
distance = Distance(PointA=attractor, PointB=panel_31)  # disabled
series_15 = Series(Start=number_slider_27, Step=number_slider_28, Count=number_slider_26)  # disabled
series_16 = Series(Start=number_slider_34, Step=number_slider_35, Count=number_slider_33)  # disabled
construct_domain_12 = ConstructDomain(DomainStart=number_slider_36, DomainEnd=number_slider_38)  # disabled
range_7 = Range(Domain=construct_domain_7, Steps=number_slider_37)  # disabled
division = Division(A=object_height, B=layer_height_mm)  # disabled
or = GateOr(A=and, B=panel_42, C=panel_43)  # disabled
division_2 = Division(A=number_slider, B=number_slider_2)  # disabled
integer_division = IntegerDivision(A=number_slider, B=number_slider_2)  # disabled
modulus_mod = Modulus(A=number_slider, B=number_slider_2)  # disabled
panel_51 = Panel("8.56")  # disabled
panel_52 = Panel(and)  # disabled
divide_curve = DivideCurve(Curve=curve, Count=number_slider_48, Kinks=False)  # -> Points, Tangents, Parameters; disabled
circle_cnr = CircleCNR(Center=panel_48, Normal=Vector(0, 0, 1), Radius=number_slider_44)  # disabled
panel_53 = Panel("5")  # disabled
construct_domain_13 = ConstructDomain(DomainStart=number_slider_43, DomainEnd=number_slider_45)  # disabled
xz_plane = XZPlane(Origin=Point(0, 0, 0))  # disabled
point_3 = Point(<point referenced from the Rhino model>)  # disabled
panel_54 = Panel(absolute)  # disabled
panel_55 = Panel(absolute_2)  # disabled
number_slider_80 = Slider(0.8, range=0..10)  # disabled
multiplication = Panel("A*B")  # disabled
N = Slider(2, range=0..10)  # disabled
panel_56 = Panel(negative_2)  # disabled
addition = Panel("A+B")  # disabled
subtraction = Panel("A-B")  # disabled
power = Panel("A^B")  # disabled
bth_root = Panel("A^(1/N)")  # disabled
panel_57 = Panel(negative)  # disabled
division_3 = Division(A=distance, B=number_slider_58)  # disabled
division_4 = Panel("A/B")  # disabled
U = Range(Domain=construct_domain_8, Steps=number_slider_53)  # disabled
V = Range(Domain=construct_domain_9, Steps=number_slider_53)  # disabled
panel_58 = Panel("0,0,20")  # disabled
center_box = CenterBox(Base=point_2, X=number_slider_60, Y=number_slider_61, Z=number_slider_59)  # disabled
construct_point_7 = ConstructPoint(XCoordinate=series_11, YCoordinate=number_slider_63, ZCoordinate=0)  # disabled
number_slider_81 = Slider(9, range=0..10)  # disabled
number_slider_82 = Slider(5.94, range=0..10)  # disabled
construct_point_8 = ConstructPoint(XCoordinate=series_10, YCoordinate=number_slider_62, ZCoordinate=0)  # disabled
# attach attractor from rhino here
attractor_2 = Point(Point(0.5375843797, -4.113471755, 0))  # disabled
construct_point_9 = ConstructPoint(XCoordinate=series_12, YCoordinate=number_slider_64, ZCoordinate=0)  # disabled
number_slider_83 = Slider(2.3, range=0..10)  # disabled
point_x_y_z = Panel(construct_point_6)  # disabled
addition_2 = Addition(A=range_4, B=panel_53)  # disabled
number_slider_84 = Slider(0.09, range=0..0.1)  # disabled
integer = Integer(division)  # disabled
construct_point_10 = ConstructPoint(XCoordinate=series_14, YCoordinate=number_slider_66, ZCoordinate=0)  # disabled
construct_point_11 = ConstructPoint(XCoordinate=series_13, YCoordinate=number_slider_65, ZCoordinate=0)  # disabled
# AND
# (result is TRUE only if all operands are TRUE)
panel_59 = Panel("false")  # disabled
panel_60 = Panel("false")  # disabled
panel_61 = Panel("false")  # disabled
panel_62 = Panel("true")  # disabled
panel_63 = Panel("true")  # disabled
panel_64 = Panel("false")  # disabled
panel_65 = Panel("true")  # disabled
panel_66 = Panel("true")  # disabled
evaluate = Evaluate(Expression=panel_49, Variable_x=range)  # disabled
# Circle:
# C.x = sin(t)
# C.y = cos(t)
panel_67 = Panel("sin(t)*x")  # disabled
remainder = Panel(modulus_mod)  # disabled
evaluate_2 = Evaluate(Expression=panel_50, Variable_x=range_5)  # disabled
integer_quotient = Panel(integer_division)  # disabled
rational_quotient = Panel(division_2)  # disabled
panel_68 = Panel("cos(t)")  # disabled
# Regular Spiral:
# C.x = sin(t)*t
# C.y = cos(t)*t
panel_69 = Panel("sin(t)*t")  # disabled
panel_70 = Panel("cos(t)*t")  # disabled
circle_cnr_2 = CircleCNR(Center=panel_58, Normal=Vector(0, 0, 1), Radius=number_slider_71)  # disabled
# Domain defined by start and end
# Domain also includes all numbers between the start and end
panel_71 = Panel(construct_domain_11)  # disabled
number_slider_85 = Slider(64, range=0..100)  # disabled
circle_cnr_3 = CircleCNR(Center=panel_17, Normal=Vector(0, 0, 1), Radius=number_slider_73)  # disabled
construct_point_12 = ConstructPoint(XCoordinate=range_2, YCoordinate=panel_51, ZCoordinate=0)  # disabled
center_box_2 = CenterBox(Base=point_3, X=number_slider_69, Y=number_slider_67, Z=number_slider_68)  # disabled
construct_point_13 = ConstructPoint(XCoordinate=range_3, YCoordinate=range_3, ZCoordinate=0)  # disabled
circle_cnr_4 = CircleCNR(Center=panel_31, Normal=Vector(0, 0, 1), Radius=division_3)  # disabled
division_5 = Division(A=object_height, B=integer)  # disabled
distance_2 = Distance(PointA=divide_curve.Points, PointB=attractor_2)  # disabled
rotate = Rotate(Geometry=circle_cnr, Angle=number_slider_74, Plane=xz_plane)  # -> Geometry, Transform; disabled
range_8 = Range(Domain=construct_domain_12, Steps=number_slider_72)  # disabled
panel_72 = Panel(construct_domain_10)  # disabled
ellipse = Ellipse(Plane=PlaneXY(0, 0, 0), Radius1=number_slider_75, Radius2=number_slider_79)  # -> Ellipse, Focus1, Focus2; disabled
panel_73 = Panel(or)  # disabled
series_17 = Series(Start=number_slider_76, Step=number_slider_77, Count=number_slider_78)  # disabled
negative_3 = Negative(Value=panel_57)  # disabled
negative_4 = Negative(Value=panel_56)  # disabled
absolute_3 = Absolute(Value=panel_57)  # disabled
absolute_4 = Absolute(Value=panel_56)  # disabled
number_slider_86 = Slider(2, range=-20..20)  # disabled
number_slider_87 = Slider(-1.85, range=-3.14..3.14)  # disabled
construct_point_14 = ConstructPoint(XCoordinate=range_4, YCoordinate=addition_2, ZCoordinate=0)  # disabled
number_slider_88 = Slider(0.68, range=0..10)  # disabled

# ---- group: Wall of bricks
number_slider_89 = Slider(4, range=0..10)  # disabled
number_slider_90 = Slider(6, range=0..10)  # disabled
panel_74 = Panel("0.5")  # disabled
panel_75 = Panel("0.5")  # disabled
multiplication_2 = Multiplication(A=number_slider_49, B=panel_74)  # disabled
multiplication_3 = Multiplication(A=number_slider_51, B=panel_75)  # disabled
number_slider_91 = Slider(36, range=0..100)  # disabled
subtraction_2 = Subtraction(A=multiplication_2, B=number_slider_90)  # disabled
subtraction_3 = Subtraction(A=multiplication_3, B=number_slider_89)  # disabled
center_box_3 = CenterBox(Base=construct_point_4, X=number_slider_91, Y=subtraction_2, Z=subtraction_3)  # disabled

# ----
and_2 = GateAnd(A=panel_59, B=panel_60)  # disabled

number_slider_92 = Slider(10, range=0..10)  # disabled
point_4 = Point(Point(243.7444635, -447.9441897, 0))  # disabled
unit_z = UnitZ(Factor=number_slider_92)  # disabled
unit_x = UnitX(Factor=number_slider_92)  # disabled
vector_2pt = Vector2Pt(PointA=point_2, PointB=point_4, Unitize=False)  # -> Vector, Length; disabled

and_3 = GateAnd(A=panel_61, B=panel_62)  # disabled
and_4 = GateAnd(A=panel_65, B=panel_66)  # disabled
and_5 = GateAnd(A=panel_63, B=panel_64)  # disabled
number_slider_93 = Slider(-1.85, range=-3.14..3.14)  # disabled
series_18 = Panel(series_12)  # disabled
number_slider_94 = Slider(766, range=0..1000)  # disabled
# Point list previews in Rhino the index of the point in the list
point_list = PointList(Points=construct_point_9, Size=number_slider_80)  # disabled
boolean_toggle_3 = BooleanToggle(True)  # disabled

# ---- group: Create wall of bricks
gap_size = Slider(6, range=0..10)  # disabled
panel_76 = Panel("0.5")  # disabled
panel_77 = Panel("0.5")  # disabled
multiplication_4 = Multiplication(A=brick_height, B=panel_76)  # disabled
multiplication_5 = Multiplication(A=brick_length, B=panel_77)  # disabled
subtraction_4 = Subtraction(A=multiplication_5, B=gap_size)  # disabled
subtraction_5 = Subtraction(A=multiplication_4, B=gap_size)  # disabled
brick_depth = Slider(75, range=0..100)  # disabled
center_box_4 = CenterBox(Base=construct_point_3, X=brick_depth, Y=subtraction_4, Z=subtraction_5)  # disabled

# ----
construct_point_15 = ConstructPoint(XCoordinate=range, YCoordinate=evaluate, ZCoordinate=0)  # disabled
xy_plane = XYPlane(Origin=point_3)  # disabled
construct_point_16 = ConstructPoint(XCoordinate=range_5, YCoordinate=evaluate_2, ZCoordinate=0)  # disabled
evaluate_3 = Evaluate(Expression=addition, A=A, B=B)  # disabled
evaluate_4 = Evaluate(Expression=subtraction, A=A, B=B)  # disabled
evaluate_5 = Evaluate(Expression=multiplication, A=A, B=B)  # disabled
evaluate_6 = Evaluate(Expression=division_4, A=A, B=B)  # disabled
evaluate_7 = Evaluate(Expression=power, A=A, B=B)  # disabled
evaluate_8 = Evaluate(Expression=bth_root, A=A, N=N)  # disabled
divide_curve_2 = DivideCurve(Curve=circle_cnr_2, Count=number_slider_70, Kinks=False)  # -> Points, Tangents, Parameters; disabled
and_6 = GateAnd(A=panel_52, B=or, C=panel_73)  # disabled
cross_reference_5 = CrossReference(ListListA=series_16, ListListB=series_15, CrossMode=1)  # -> ListListA, ListListB; disabled
series_19 = Series(Start=division_5, Step=division_5, Count=integer)  # disabled
construct_point_17 = ConstructPoint(XCoordinate=series_16, YCoordinate=series_15, ZCoordinate=0)  # disabled
divide_curve_3 = DivideCurve(Curve=circle_cnr_3, Count=number_slider_70, Kinks=False)  # -> Points, Tangents, Parameters; disabled
random = Random(Range=panel_72, Number=number_slider_81, Seed=number_slider_82)  # disabled
# By default in equal length lists, items with equal indexes are matched:
# 
# {7.0, 7.6, 0.0} is matched with {7.0, 5.2, 0.0} to form a line
# i.e. Item #5 from Start points list is matched with item #5 from End Points list and form line #5 in the lines list
line_2 = Line(StartPoint=construct_point_10, EndPoint=construct_point_11)  # disabled
interpolate = Interpolate(Vertices=construct_point_12, Degree=3, Periodic=False, KnotStyle=1)  # -> Curve, Length, Domain; disabled
series_20 = Panel(series_17)  # disabled
range_9 = Panel(range_8)  # disabled
evaluate_9 = Evaluate(Expression=panel_67, t=range_6, x=number_slider_83)  # disabled
interpolate_2 = Interpolate(Vertices=construct_point_13, Degree=3, Periodic=False, KnotStyle=1)  # -> Curve, Length, Domain; disabled
addition_3 = Addition(A=A, B=B)  # disabled
subtraction_6 = Subtraction(A=A, B=B)  # disabled
multiplication_6 = Multiplication(A=A, B=B)  # disabled
division_6 = Division(A=A, B=B)  # disabled
power_2 = Power(A=A, B=B)  # disabled
square_root = SquareRoot(Value=A)  # disabled
evaluate_10 = Evaluate(Expression=panel_68, t=range_6)  # disabled
panel_78 = Panel(absolute_3)  # disabled
panel_79 = Panel(absolute_4)  # disabled
panel_80 = Panel(negative_3)  # disabled
evaluate_11 = Evaluate(Expression=panel_69, t=range_7)  # disabled
panel_81 = Panel(negative_4)  # disabled
evaluate_12 = Evaluate(Expression=panel_70, t=range_7)  # disabled
multiplication_7 = Multiplication(A=distance_2, B=number_slider_84)  # disabled
# Remembre to cross
# reference the values!!
cross_reference_6 = CrossReference(ListListA=U, ListListB=V, CrossMode=1)  # -> ListListA, ListListB; disabled
point_on_curve = PointOnCurve(rotate.Geometry, parameter=1)  # disabled
xy_plane_2 = XYPlane(Origin=point_2)  # disabled
boolean_toggle_4 = BooleanToggle(True)  # disabled
divide_curve_4 = DivideCurve(Curve=ellipse.Ellipse, Count=number_slider_85, Kinks=False)  # -> Points, Tangents, Parameters; disabled
panel_82 = Panel(and_4)  # disabled
number_slider_95 = Slider(5, range=0..10)  # disabled
panel_83 = Panel(and_2)  # disabled
number_slider_96 = Slider(14.5, range=0..100)  # disabled
panel_84 = Panel(and_3)  # disabled
panel_85 = Panel(and_5)  # disabled
interpolate_3 = Interpolate(Vertices=construct_point_14, Degree=3, Periodic=False, KnotStyle=1)  # -> Curve, Length, Domain; disabled
panel_86 = Panel(and_6)  # disabled
points = Panel(construct_point_9)  # disabled
interpolate_4 = Interpolate(Vertices=construct_point_15, Degree=3, Periodic=False, KnotStyle=1)  # -> Curve, Length, Domain; disabled
interpolate_5 = Interpolate(Vertices=construct_point_16, Degree=3, Periodic=False, KnotStyle=1)  # -> Curve, Length, Domain; disabled
number_slider_97 = Slider(9, range=0..20)  # disabled
rotate_2 = Rotate(Geometry=center_box_2, Angle=number_slider_87, Plane=xy_plane)  # -> Geometry, Transform; disabled
panel_87 = Panel(evaluate_3)  # disabled
panel_88 = Panel(evaluate_6)  # disabled
panel_89 = Panel(addition_3)  # disabled
panel_90 = Panel(subtraction_6)  # disabled
panel_91 = Panel(evaluate_4)  # disabled
panel_92 = Panel(evaluate_5)  # disabled
panel_93 = Panel(multiplication_6)  # disabled
panel_94 = Panel(division_6)  # disabled
panel_95 = Panel(evaluate_7)  # disabled
panel_96 = Panel(power_2)  # disabled
panel_97 = Panel(evaluate_8)  # disabled
panel_98 = Panel(square_root)  # disabled
panel_99 = Panel(random)  # disabled
z = UnitZ(Factor=series_19)  # disabled
# attach attractor from rhino here
attractor_3 = Point(Point(7.592909345, 8.893293019, 0))  # disabled
# attach attractor from rhino here
attractor_4 = Point(Point(28.91781144, 8.38471868, 0))  # disabled
shift_list = ShiftList(List=divide_curve_2.Points, Shift=number_slider_86, Wrap=boolean_toggle_3)  # disabled
# By default in equal length lists, items with equal indexes are matched:
# to get all possible combinations of (x,y) coordinates, use cross referencing
construct_point_18 = ConstructPoint(XCoordinate=cross_reference_5.ListListA, YCoordinate=cross_reference_5.ListListB, ZCoordinate=0)  # disabled
circle_cnr_5 = CircleCNR(Center=divide_curve.Points, Normal=Vector(0, 0, 1), Radius=multiplication_7)  # disabled
point_list_2 = PointList(Points=divide_curve_3.Points, Size=number_slider_88)  # disabled
rotate_3 = Rotate(Geometry=center_box, Angle=number_slider_93, Plane=xy_plane_2)  # -> Geometry, Transform; disabled
longest_list = LongestList(ListListA=construct_point_7, ListListB=construct_point_8, PaddingMode=2)  # -> ListListA, ListListB; disabled
shortest_list = ShortestList(ListListA=construct_point_7, ListListB=construct_point_8, TrimMode=2)  # -> ListListA, ListListB; disabled
cross_reference_7 = CrossReference(ListListA=construct_point_7, ListListB=construct_point_8, CrossMode=1)  # -> ListListA, ListListB; disabled
boolean_toggle_5 = BooleanToggle(False)  # disabled
start_points = Panel(construct_point_10)  # disabled
# lists of values (each item has an index)
# indices are always a series of integers starting at 0:
# 0, 1, 2, 3 ...
# In list 'E1':
#    item '98.5' has index (5)
#    item '7 to 9.5' has index (4)
#    etc
list_e1 = Panel("""ad
326
2.365
2
7 to 9.5
98.5
9hg
0
<>
{0.0, 3.5, 6.8}""")  # disabled
sphere = Sphere(Base=point_on_curve, Radius=number_slider_94)  # disabled
construct_point_19 = ConstructPoint(XCoordinate=evaluate_9, YCoordinate=evaluate_10, ZCoordinate=0)  # disabled
construct_point_20 = ConstructPoint(XCoordinate=evaluate_11, YCoordinate=evaluate_12, ZCoordinate=0)  # disabled
panel_100 = Panel(series_9)  # disabled
polyline_2 = PolyLine(Vertices=divide_curve_4.Points, Closed=boolean_toggle_4)  # disabled
line_3 = Line(StartPoint=divide_curve_3.Points, EndPoint=shift_list)  # disabled

number_slider_98 = Slider(1.91, range=-3.14..3.14)  # disabled
number_slider_99 = Slider(0.04, range=-3.14..3.14)  # disabled
# Remap height of bricks (same as distance from XY plane or z coordinate of centrepoint) to desired rotation values
bounds = Bounds(Numbers=cross_reference_2.ListListB)  # disabled
construct_domain_14 = ConstructDomain(DomainStart=number_slider_99, DomainEnd=number_slider_98)  # disabled
remap_numbers = RemapNumbers(Value=cross_reference_2.ListListB, Source=bounds, Target=construct_domain_14)  # -> Mapped, Clipped; disabled

point_list_3 = PointList(Points=shift_list, Size=number_slider_88)  # disabled
panel_101 = Panel("(1+v/2*cos(u/2))*sin(u)")  # disabled
panel_102 = Panel("v/2 * sin(u/2)")  # disabled
panel_103 = Panel("(1+v/2*cos(u/2))*cos(u)")  # disabled
# OR
# (result is TRUE only if at least one operand is TRUE)
panel_104 = Panel("false")  # disabled
panel_105 = Panel("false")  # disabled
panel_106 = Panel("false")  # disabled
panel_107 = Panel("true")  # disabled
panel_108 = Panel("true")  # disabled
panel_109 = Panel("false")  # disabled
panel_110 = Panel("true")  # disabled
panel_111 = Panel("true")  # disabled
panel_112 = Panel("0 to pi/4")  # disabled
# use distance between grid points and a point attractor to generate circle radii
distance_3 = Distance(PointA=construct_point_5, PointB=attractor_4)  # disabled
line_4 = Line(StartPoint=longest_list.ListListA, EndPoint=longest_list.ListListB)  # disabled
line_5 = Line(StartPoint=cross_reference_7.ListListA, EndPoint=cross_reference_7.ListListB)  # disabled

# ---- group: Use either point or curve attractors from rhino
point_5 = Point(Point(1730.764897, 88.17146009, 1003.482844))  # disabled
curve_2 = Curve(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)  # disabled

# ----
line_6 = Line(StartPoint=shortest_list.ListListA, EndPoint=shortest_list.ListListB)  # disabled

sine = Sine(Value=panel_99)  # disabled
construct_point_21 = ConstructPoint(XCoordinate=panel_99, YCoordinate=sine, ZCoordinate=0)  # disabled
panel_113 = Panel("Points (x; sin(x); 0.00)")  # disabled
sort_list = SortList(Keys=panel_99, ValuesValuesA=construct_point_21)  # -> Keys, ValuesValuesA; disabled
sort_list_2 = SortList(Keys=sine, ValuesValuesA=construct_point_21)  # -> Keys, ValuesValuesA; disabled
points_sorted_by_x_coordinate = Panel(sort_list.ValuesValuesA)  # disabled
points_sorted_by_y_coordinate_sin_x = Panel(sort_list_2.ValuesValuesA)  # disabled

# ----
# use distance between grid points and a point attractor to generate circle radii
distance_4 = Distance(PointA=construct_point_2, PointB=attractor_3)  # disabled
interpolate_6 = Interpolate(Vertices=construct_point_20, Degree=3, Periodic=False, KnotStyle=1)  # -> Curve, Length, Domain; disabled
list_length = ListLength(List=series_9)  # disabled
insert_items = InsertItems(List=series_9, Item=number_slider_96, Indices=number_slider_95, Wrap=True)  # disabled
replace_items = ReplaceItems(List=series_9, Item=number_slider_96, Indices=number_slider_95, Wrap=False)  # disabled
end_points = Panel(construct_point_11)  # disabled
reverse_list = ReverseList(List=series_9)  # disabled
list_item = ListItem(List=series_9, Index=number_slider_97, Wrap=boolean_toggle_5)  # disabled
curve_closest_point = CurveClosestPoint(Point=construct_point_4, Curve=curve_2)  # -> Point, Parameter, Distance; disabled
distance_5 = Distance(PointA=point_5, PointB=construct_point_4)  # disabled
panel_114 = Panel("5")  # disabled
# DIVISION by 0
# 9 / 0 = undefined operation
# 0 / 0 = indeterminate result
# in computation, /0 generates a floating point exception error
panel_115 = Panel("0")  # disabled
move = Move(Geometry=polyline_2, Motion=z)  # -> Geometry, Transform; disabled
# Sort Numbers in a List
sort_list_3 = SortList(Keys=panel_99)  # -> Keys, ValuesValuesA; disabled
move_2 = Move(Geometry=center_box, Motion=rotate_3.Geometry)  # -> Geometry, Transform; disabled
interpolate_7 = Interpolate(Vertices=construct_point_19, Degree=3, Periodic=False, KnotStyle=1)  # -> Curve, Length, Domain; disabled
original_list = Panel(divide_curve_2.Points)  # disabled
range_10 = Range(Domain=panel_112, Steps=expr("x-1", integer))  # disabled
or_2 = GateOr(A=panel_110, B=panel_111)  # disabled
or_3 = GateOr(A=panel_104, B=panel_105)  # disabled
or_4 = GateOr(A=panel_106, B=panel_107)  # disabled
or_5 = GateOr(A=panel_108, B=panel_109)  # disabled
number_slider_100 = Slider(10.545, range=0..50)  # disabled
evaluate_13 = Evaluate(Expression=panel_102, u=cross_reference_6.ListListA, v=cross_reference_6.ListListB)  # disabled
division_7 = Division(A=panel_114, B=panel_115)  # disabled
evaluate_14 = Evaluate(Expression=panel_103, u=cross_reference_6.ListListA, v=cross_reference_6.ListListB)  # disabled
evaluate_15 = Evaluate(Expression=panel_101, u=cross_reference_6.ListListA, v=cross_reference_6.ListListB)  # disabled

# ----
# create a domain form min and max desired radii
number_slider_101 = Slider(0.05, range=0..0.1)  # disabled
number_slider_102 = Slider(0.98, range=0..10)  # disabled
construct_domain_15 = ConstructDomain(DomainStart=number_slider_101, DomainEnd=number_slider_102)  # disabled

number_slider_103 = Slider(0, range=0..1)  # disabled
number_slider_104 = Slider(1123, range=0..10000)  # disabled
panel_116 = Panel(list_item)  # disabled
panel_117 = Panel(list_length)  # disabled
panel_118 = Panel(insert_items)  # disabled
number_slider_105 = Slider(1, range=0..10)  # disabled
panel_119 = Panel(sort_list_3.Keys)  # disabled
lines = Panel(line_2)  # disabled
panel_120 = Panel(or_2)  # disabled
panel_121 = Panel(or_3)  # disabled
panel_122 = Panel(or_4)  # disabled
panel_123 = Panel(or_5)  # disabled
bounds_2 = Bounds(Numbers=distance_3)  # disabled
panel_124 = Panel(division_7)  # disabled
list_a = Panel(cross_reference_7.ListListA)  # disabled
panel_125 = Panel("0")  # disabled
rotate_4 = Rotate(Geometry=move.Geometry, Angle=range_10, Plane=PlaneXY(0, 0, 0))  # -> Geometry, Transform; disabled
panel_126 = Panel(replace_items)  # disabled
number_slider_106 = Slider(1, range=0..1)  # disabled
panel_127 = Panel(reverse_list)  # disabled
construct_point_22 = ConstructPoint(XCoordinate=evaluate_14, YCoordinate=evaluate_15, ZCoordinate=evaluate_13)  # disabled
shifted_list = Panel(shift_list)  # disabled
panel_128 = Panel("""Direct prop
P
Inverse proportionality
1/P""")  # disabled
series_21 = Series(Start=panel_125, Step=number_slider_100, Count=integer)  # disabled
construct_domain_16 = ConstructDomain(DomainStart=number_slider_103, DomainEnd=number_slider_104)  # disabled
number_slider_107 = Slider(1, range=0..1)  # disabled
multiplication_8 = Multiplication(A=distance_4, B=number_slider_105)  # disabled
bounds_3 = Bounds(Numbers=curve_closest_point.Distance)  # disabled
panel_129 = Panel("1")  # disabled
xy_plane_3 = XYPlane(Origin=construct_point_3)  # disabled
list_b = Panel(cross_reference_7.ListListB)  # disabled
number_slider_108 = Slider(3.14, range=-3.14..3.14)  # disabled
number_slider_109 = Slider(-3.14, range=-3.14..3.14)  # disabled
polyline_3 = PolyLine(Vertices=construct_point_22, Closed=False)  # disabled
mod = Modulus(A=series_21, B=panel_129)  # disabled
division_8 = Division(A=number_slider_106, B=multiplication_8)  # disabled
remap_numbers_2 = RemapNumbers(Value=distance_3, Source=bounds_2, Target=construct_domain_15)  # -> Mapped, Clipped; disabled
rotate_5 = Rotate(Geometry=center_box_4, Angle=remap_numbers.Mapped, Plane=xy_plane_3)  # -> Geometry, Transform; disabled
panel_130 = Panel(bounds_3)  # disabled
jitter = Jitter(List=panel_119, Jitter=number_slider_107, Seed=2)  # -> Values, Indices; disabled
remap_numbers_3 = RemapNumbers(Value=curve_closest_point.Distance, Source=bounds_3, Target=construct_domain_16)  # -> Mapped, Clipped; disabled
shift_list_2 = ShiftList(List=mod, Shift=1, Wrap=True)  # disabled
circle_cnr_6 = CircleCNR(Center=construct_point_2, Normal=Vector(0, 0, 1), Radius=division_8)  # disabled
number_slider_110 = Slider(0, range=-18.85..18.85)  # disabled
construct_domain_17 = ConstructDomain(DomainStart=number_slider_109, DomainEnd=number_slider_108)  # disabled
square = Square(Plane=PlaneXY(0, 0, 0), Size=1, ExtentX=5, ExtentY=5)  # -> Cells, Points
bounds_4 = Bounds(Numbers=distance_5)  # disabled
circle_cnr_7 = CircleCNR(Center=construct_point_5, Normal=Vector(0, 0, 1), Radius=remap_numbers_2.Mapped)  # disabled
number_slider_111 = Slider(10, range=0..100)
panel_131 = Panel(jitter.Values)  # disabled
panel_132 = Panel("""for i = 0 to 9
a+=1
next""")
evaluate_curve = EvaluateCurve(Curve=reparameterize(rotate_4.Geometry), Parameter=mod)  # -> Point, Tangent, Angle; disabled
evaluate_curve_2 = EvaluateCurve(Curve=reparameterize(rotate_4.Geometry), Parameter=shift_list_2)  # -> Point, Tangent, Angle; disabled
construct_domain_18 = ConstructDomain(DomainStart=Slider(0, range=0..100), DomainEnd=Slider(10, range=0..10))
data = Data(square.Points)
panel_133 = Panel("2*pi")  # disabled
unit_y = UnitY(Factor=remap_numbers_3.Mapped)  # disabled
remap_numbers_4 = RemapNumbers(Value=distance_5, Source=bounds_4, Target=construct_domain_17)  # -> Mapped, Clipped; disabled
number_slider_112 = Slider(896, range=0..1000)  # disabled
C = Slider(50, range=0..100)  # disabled
F = Slider(122, range=32..212)  # disabled
xy_plane_4 = XYPlane(Origin=construct_point_4)  # disabled
# Sort numbers again
sort_list_4 = SortList(Keys=panel_131)  # -> Keys, ValuesValuesA; disabled
series_22 = Series(Start="0", Step="1", Count=number_slider_111)
construct_domain_19 = ConstructDomain(DomainStart=number_slider_110, DomainEnd=panel_133)  # disabled
series_23 = Series(Start="0", Step="1", Count=Slider(15, range=0..100))
series_24 = Series(Start="0", Step="1", Count=Slider(15, range=0..100))
temp_c = Panel("""[0...100]

0
...
20
...
38
...
100

t(C) = (t(F)-32)/1.8""")  # disabled
series_25 = Series(Start="0", Step="1", Count=number_slider_111)
temp_c_2 = Panel("""[0...100]

0
...
10 (10%)
...
25 (25%)
...
50
...
100""")  # disabled
line_7 = Line(StartPoint=evaluate_curve.Point, EndPoint=evaluate_curve_2.Point)  # disabled
number_slider_113 = Slider(50, range=0..100)  # disabled
range_11 = Range(Domain=construct_domain_18, Steps=number_slider_111)
panel_135 = Panel("-1")  # disabled
panel_136 = Panel("0 to 100")  # disabled
panel_137 = Panel("32 to 212")  # disabled
move_3 = Move(Geometry=center_box_3, Motion=unit_y)  # -> Geometry, Transform; disabled
gradient = Gradient(
    LowerLimit=number_slider_103,
    UpperLimit=number_slider_104,
    Parameter=remap_numbers_3.Mapped,
    stops=[0: RGB(243, 57, 0), 0.1: RGB(236, 27, 60), 0.2: RGB(210, 0, 118), 0.3: RGB(103, 0, 120), 0.4: RGB(39, 72, 161), 0.5: RGB(1, 192, 229), 0.6: RGB(18, 178, 90), 0.7: RGB(79, 186, 8), 0.8: RGB(220, 237, 32), 0.9: RGB(247, 159, 20), 1: RGB(243, 57, 0)])  # disabled
panel_138 = Panel("cos(t)*(e^(cos(t*3)) - 3*cos(2*t) + sin(t/12)^3)")  # disabled
panel_139 = Panel("sin(t)*(pi^(cos(t)) - 2*sin(t)*cos(4*t) + sin(t/12)^5)")  # disabled
panel_140 = Panel(series_22)
cull_index = CullIndex(List=line_7, Indices=panel_135, Wrap=True)  # disabled
rotate_6 = Rotate(Geometry=center_box_3, Angle=remap_numbers_4.Mapped, Plane=xy_plane_4)  # -> Geometry, Transform; disabled
panel_141 = Panel(sort_list_4.Keys)  # disabled
# Regular Spiral:
# C.x = sin(t)*t
# C.y = cos(t)*t
range_12 = Range(Domain=construct_domain_19, Steps=number_slider_112)  # disabled
colour_picker = ColourPicker(PickedColour=RGB(101, 117, 128))  # disabled
panel_142 = Panel(range_11)
temp_f = Panel("""[32...212]

32
...
68
...
100
...
212

t(F) = t(C)*1.8 + 32""")  # disabled
temp_f_2 = Panel("""[32...212]

32
...
50 (10%)
...
77 (25%)
...
122
...
212""")  # disabled
construct_point_23 = ConstructPoint(XCoordinate=series_25, YCoordinate=0, ZCoordinate=0)
panel_143 = Panel("-pi to  pi")  # disabled
construct_point_24 = ConstructPoint(XCoordinate=series_23, YCoordinate=Slider(2.5, range=0..10), ZCoordinate=0)
remap_numbers_5 = RemapNumbers(Value=number_slider_113, Source=panel_136, Target=panel_137)  # -> Mapped, Clipped; disabled
cross_reference_8 = CrossReference(ListA=series_22, ListB=series_24, CrossMode=1)  # -> ListA, ListB
construct_point_25 = ConstructPoint(XCoordinate="0", YCoordinate=series_24, ZCoordinate=0)
panel_144 = Panel(series_24)
weave = Weave(Pattern=[0, 1], Stream0=rotate_4.Geometry, Stream1=cull_index, NullGaps=False)  # disabled
panel_145 = Panel(remap_numbers_5.Mapped)  # disabled
custom_preview = CustomPreview(Geometry=move_3.Geometry, Shader=gradient)  # disabled
number_slider_114 = Slider(3, range=0..100)  # disabled
number_slider_115 = Slider(0, range=0..100)  # disabled
number_slider_116 = Slider(14, range=0..100)  # disabled
number_slider_117 = Slider(35, range=0..100)  # disabled
panel_146 = Panel(construct_point_23)
construct_point_26 = ConstructPoint(XCoordinate=cross_reference_8.ListA, YCoordinate=cross_reference_8.ListB, ZCoordinate=0)
explode = Explode(Curve=weave, Recursive=True)  # -> Segments, Vertices; disabled
evaluate_16 = Evaluate(Expression=panel_139, t=range_12)  # disabled
evaluate_17 = Evaluate(Expression=panel_138, t=range_12)  # disabled
cross_reference_9 = CrossReference(ListA=construct_point_23, ListB=construct_point_24, CrossMode=1)  # -> ListA, ListB
range_13 = Range(Domain="0 to 4*pi", Steps=Slider(81, range=0..100))
random_2 = Random(Range="0 to 10", Number=Slider(12, range=0..100), Seed=Slider(4, range=0..10))
random_3 = Random(Range="0 to 10", Number=Slider(12, range=0..100), Seed=2)
panel_147 = Panel(construct_point_24)
expression = Expression(Variable_x=range_13, Expression="sin(x)*x*pi")
expression_2 = Expression(Variable_x=range_13, Expression="sin(x)*cos(x)")
expression_3 = Expression(Variable_x=range_13, Expression="cos(x)*x")
polyline_4 = PolyLine(Vertices=flatten(explode.Vertices), Closed=False)  # disabled
series_26 = Series(Start=number_slider_115, Step=1, Count=number_slider_116)  # disabled
series_27 = Series(Start=number_slider_115, Step=1, Count=number_slider_114)  # disabled
series_28 = Series(Start=number_slider_115, Step=1, Count=number_slider_117)  # disabled
line_8 = Line(StartPoint=cross_reference_9.ListA, EndPoint=cross_reference_9.ListB)
construct_point_27 = ConstructPoint(XCoordinate=evaluate_16, YCoordinate=evaluate_17, ZCoordinate=0)  # disabled
sort_list_5 = SortList(Keys=random_2)  # -> Keys, ValuesA
panel_148 = Panel(series_26)  # disabled
panel_149 = Panel(random_3)
interpolate_8 = Interpolate(Vertices=construct_point_27, Degree=3, Periodic=False, KnotStyle=1)  # -> Curve, Length, Domain; disabled
curve_3 = Curve([<curve referenced from the Rhino model> x2])  # disabled
construct_point_28 = ConstructPoint(XCoordinate=expression_3, YCoordinate=expression, ZCoordinate=expression_2)
cross_reference_10 = CrossReference(ListListA=series_26, ListListB=series_27, ListA=series_28, CrossMode=1)  # -> ListListA, ListListB, ListA; disabled
panel_150 = Panel(sort_list_5.Keys)
series_29 = Series(Start=Slider(3, range=0..10), Step=1, Count=10)
panel_151 = Panel(series_29)
number = Number(panel_151)
expression_4 = Expression(Variable_x=number, myT=Slider(10, range=0..10), Expression="if(x>myT, 10, False)")
number_slider_118 = Slider(-0.141, range=-3.142..3.142)  # disabled
panel_152 = Panel(random_2)
panel_153 = Panel(series_27)  # disabled
larger_than = LargerThan(FirstNumber=panel_151, SecondNumber=Slider(5, range=0..10))  # -> LargerThan, OrEqualTo
number_slider_119 = Slider(1.7, range=0..10)  # disabled
panel_154 = Panel("""1
1
0""")
x = Panel("0")  # disabled
x_2 = Panel("0")
construct_point_29 = ConstructPoint(XCoordinate=panel_151, YCoordinate=0, ZCoordinate=0)
interpolate_9 = Interpolate(Vertices=construct_point_28, Degree=3, Periodic=False, KnotStyle=1)  # -> Curve, Length, Domain
construct_point_30 = ConstructPoint(XCoordinate=cross_reference_10.ListListA, YCoordinate=cross_reference_10.ListListB, ZCoordinate=cross_reference_10.ListA)  # disabled
curve_closest_point_2 = CurveClosestPoint(Point=construct_point_30, Curve=curve_3)  # -> Point, Parameter, Distance; disabled
number_slider_120 = Slider(0.23, range=0..1)  # disabled
panel_155 = Panel(series_28)  # disabled
jitter_2 = Jitter(List=panel_150, Jitter=Slider(1, range=0..1), Seed=2)  # -> Values, Indices
construct_domain_20 = ConstructDomain(DomainStart=x, DomainEnd=number_slider_118)  # disabled
bounds_5 = Bounds(Numbers=curve_closest_point_2.Parameter)  # disabled
panel_156 = Panel(expression_4)
division_9 = Division(A=curve_closest_point_2.Distance, B=number_slider_119)  # disabled
panel_157 = Panel(jitter_2.Values)
dispatch = Dispatch(List=construct_point_29, DispatchPattern=larger_than.LargerThan)  # -> ListA, ListB
cull_pattern = CullPattern(List=construct_point_29, CullPattern=panel_154)
unit_y_2 = UnitY(Factor=division_9)  # disabled
remap_numbers_6 = RemapNumbers(Value=curve_closest_point_2.Parameter, Source=bounds_5, Target=construct_domain_20)  # -> Mapped, Clipped; disabled
center_box_5 = CenterBox(Base=construct_point_30, X=number_slider_120, Y=number_slider_120, Z=number_slider_120)  # disabled
replace_items_2 = ReplaceItems(List=panel_151, Item="A", Indices=Slider(4, range=0..10), Wrap=False)
list_item_2 = ListItem(List=panel_151, Index="-2", Wrap=Toggle(True))  # -> Item, Item1, Item2
number_slider_121 = Slider(7.4, range=0..100)  # disabled
panel_158 = Panel(replace_items_2)
panel_159 = Panel(list_item_2.Item1)
panel_160 = Panel(list_item_2.Item)
sphere_2 = Sphere(Base=dispatch.ListB, Radius=Slider(0.23, range=0..1))
range_14 = Range(Domain="0 to 2*pi", Steps=Slider(32, range=0..100))
move_4 = Move(Geometry=center_box_5, Motion=unit_y_2)  # -> Geometry, Transform; disabled
move_5 = Move(Geometry=construct_point_30, Motion=unit_y_2)  # -> Geometry, Transform; disabled
number_slider_122 = Slider(12, range=0..100)  # disabled
unit_z_2 = UnitZ(Factor=number_slider_121)  # disabled
expression_5 = Expression(x=range_14, myT=Slider(1.9, range=0.2..5), Expression="cos(x) * myT")
expression_6 = Expression(x=range_14, Expression="sin(x)")
object_height_mm = Slider(150, range=0..1000)
number_slider_123 = Slider(0.5, range=0..1)  # disabled
number_slider_124 = Slider(2, range=0..10)  # disabled
number_slider_125 = Slider(2, range=0.1..20)
curve_4 = Curve([<curve referenced from the Rhino model> x2])  # disabled
deconstruct = Deconstruct(Point=move_5.Geometry)  # -> XComponent, YComponent, ZComponent; disabled
polygon = Polygon(Plane=PlaneXY(0, 0, 0), Radius=3, Segments=number_slider_122, FilletRadius=0)  # -> Polygon, Length; disabled
move_6 = Move(Geometry=polygon.Polygon, Motion=unit_z_2)  # -> Geometry, Transform; disabled
number_slider_126 = Slider(0.6, range=0..1)  # disabled
platform_centre = Panel("105,105,0")
circle_cnr_8 = CircleCNR(Normal=Vector(0, 0, 1), Radius=1)  # disabled
number_slider_127 = Slider(0.2, range=0..1)  # disabled
construct_point_31 = ConstructPoint(XCoordinate=expression_6, YCoordinate=expression_5, ZCoordinate=0)
curve_closest_point_3 = CurveClosestPoint(Point=construct_point_30, Curve=curve_4)  # -> Point, Parameter, Distance; disabled
xy_plane_5 = XYPlane(Origin=move_5.Geometry)  # disabled
xz_plane_2 = XZPlane(Origin=Point(0, 0, 0))  # disabled
construct_domain_21 = ConstructDomain(DomainStart=number_slider_124, DomainEnd=number_slider_123)  # disabled
bounds_6 = Bounds(Numbers=deconstruct.ZComponent)  # disabled
division_10 = Division(A=object_height_mm, B=number_slider_125)
explode_2 = Explode(Curve=move_6.Geometry, Recursive=True)  # -> Segments, Vertices; disabled
point_6 = Point(platform_centre)
explode_3 = Explode(Curve=polygon.Polygon, Recursive=True)  # -> Segments, Vertices; disabled
shift_list_3 = ShiftList(Shift=1, Wrap=True)  # disabled
point_7 = Point("0,0,0")
polyline_5 = PolyLine(Vertices=construct_point_31, Closed=False)
rotate_7 = Rotate(Geometry=move_4.Geometry, Angle=remap_numbers_6.Mapped, Plane=xy_plane_5)  # -> Geometry, Transform; disabled
bounds_7 = Bounds(Numbers=curve_closest_point_3.Distance)  # disabled
construct_domain_22 = ConstructDomain(DomainStart=number_slider_127, DomainEnd=number_slider_126)  # disabled
number_slider_128 = Slider(-5, range=-5..5)  # disabled
x_3 = Panel(division_10)
subtraction_7 = Subtraction(A=point_6, B=point_7)
x_4 = Panel("-1")  # disabled
x_5 = Panel("-1")  # disabled
number_slider_129 = Slider(0.41, range=0..10)  # disabled
remap_numbers_7 = RemapNumbers(Value=deconstruct.ZComponent, Source=bounds_6, Target=construct_domain_21)  # -> Mapped, Clipped; disabled
number_slider_130 = Slider(0.41, range=0..10)  # disabled
integer_2 = Integer(x_3)
cull_index_2 = CullIndex(List=explode_2.Vertices, Indices=x_4, Wrap=True)  # disabled
cull_index_3 = CullIndex(List=explode_3.Vertices, Indices=x_5, Wrap=True)  # disabled
series_30 = Series(Start=number_slider_125, Step=number_slider_125, Count=integer_2)
move_7 = Move(Geometry=polyline_5, Motion=subtraction_7)  # -> Geometry, Transform
remap_numbers_8 = RemapNumbers(Value=curve_closest_point_3.Distance, Source=bounds_7, Target=construct_domain_22)  # -> Mapped, Clipped; disabled
panel_161 = Panel(integer_2)
point_8 = Point(<point referenced from the Rhino model>)  # disabled
shift_list_4 = ShiftList(List=cull_index_2, Shift=number_slider_128, Wrap=True)  # disabled
point_list_4 = PointList(Points=cull_index_3, Size=number_slider_129)  # disabled
distance_6 = Distance(PointA=point_8, PointB=move_5.Geometry)  # disabled
point_list_5 = PointList(Points=shift_list_4, Size=number_slider_130)  # disabled
scale_nu = ScaleNU(Geometry=rotate_7.Geometry, Plane=move_5.Geometry, ScaleX=1, ScaleY=remap_numbers_7.Mapped, ScaleZ=1)  # -> Geometry, Transform; disabled
range_15 = Range(Domain=Domain(0, 1), Steps=expr("x-1", integer_2))
scale = Scale(Geometry=move_7.Geometry, Center=point_6, Factor=Slider(32.8, range=0..100))  # -> Geometry, Transform
line_9 = Line(StartPoint=cull_index_3, EndPoint=shift_list_4)  # disabled
z_2 = UnitZ(Factor=series_30)
panel_162 = Panel(cull_index_2)  # disabled
circle_cnr_9 = CircleCNR(Center=construct_point_30, Normal=xz_plane_2, Radius=remap_numbers_8.Mapped)  # disabled
bounds_8 = Bounds(Numbers=distance_6)  # disabled
boolean_toggle_6 = BooleanToggle(False)  # disabled
graph_mapper = GraphMapper(
    range_15,
    x0=0,
    x1=1,
    y0=0,
    y1=1,
    amplitude=0.3,
    container_name="Perlin",
    decay=0.3,
    frequency=0.1,
    x_offset=0.5,
    y_offset=0.5)
move_8 = Move(Geometry=scale.Geometry, Motion=z_2)  # -> Geometry, Transform
deconstruct_domain = DeconstructDomain(Domain=bounds_8)  # -> Start, End; disabled
move_9 = Move(Geometry=platform_centre, Motion=z_2)  # -> Geometry, Transform
panel_163 = Panel(shift_list_4)  # disabled
xy_plane_6 = XYPlane(Origin=platform_centre)
series_31 = Series(Start="0", Step=Slider(-0.077, range=-3.142..3.142), Count=integer_2)
merge = Merge(Data1=scale.Geometry, Data2=move_8.Geometry)  # disabled
polyline_6 = PolyLine(Vertices=cull_index_3, Closed=boolean_toggle_6)  # disabled
construct_domain_23 = ConstructDomain(DomainStart=Slider(1.23, range=0..10), DomainEnd=Slider(0.45, range=0..1))
gradient_2 = Gradient(
    LowerLimit=deconstruct_domain.Start,
    UpperLimit=deconstruct_domain.End,
    Parameter=distance_6,
    stops=[0: RGB(234, 38, 0), 0.25: RGB(234, 126, 0), 0.5: RGB(255, 238, 0), 0.75: RGB(172, 250, 176), 1: RGB(75, 107, 169)])  # disabled
explode_4 = Explode(Curve=merge, Recursive=True)  # -> Segments, Vertices; disabled
rotate_8 = Rotate(Geometry=move_8.Geometry, Angle=series_31, Plane=xy_plane_6)  # -> Geometry, Transform
remap_numbers_9 = RemapNumbers(Value=graph_mapper, Source="0 to 1", Target=construct_domain_23)  # -> Mapped, Clipped
polyline_7 = PolyLine(Vertices=flatten(explode_4.Vertices), Closed=False)  # disabled
custom_preview_2 = CustomPreview(Geometry=scale_nu.Geometry, Shader=gradient_2)  # disabled
scale_nu_2 = ScaleNU(
    Geometry=rotate_8.Geometry,
    Plane=move_9.Geometry,
    ScaleX=remap_numbers_9.Mapped,
    ScaleY=remap_numbers_9.Mapped,
    ScaleZ=1)  # -> Geometry, Transform
