# Grasshopper definition 2017 11 28 - MAS Meshes.gh (Grasshopper 0.9.76)
# plug-ins: MeshEdit Components, Weaverbird

# Construct a mesh cube from scratch
panel = Panel(" ")
# Meshes: Grid of points + faces
# Points = basic elements of mesh surface
# Face = closed polygon passing through these points. The points are connected with straight lines
# The composite of the faces results on the mesh surface
# 
# position (geometry) and connectivity (topology) of the points
# 
# meshes are easier to compute. Vertices and faces can have different colors which are great features for analytical tools
# Construct a mesh square from scratch
panel_2 = Panel(" ")
# Randomized Mesh
panel_3 = Panel(" ")
panel_4 = Panel(" ")
# Construct a mesh from a grid of points
panel_6 = Panel(" ")
# Construct a mesh from a 3d grid of points
panel_8 = Panel(" ")

number_slider = Slider(2.55, range=0..10)
# Geometry
construct_point = ConstructPoint(XCoordinate="0", YCoordinate="0", ZCoordinate="0")
construct_point_2 = ConstructPoint(XCoordinate=number_slider, YCoordinate="0", ZCoordinate="0")
construct_point_3 = ConstructPoint(XCoordinate="0", YCoordinate=number_slider, ZCoordinate="0")
construct_point_4 = ConstructPoint(XCoordinate=number_slider, YCoordinate=number_slider, ZCoordinate="0")
construct_point_5 = ConstructPoint(XCoordinate="0", YCoordinate="0", ZCoordinate=number_slider)
construct_point_6 = ConstructPoint(XCoordinate=number_slider, YCoordinate="0", ZCoordinate=number_slider)
construct_point_7 = ConstructPoint(XCoordinate="0", YCoordinate=number_slider, ZCoordinate=number_slider)
construct_point_8 = ConstructPoint(XCoordinate=number_slider, YCoordinate=number_slider, ZCoordinate=number_slider)
merge = Merge(
    Data1=construct_point,
    Data2=construct_point_2,
    Data3=construct_point_3,
    Data4=construct_point_4,
    Data5=construct_point_5,
    Data6=construct_point_6,
    Data7=construct_point_7,
    Data8=construct_point_8)

number_of_floors = Slider(17, range=0..100)
tower_radius = Slider(30.394, range=0..150)
tower_radius_2 = Slider(21.222, range=0..150)
floor_height = Slider(3.84, range=0..5)
number_of_ribbons = Slider(17, range=0..100)
number_slider_2 = Slider(63, range=0..100)
number_slider_3 = Slider(60, range=0..100)

number_slider_4 = Slider(2.55, range=0..10)
# Geometry
x = Panel("0")
construct_point_9 = ConstructPoint(XCoordinate=x, YCoordinate=x, ZCoordinate=x)
construct_point_10 = ConstructPoint(XCoordinate=number_slider_4, YCoordinate=x, ZCoordinate=x)
construct_point_11 = ConstructPoint(XCoordinate=x, YCoordinate=number_slider_4, ZCoordinate=x)
construct_point_12 = ConstructPoint(XCoordinate=number_slider_4, YCoordinate=number_slider_4, ZCoordinate=x)
merge_2 = Merge(Data1=construct_point_9, Data2=construct_point_10, Data3=construct_point_11, Data4=construct_point_12)

number_slider_5 = Slider(16, range=0..64)
number_slider_6 = Slider(12, range=0..64)
# list management
number_slider_7 = Slider(10, range=0..100)  # disabled

# ---- group: 3d grid of points
number_slider_8 = Slider(2.35, range=0..10)
number_slider_9 = Slider(6, range=0..10)
number_slider_10 = Slider(3, range=0..10)
number_slider_11 = Slider(4, range=0..10)
square = Square(Plane=PlaneXY(0, 0, 0), Size=number_slider_8, ExtentX=number_slider_9, ExtentY=number_slider_10)  # -> Cells, flatten(Points)
series = Series(Start="0", Step=number_slider_8, Count=number_slider_11)
unit_z = UnitZ(Factor=series)  # -> graft(UnitVector)
move = Move(Geometry=square.Points, Motion=unit_z)  # -> flatten(Geometry), Transform

# ----
number_slider_12 = Slider(1, range=0..1)  # disabled
number_slider_13 = Slider(10, range=0..10)  # disabled

# ----
# (c) Andrei Jipa 2014 @ JAM.design
# Mihail-Andrei Jipa
# RIBA II, MArch (distinction);
# parametric design and digital manufacturing consultant
# www.jam-d.com
# ma.jipa@yahoo.com
# Project Name:
# File Name:
# Date:
# Version:
# 
# Revisions:
x_2 = Panel("0")  # disabled
# list management: item shifting
construct_point_13 = ConstructPoint(XCoordinate=x_2, YCoordinate=x_2, ZCoordinate=x_2)  # disabled
x_3 = Panel(construct_point_13)  # disabled
x_4 = Panel("0,0,0")  # disabled

number_of_floors_2 = Slider(16, range=0..100)
tower_radius_3 = Slider(6.393, range=0..10)
floor_height_2 = Slider(1.81, range=0..5)
number_of_ribbons_2 = Slider(12, range=0..100)
# 3 Methods of creating Point Grids
x_5 = Panel("0")
square_2 = Square(Plane=PlaneXY(0, 0, 0), Size=1, ExtentX=number_slider_2, ExtentY=number_slider_3)  # -> Cells, flatten(Points)
range = Range(Domain=Domain(0, 1), Steps=expr("x-1", number_of_floors))

# ---- group: TOPOLOGY in YZ
addition = Addition(A=number_slider_10, B="1")
addition_2 = Addition(A=number_slider_9, B="1")
x_6 = Multiplication(A=addition_2, B=addition)
series_2 = Series(Start="0", Step=addition, Count=expr("x+1", number_slider_9))
series_3 = Series(Start=series_2, Step=x_6, Count=expr("x-1", number_slider_11))
series_4 = Series(Start=series_3, Step="1", Count=number_slider_10)
addition_3 = Addition(A=series_4, B="1")
addition_4 = Addition(A=series_4, B=x_6)
addition_5 = Addition(A=addition_3, B=x_6)
mesh_quad = MeshQuad(CornerA=series_4, CornerB=addition_3, CornerC=addition_5, CornerD=addition_4)  # -> flatten(Face)

# ----
number_slider_14 = Slider(15, range=0..100)  # disabled
series_5 = Series(Start="0", Step="1", Count=Slider(16, range=0..100))
series_6 = Series(Start=x_5, Step="1", Count=Slider(12, range=0..100))
number_slider_15 = Slider(4.35, range=0..10)  # disabled
series_7 = Series(Start=number_slider_7, Step=number_slider_12, Count=number_slider_13)  # disabled
number_slider_16 = Slider(5.71, range=0..10)  # disabled
# DATA TREES
x_7 = Panel("0")
series_8 = Series(Start="0", Step="1", Count=Slider(16, range=0..100))  # -> graft(Series)
series_9 = Series(Start="0", Step="1", Count=Slider(12, range=0..100))
square_3 = Square(Plane=PlaneXY(0, 0, 0), Size=1, ExtentX=Slider(11, range=0..100), ExtentY=Slider(15, range=0..100))  # -> Cells, Points

# ---- group: Generate floor plates
series_10 = Series(Start=0, Step=floor_height_2, Count=number_of_floors_2)
unit_z_2 = UnitZ(Factor=series_10)
circle_cnr = CircleCNR(Center="0,0,0", Normal=Vector(0, 0, 1), Radius=tower_radius_3)
move_2 = Move(Geometry=circle_cnr, Motion=unit_z_2)  # -> Geometry, Transform

# ----
triangle_size = Slider(0.89, range=0..1)
x_8 = Multiplication(A=number_of_ribbons_2, B="3")
# Point grids (as lists / trees)
square_4 = Square(Plane=PlaneXY(0, 0, 0), Size=Slider(1, range=0..1), ExtentX=number_slider_6, ExtentY=number_slider_5)  # -> Cells, Points
cross_reference = CrossReference(ListListA=series_6, ListListB=series_5, CrossMode=1)  # -> ListListA, ListListB
series_11 = Series(Start="0", Step="1", Count=number_slider_5)

# ---- group: TOPOLOGY
# Use point list to create topology using series of whole numbers (indices)
addition_6 = Addition(A=number_slider_3, B="1")
series_12 = Series(Start="0", Step=addition_6, Count=number_slider_2)
series_13 = Series(Start=series_12, Step="1", Count=number_slider_3)  # -> simplify(Series)
addition_7 = Addition(A=series_13, B="1")
addition_8 = Addition(A=addition_7, B=addition_6)
addition_9 = Addition(A=series_13, B=addition_6)
mesh_quad_2 = MeshQuad(CornerA=series_13, CornerB=addition_7, CornerC=addition_8, CornerD=addition_9)

# ----
series_14 = Series(Start=x_7, Step="1", Count=number_slider_6)
graph_mapper = GraphMapper(range, x0=0, x1=1, y0=0, y1=1, container_name="Parabola", Ox=0.2788408697, Oy=0.4660255313, Px=1, Py=0.3191307187)
height = Slider(0.19, range=0..10)
range_2 = Range(Domain=Domain(0, 1), Steps=expr("x-1", number_of_floors_2))
x_9 = Panel("0,0,0")  # disabled
# Angle attractor
number_slider_17 = Slider(2, range=0..10)
construct_point_14 = ConstructPoint(XCoordinate=series_9, YCoordinate=series_8, ZCoordinate=0)
circle_cnr_2 = CircleCNR(Center=x_9, Normal=Vector(0, 0, 1), Radius=number_slider_15)  # disabled
circle_cnr_3 = CircleCNR(Center=x_4, Normal=Vector(0, 0, 1), Radius=number_slider_16)  # disabled
panel_9 = Panel("-1")
number_slider_18 = Slider(1, range=0..1)
cross_reference_2 = CrossReference(ListListA=series_14, ListListB=series_11, CrossMode=1)  # -> ListListA, ListListB
list_item = ListItem(List=square_4.Points, Index=Slider(8, range=0..29), Wrap=True)

# ---- group: triangular grid
number_slider_19 = Slider(61, range=0..100)
number_slider_20 = Slider(10, range=0..10)
x_10 = Multiplication(A=number_slider_19, B=number_slider_20)
triangular = Triangular(Plane=PlaneXY(0, 0, 0), Size=triangle_size, ExtentX=number_slider_19, ExtentY=number_slider_20)  # -> Cells, Points

# ----
point_list = PointList(Points=square_4.Points, Size=Slider(0.3, range=0..10))
curve_attractor_import_from_rhino = Curve(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)
number_slider_21 = Slider(1, range=0..1)
construct_point_15 = ConstructPoint(XCoordinate=cross_reference.ListListA, YCoordinate=cross_reference.ListListB, ZCoordinate=0)
number_slider_22 = Slider(0, range=-20..20)  # disabled
graph_mapper_2 = GraphMapper(range_2, x0=0, x1=1, y0=0, y1=1, container_name="Parabola", Ox=0.4243478179, Oy=0.9915930629, Px=1, Py=0.3191307187)
number_slider_23 = Slider(0.68, range=0..10)  # disabled
number_slider_24 = Slider(0.39, range=0..10)  # disabled
flip_matrix = FlipMatrix()
point = Point(square_3.Points)
boolean_toggle = BooleanToggle(False)  # disabled

# ----
# TOPOLOGY
x_11 = Panel("0")
mesh_quad_3 = MeshQuad(CornerA=x_11, CornerB="1", CornerC="3", CornerD="2")
x_12 = Panel("{0,1,3,2}")

divide_curve = DivideCurve(Curve=circle_cnr_2, Count=number_slider_14, Kinks=False)  # -> Points, Tangents, Parameters; disabled
divide_curve_2 = DivideCurve(Curve=circle_cnr_3, Count=number_slider_14, Kinks=False)  # -> Points, Tangents, Parameters; disabled
point_2 = Point(simplify(square_4.Points))
construct_point_16 = ConstructPoint(XCoordinate=cross_reference_2.ListListA, YCoordinate=cross_reference_2.ListListB, ZCoordinate=0)

# ---- group: a series for shift values
series_15 = Series(Start="0", Step=Slider(0.11, range=0..1), Count=number_of_floors)

# ----
# Use attractor to change the geometry of the mesh
curve_closest_point = CurveClosestPoint(Point=square_2.Points, Curve=curve_attractor_import_from_rhino)  # -> Point, Parameter, Distance
panel_10 = Panel(square_3.Points)
number_slider_25 = Slider(5, range=0..10)  # disabled
number_slider_26 = Slider(14.5, range=0..100)  # disabled

# ---- group: TOPOLOGY in XY
addition_10 = Addition(A=number_slider_10, B="1")
addition_11 = Addition(A=number_slider_9, B="1")
x_13 = Multiplication(A=addition_11, B=addition_10)
series_16 = Series(Start="0", Step=x_13, Count=number_slider_11)
addition_12 = Addition(A=number_slider_10, B="1")
series_17 = Series(Start=series_16, Step=addition_12, Count=number_slider_9)  # -> simplify(Series)
series_18 = Series(Start=series_17, Step="1", Count=number_slider_10)  # -> simplify(Series)
addition_13 = Addition(A=series_18, B="1")
addition_14 = Addition(A=addition_13, B=addition_12)
addition_15 = Addition(A=series_18, B=addition_12)
mesh_quad_4 = MeshQuad(CornerA=series_18, CornerB=addition_13, CornerC=addition_14, CornerD=addition_15)  # -> flatten(Face)

# ----
subtraction = Subtraction(A=number_of_floors, B=Slider(0, range=0..100))
point_3 = Point(square_4.Points)
# Original Tree
point_4 = Point(point_3)
panel_11 = Panel(point_4)
panel_12 = Panel(point_3)
point_5 = Point(simplify(point_3))
path_mapper = PathMapper(point_5, source="{A}(i)", target="{A}(i*2)")
panel_13 = Panel(point_5)
path_mapper_2 = PathMapper(point_4, source="{A;B;C}(i)", target="{A;B;C;i}")
# Path Mapper
path_mapper_3 = PathMapper(point_3, source="{A;B;C}", target="{C*2}")
point_6 = Point(graft(point_3))
path_mapper_4 = PathMapper(point_3, source="{A;B;C}", target="{C;C;C}")
param_viewer = ParamViewer(path_mapper)
# SIMPLIFIED TREE
panel_14 = Panel(point_5)
list_item_2 = ListItem(List=point_6, Index=Slider(3, range=0..29), Wrap=True)
point_list_2 = PointList(Points=point_6, Size=Slider(0.3, range=0..10))
point_7 = Point(flatten(point_3))
panel_15 = Panel(path_mapper_4)
panel_16 = Panel(path_mapper_2)
panel_17 = Panel(point_6)

# ---- group: Attractor
md_slider = MDSlider(
    slider_value=Point(0.8157708961, 0.6755311547, 0.5),
    SliderMode=0,
    x_domain=Domain(0, 1),
    y_domain=Domain(0, 1),
    z_domain=Domain(0, 1))
bounding_box = BoundingBox(Content=flatten(triangular.Cells), Plane=PlaneXY(0, 0, 0), UnionBox=True)  # -> Box, Box_2
# Geometry of compomnent
evaluate_surface = EvaluateSurface(Surface=reparameterize(bounding_box.Box), Point=md_slider)  # -> Point, Normal, Frame

# ----
point_list_3 = PointList(Points=point_2, Size=Slider(0.3, range=0..10))
list_item_3 = ListItem(List=point_2, Index=Slider(3, range=0..29), Wrap=True)
panel_18 = Panel(path_mapper_3)
panel_19 = Panel(point_2)
number_slider_27 = Slider(9, range=0..20)  # disabled
point_list_4 = PointList(Points=square_2.Points, Size=number_slider_24)  # disabled
# FLATTENED TREE
panel_20 = Panel(path_mapper)
shift_list = ShiftList(List=divide_curve.Points, Shift=number_slider_22, Wrap=boolean_toggle)  # disabled
point_list_5 = PointList(Points=divide_curve_2.Points, Size=number_slider_23)  # disabled
boolean_toggle_2 = BooleanToggle(False)  # disabled
series_19 = Series(Start=number_of_floors, Step=number_of_floors, Count=expr("X-1", number_of_floors))  # -> simplify(Series)
series_20 = Series(Start=series_19, Step=number_slider_18, Count=number_of_floors)  # -> simplify(Series)
point_list_6 = PointList(Points=construct_point_16, Size=Slider(0.3, range=0..10))
list_item_4 = ListItem(List=construct_point_16, Index=Slider(14, range=0..29), Wrap=True)
scale = Scale(Geometry=move_2.Geometry, Center=move_2.Geometry, Factor=graph_mapper_2)  # -> Geometry, Transform
x_14 = Panel("1")  # disabled
x_15 = Panel("14")  # disabled
panel_21 = Panel(point_7)
x_16 = Panel("0")  # disabled
# Scale floors to size based on graph mapper
number_slider_28 = Slider(0.67, range=0..10)

# ---- group: a series for shift values
series_21 = Series(Start="0", Step=1, Count=number_of_floors_2)

# ----
panel_22 = Panel(series_7)  # disabled
# Notice differenes in outputs
panel_23 = Panel(construct_point_15)
panel_24 = Panel(construct_point_14)
bounds = Bounds(Numbers=curve_closest_point.Distance)
shift_list_2 = ShiftList(List=series_20, Shift=number_slider_18, Wrap=True)
x_17 = Panel("2")  # disabled
x_18 = Panel("1")  # disabled
x_19 = Panel("15")  # disabled
point_list_7 = PointList(Points=shift_list, Size=number_slider_23)  # disabled
original_list = Panel(divide_curve.Points)  # disabled
param_viewer_2 = ParamViewer(path_mapper_3)
panel_25 = Panel(list_item_3)
panel_26 = Panel(construct_point_16)
# Param viewer
panel_27 = Panel(point_3)
path_mapper_5 = PathMapper(panel_15, source="{A;B;C}", target="{5;2}")
construct_mesh = ConstructMesh(Vertices=merge_2, Faces=mesh_quad_3)
x_20 = Panel("8")  # disabled
x_21 = Panel("7")  # disabled
x_22 = Panel("21")  # disabled
list_length = ListLength(List=series_7)  # disabled
insert_items = InsertItems(List=series_7, Item=number_slider_26, Indices=number_slider_25, Wrap=True)  # disabled
replace_items = ReplaceItems(List=series_7, Item=number_slider_26, Indices=number_slider_25, Wrap=False)  # disabled
reverse_list = ReverseList(List=series_7)  # disabled

series_22 = Series(Start="0", Step="1", Count=x_8)
series_23 = Series(Start=series_22, Step=x_8, Count=expr("x-1", number_of_floors_2))  # -> simplify(Series)
# Mesh topology
flip_matrix_2 = FlipMatrix(Data=series_23)
shift_list_3 = ShiftList(List=flip_matrix_2, Shift=1, Wrap=True)
addition_16 = Addition(A=flip_matrix_2, B=x_8)
addition_17 = Addition(A=shift_list_3, B=x_8)
# 1 x quad
mesh_quad_5 = MeshQuad(CornerA=0, CornerB=1, CornerC=2, CornerD=addition_16)
mesh_triangle = MeshTriangle(CornerA=flip_matrix_2, CornerB=addition_17, CornerC=addition_16)
# 2 x triangles
mesh_triangle_2 = MeshTriangle(CornerA=flip_matrix_2, CornerB=shift_list_3, CornerC=addition_17)

list_item_5 = ListItem(List=series_7, Index=number_slider_27, Wrap=boolean_toggle_2)  # disabled
# Mesh topology
subtraction_2 = Subtraction(A=shift_list_2, B=number_of_floors)

series_24 = Series(Start="0", Step="1", Count=number_of_floors)
series_25 = Series(Start=series_24, Step=number_of_floors, Count=expr("X-1", number_of_floors))  # -> simplify(Series)
flip_matrix_3 = FlipMatrix(Data=series_25)
addition_18 = Addition(A=flip_matrix_3, B=subtraction)
shift_list_4 = ShiftList(List=flip_matrix_3, Shift=1, Wrap=True)
mesh_triangle_3 = MeshTriangle(CornerA=series_20, CornerB=shift_list_2, CornerC=subtraction_2)
mesh_triangle_4 = MeshTriangle(CornerA=flip_matrix_3, CornerB=shift_list_4, CornerC=addition_18)

divide_curve_3 = DivideCurve(Curve=scale.Geometry, Count=x_8, Kinks=False)  # -> Points, Tangents, Parameters
# GRAFTED TREE
point_8 = Point(graft(point_3))
remap_numbers = RemapNumbers(Value=curve_closest_point.Distance, Source=bounds, Target="0 to 1")  # -> Mapped, Clipped
point_list_8 = PointList(Points=merge_2, Size=number_slider_28)
x_23 = Panel("7")  # disabled
x_24 = Panel("6")  # disabled
x_25 = Panel("20")  # disabled
point_9 = Point(flatten(panel_15))
panel_28 = Panel(list_item_5)  # disabled
panel_29 = Panel(list_length)  # disabled

# ----
# TOPOLOGY
x_26 = Panel("3")
x_27 = Panel("""{1,3,7,5}
{3,2,6,7}
{4,5,7,6}
{0,2,6,4}""")
mesh_quad_6 = MeshQuad(CornerA="0", CornerB="1", CornerC=x_26, CornerD="2")

panel_30 = Panel(insert_items)  # disabled
addition_19 = Addition(A=shift_list_4, B=subtraction)
param_viewer_3 = ParamViewer(construct_point_16)
panel_31 = Panel(point_8)
panel_32 = Panel(path_mapper_5)
shifted_list = Panel(shift_list)  # disabled
panel_33 = Panel(point_9)
mesh_quad_7 = MeshQuad(CornerA=[x_16, x_14, x_15], CornerB=[x_18, x_17, x_19], CornerC=[x_21, x_20, x_22], CornerD=[x_24, x_23, x_25])  # disabled
graph_mapper_3 = GraphMapper(
    remap_numbers.Mapped,
    x0=0,
    x1=1,
    y0=0,
    y1=1,
    container_name="Bezier",
    cpx=[0, 0.5611510873, 0.3597122431, 1],
    cpy=[0, 0, 1, 1])
point_list_9 = PointList(Points=move.Geometry, Size=Slider(0.39, range=0..10))

# ---- group: Counter-clockwise trusses
shift_list_5 = ShiftList(List=divide_curve_3.Points, Shift=graft(series_21), Wrap=True)
flip_matrix_4 = FlipMatrix(Data=shift_list_5)
interpolate = Interpolate(Vertices=flip_matrix_4, Degree=3, Periodic=False, KnotStyle=1)  # -> Curve, Length, Domain

# ---- group: Clock-wise trusses
negative = Negative(Value=series_21)
shift_list_6 = ShiftList(List=divide_curve_3.Points, Shift=graft(negative), Wrap=True)
flip_matrix_5 = FlipMatrix(Data=shift_list_6)
interpolate_2 = Interpolate(Vertices=flip_matrix_5, Degree=3, Periodic=False, KnotStyle=1)  # -> Curve, Length, Domain

# ----
panel_34 = Panel(replace_items)  # disabled
panel_35 = Panel(reverse_list)  # disabled

# ---- group: compute and remap distances to attractor
distance = Distance(PointA=triangular.Points, PointB=evaluate_surface.Point)
construct_domain = ConstructDomain(DomainStart=Slider(1.06, range=-3.14..3.14), DomainEnd=Slider(-0.4, range=-3.14..3.14))
bounds_2 = Bounds(Numbers=flatten(distance))
remap_numbers_2 = RemapNumbers(Value=distance, Source=bounds_2, Target=construct_domain)  # -> Mapped, Clipped

# ----
shift_list_7 = ShiftList(List=shift_list_4, Shift="-2", Wrap=True)
addition_20 = Addition(A=addition_19, B="-2")
construct_mesh_2 = ConstructMesh(Vertices=square_2.Points, Faces=mesh_quad_7)  # disabled
duplicate_data = DuplicateData(Data=panel_27, Number=Slider(1, range=0..100), Order=True)  # -> simplify(Data)
remap_numbers_3 = RemapNumbers(Value=graph_mapper_3, Source="0 to 1", Target=" 0 to 25")  # -> Mapped, Clipped
shift_list_8 = ShiftList(List=divide_curve_3.Points, Shift=graft(series_21), Wrap=True)  # -> flatten(List)
point_list_10 = PointList(Points=merge, Size=Slider(0.67, range=0..10))
point_list_11 = PointList(Points=shift_list_8, Size=Slider(0.3, range=0..10))
# Map a colour gradient on the mesh
x_29 = Panel("0")
unit_z_3 = UnitZ(Factor=remap_numbers_3.Mapped)
colour_picker = ColourPicker(PickedColour=RGB(204, 204, 204))
colour_picker_2 = ColourPicker(PickedColour=RGB(0, 51, 255))
construct_mesh_3 = ConstructMesh(Vertices=merge, Faces=[mesh_quad_6, "{0,1,5,4}", x_27])
gradient = Gradient(
    LowerLimit=x_29,
    UpperLimit="1",
    Parameter=graph_mapper_3,
    stops=[0: RGB(243, 57, 0), 0.1: RGB(236, 27, 60), 0.2: RGB(210, 0, 118), 0.3: RGB(103, 0, 120), 0.4: RGB(39, 72, 161), 0.5: RGB(1, 192, 229), 0.6: RGB(18, 178, 90), 0.7: RGB(79, 186, 8), 0.8: RGB(220, 237, 32), 0.9: RGB(247, 159, 20), 1: RGB(243, 57, 0)])
number_slider_29 = Slider(1.5, range=0..3)
move_3 = Move(Geometry=square_2.Points, Motion=unit_z_3)  # -> Geometry, Transform

# ---- group: ORBITAL Attractor
circle_cnr_4 = CircleCNR(Center="0,0,0", Normal=Vector(0, 0, 1), Radius=Slider(84, range=0..1000))
yz_plane = YZPlane(Origin=Point(0, 0, 0))
rotate = Rotate(Geometry=circle_cnr_4, Angle=Slider(1.22, range=-1.57..1.57), Plane=yz_plane)  # -> Geometry, Transform
point_on_curve = PointOnCurve(rotate.Geometry, parameter=0.371)

# ----
series_26 = Series(Start=Slider(0, range=0..100), Step=number_slider_29, Count=Slider(32, range=0..100))
merge_3 = Merge(Data1=colour_picker_2, Data2=colour_picker, Data3=colour_picker)  # -> simplify(graft(Result))
# Construct a mesh from a grid of points
construct_mesh_4 = ConstructMesh(Vertices=square_2.Points, Faces=mesh_quad_2)
construct_mesh_5 = ConstructMesh(Vertices=move_3.Geometry, Faces=mesh_quad_2, Colours=gradient)
flip_matrix_6 = FlipMatrix(Data=[mesh_triangle_2, mesh_triangle])
multiplication = Multiplication(A=number_of_ribbons_2, B=Slider(2, range=0..10))

# ---- group: 3d grid of points
number_slider_30 = Slider(2.35, range=0..10)
series_27 = Series(Start="0", Step=number_slider_30, Count=Slider(4, range=0..10))
unit_z_4 = UnitZ(Factor=series_27)  # -> simplify(graft(UnitVector))
square_5 = Square(Plane=PlaneXY(0, 0, 0), Size=number_slider_30, ExtentX=Slider(6, range=0..10), ExtentY=Slider(3, range=0..10))  # -> Cells, simplify(Points)

# ----
# trusses
pipe = Pipe(Curve=[interpolate.Curve, interpolate_2.Curve], Radius=Slider(0.05, range=0..1), Caps=0)
construct_point_17 = ConstructPoint(XCoordinate=series_26, YCoordinate=0, ZCoordinate=0)
multiplication_2 = Multiplication(A=number_slider_29, B=Slider(0.45, range=0..1))
duplicate_data_2 = DuplicateData(Data=flatten(merge_3), Number=multiplication, Order=True)  # -> graft(Data)
panel_36 = Panel("""true
false""")
panel_37 = Panel("""1
0
1
0""")
panel_38 = Panel("""1
0""")
topology = Panel("""{0,1,4}
{0,4,3}
{0,3,6}
{0,6,2}
{0,2,5}
{0,5,1}""")
center_box = CenterBox(Base=construct_point_17, X=multiplication_2, Y=multiplication_2, Z=multiplication_2)
construct_mesh_6 = ConstructMesh(Vertices=move.Geometry, Faces=flatten([mesh_quad, mesh_quad_4]))
panel_39 = Panel(center_box)
height_2 = Slider(0.19, range=0..10)
# Mesh Component
bounds_3 = Bounds(Numbers=flatten(remap_numbers_2.Mapped))
dispatch = Dispatch(List=center_box, DispatchPattern=panel_38)  # -> ListA, ListB
cull_nth = CullNth(List=center_box, CullFrequency=Slider(5, range=0..10))
cull_pattern = CullPattern(List=center_box, CullPattern=panel_38)
xy_plane = XYPlane(Origin=unit_z_4)
mesh = Mesh(Vertices=shift_list_8, Faces=simplify(flip_matrix_6), Colours=duplicate_data_2)
cull_index = CullIndex(List=center_box, Indices=Slider(51, range=0..100), Wrap=Toggle(True))
list_item_6 = ListItem(List=center_box, Index=Slider(6, range=0..10), Wrap=True)
param_viewer_4 = ParamViewer(panel_39)
deconstruct_domain = DeconstructDomain(Domain=bounds_3)  # -> Start, End
data = Data(dispatch.ListA)
data_2 = Data(dispatch.ListB)
# More list management:
# Culling components and Dispatches
panel_40 = Panel(cull_index)
list_item_7 = ListItem(List=flatten(mesh), Index=0, Wrap=True)  # disabled
gradient_2 = Gradient(
    LowerLimit=deconstruct_domain.Start,
    UpperLimit=deconstruct_domain.End,
    Parameter=remap_numbers_2.Mapped,
    stops=[0: RGB(0, 128, 26), 0.5: RGB(0, 242, 255), 1: RGB(0, 64, 255)])
data_3 = Data(square_5.Points)
panel_41 = Panel("""{0}[+1]
{+1}[0]""")
point_list_12 = PointList(Points=data_3, Size=Slider(0.69, range=0..10))
item_index = ItemIndex(List=data_3, Item=data_3)
relative_item = RelativeItem(Tree=data_3, Offset=panel_41, WrapPaths=False, WrapItems=False)  # -> ItemA, ItemB
relative_item_2 = RelativeItem(Tree=data_3, Offset="{0;+1}[+1]", WrapPaths=False, WrapItems=False)  # -> ItemA, ItemB
relative_item_3 = RelativeItem(Tree=data_3, Offset="{0;+1}[0]", WrapPaths=False, WrapItems=False)  # -> ItemA, ItemB
panel_42 = Panel(item_index)
line = Line(StartPoint=relative_item.ItemA, EndPoint=relative_item.ItemB)  # -> flatten(Line)
panel_43 = Panel("{0,1,2,3}")
merge_4 = Merge(Data1=relative_item.ItemA, Data2=relative_item.ItemB, Data3=relative_item_2.ItemB, Data4=relative_item_3.ItemB)
polyline = PolyLine(Vertices=merge_4, Closed=False)
weaverbird_s_mesh_from_lines_weave_back = WeaverbirdsMeshFromLinesWeaveBack(Lines=line, MaximumValence=4)
panel_44 = Panel("0")
topology_2 = Panel("""{0,1,4}
{0,4,2}
{0,5,3}
{0,6,3}
{0,2,5}
{0,6,1}""")

mesh_sphere = MeshSphere(Base="0,0,0", Radius=10, UCount=Slider(16, range=0..100), VCount=Slider(24, range=0..100))
mcomp = Decompose(Mesh=mesh_sphere)  # -> Vertices, Faces, Colours, Normals
list_length_2 = ListLength(List=mcomp.Vertices)

random = Random(Range=Domain(0, 1), Number=list_length_2, Seed=2)
vector_2pt = Vector2Pt(PointA="0,0,0", PointB=mcomp.Vertices, Unitize=Toggle(True))  # -> Vector, Length

# ---- group: Generate floor plates
series_28 = Series(Start=0, Step=floor_height, Count=number_of_floors)
x_30 = Panel("0,0,0")
unit_z_5 = UnitZ(Factor=series_28)

# ----
ellipse = Ellipse(Plane=x_30, Radius1=tower_radius_2, Radius2=tower_radius)  # -> Ellipse, Focus1, Focus2
move_4 = Move(Geometry=x_30, Motion=unit_z_5)  # -> Geometry, Transform

# ---- group: Generate floor plates (continued)
move_5 = Move(Geometry=ellipse.Ellipse, Motion=unit_z_5)  # -> Geometry, Transform

# ----
scale_2 = Scale(Geometry=move_5.Geometry, Center=move_4.Geometry, Factor=graph_mapper)  # -> Geometry, Transform
point_on_curve_2 = PointOnCurve(scale_2.Geometry, parameter=0.5)
rotate_2 = Rotate(Geometry=scale_2.Geometry, Angle=series_15, Plane=point_on_curve_2)  # -> Geometry, Transform
divide_curve_4 = DivideCurve(Curve=rotate_2.Geometry, Count=number_of_floors, Kinks=False)  # -> flatten(Points), Tangents, Parameters
point_list_13 = PointList(Points=divide_curve_4.Points, Size=Slider(0.55, range=0..10))
mesh_2 = Mesh(Vertices=divide_curve_4.Points, Faces=simplify([mesh_triangle_4, mesh_triangle_3]))

# ---- group: compute angles
mesh_explode = MeshExplode(Mesh=mesh_2, Interpolate=False)  # -> graft(Faces)
graft_tree = GraftTree(Tree=flatten(mesh_explode), IncludeEmptyLists=True, IncludeNullItems=True)  # -> simplify(Tree)
deconstruct_mesh = DeconstructMesh(Mesh=graft_tree)  # -> Vertices, Faces, Colours, Normals
average = Average(Input=deconstruct_mesh.Vertices)  # -> simplify(ArithmeticMean)
line_2 = Line(StartPoint=point_on_curve, EndPoint=average)
list_item_8 = ListItem(List=deconstruct_mesh.Vertices, Index="0", Wrap=True)
list_item_9 = ListItem(List=deconstruct_mesh.Vertices, Index="1", Wrap=True)
list_item_10 = ListItem(List=deconstruct_mesh.Vertices, Index="2", Wrap=True)
# Map components on triangular grid
plane_3pt = Plane3Pt(PointA=list_item_8, PointB=list_item_9, PointC=list_item_10)
project = Project(Geometry=line_2, Plane=plane_3pt)  # -> Geometry, Transform

# ----
cylinder = Cylinder(Base="0,0,0", Radius=0.5, Length=1)
weaverbird_s_join_meshes_and_weld = WeaverbirdsJoinMeshesAndWeld(Mesh=flatten(mesh_2), Weld=False)
unit_z_6 = UnitZ(Factor=1)
weaverbird_s_picture_frame = WeaverbirdsPictureFrame(MeshPolylines=weaverbird_s_join_meshes_and_weld, Distance=Slider(22, range=0..100), InsetType=0)
face_normals = FaceNormals(Mesh=weaverbird_s_join_meshes_and_weld)  # -> Centers, Normals
# Geometry of compomnent
orient_direction = OrientDirection(Geometry=cylinder, PointA="0,0,0", DirectionA=unit_z_6, PointB=face_normals.Centers, DirectionB=face_normals.Normals)  # -> Geometry, Transform
plane_normal = PlaneNormal(Origin=face_normals.Centers, ZAxis=face_normals.Normals)
cylinder_2 = Cylinder(Base=plane_normal, Radius=0.5, Length=1)

polyline_2 = PolyLine(Vertices=deconstruct_mesh.Vertices, Closed=Toggle(True))
face_normals_2 = FaceNormals(Mesh=graft_tree)  # -> Centers, Normals
unit_vector = UnitVector(Vector=face_normals_2.Normals)
x_31 = Multiplication(A=unit_vector, B=height_2)

# ---- group: Remap Angles
angle = Angle(VectorA=project.Geometry, VectorB=line_2)  # -> Angle, Reflex
construct_domain_2 = ConstructDomain(DomainStart=Slider(0, range=-1.57..1.57), DomainEnd=Slider(1.2, range=-1.57..1.57))
bounds_4 = Bounds(Numbers=flatten(angle.Angle))
remap_numbers_4 = RemapNumbers(Value=angle.Angle, Source=bounds_4, Target=construct_domain_2)  # -> Mapped, Clipped

# ----
move_6 = Move(Geometry=average, Motion=x_31)  # -> Geometry, Transform
explode = Explode(Curve=polyline_2, Recursive=True)  # -> Segments, simplify(Vertices)
end_points = EndPoints(Curve=explode.Segments)  # -> Start, End
vector_2pt_2 = Vector2Pt(PointA=end_points.Start, PointB=end_points.End, Unitize=False)  # -> Vector, Length
point_on_curve_3 = PointOnCurve(explode.Segments, parameter=0.5)
rotate_3d = Rotate3D(
    Geometry=simplify(point_on_curve_3),
    Angle=simplify(graft(remap_numbers_4.Mapped)),
    Center=move_6.Geometry,
    Axis=vector_2pt_2.Vector)  # -> simplify(Geometry), Transform
merge_5 = Merge(Data1=simplify(move_6.Geometry), Data2=simplify(deconstruct_mesh.Vertices), Data3=simplify(rotate_3d.Geometry))

mesh_3 = Mesh(Vertices=merge_5, Faces=simplify(topology_2))
point_list_14 = PointList(Points=merge_5, Size=Slider(0.35, range=0..10))
mesh_explode_2 = MeshExplode(Mesh=mesh_3, Interpolate=False)  # disabled

# ----
# Triangle
polygon = Polygon(Plane="0,0,0", Radius=triangle_size, Segments="3", FilletRadius=0)  # -> Polygon, Length
unit_z_7 = UnitZ(Factor=height)
move_7 = Move(Geometry="0,0,0", Motion=unit_z_7)  # -> Geometry, Transform
explode_2 = Explode(Curve=polygon.Polygon, Recursive=True)  # -> Segments, Vertices
end_points_2 = EndPoints(Curve=explode_2.Segments)  # -> Start, End
point_on_curve_4 = PointOnCurve(explode_2.Segments, parameter=0.5)
vector_2pt_3 = Vector2Pt(PointA=end_points_2.Start, PointB=end_points_2.End, Unitize=False)  # -> Vector, Length
rotate_3d_2 = Rotate3D(
    Geometry=simplify(point_on_curve_4),
    Angle=simplify(graft(Slider(0.91, range=-3.14..3.14))),
    Center=move_7.Geometry,
    Axis=vector_2pt_3.Vector)  # -> simplify(Geometry), Transform

# ---- group: Generate Meshes for triangular grid
# Make colours
x_32 = Panel("0")
cull_index_2 = CullIndex(List=explode_2.Vertices, Indices=x_32, Wrap=True)
duplicate_data_3 = DuplicateData(Data=graft(cull_index_2), Number=x_10, Order=True)
rotate_3d_3 = Rotate3D(
    Geometry=simplify(point_on_curve_4),
    Angle=simplify(graft(remap_numbers_2.Mapped)),
    Center=move_7.Geometry,
    Axis=vector_2pt_3.Vector)  # -> simplify(Geometry), Transform
duplicate_data_4 = DuplicateData(Data=move_7.Geometry, Number=x_10, Order=True)  # -> graft(Data)
flip_matrix_7 = FlipMatrix(Data=duplicate_data_3)
merge_6 = Merge(Data1=simplify(duplicate_data_4), Data2=simplify(flip_matrix_7), Data3=simplify(rotate_3d_3.Geometry))
point_list_15 = PointList(Points=merge_6, Size=Slider(1.12, range=0..10))
mesh_4 = Mesh(Vertices=merge_6, Faces=simplify(topology))

# ----
merge_7 = Merge(
    Data1=simplify(flatten(move_7.Geometry)),
    Data2=simplify(flatten(cull_index_2)),
    Data3=simplify(flatten(rotate_3d_2.Geometry)))  # -> flatten(Result)

mesh_5 = Mesh(Vertices=merge_7, Faces=simplify(topology))
triangle_mapping = TriangleMapping(Geometry=mesh_4, Source=polygon.Polygon, Target=simplify(graft(triangular.Cells)))  # -> Geometry, Transform
custom_preview = CustomPreview(Geometry=simplify(triangle_mapping.Geometry), Shader=simplify(graft(gradient_2)))
weaverbird_s_mesh_edges = WeaverbirdsMeshEdges(MeshOrPolylines=triangle_mapping.Geometry)
custom_preview_2 = CustomPreview(Geometry=simplify(weaverbird_s_mesh_edges), Shader=simplify(graft(ColourSwatch(SwatchColor=RGB(0, 29, 97)))))

x_33 = Multiplication(A=random, B=Slider(1.5411, range=0..10))

x_34 = Multiplication(A=x_33, B=vector_2pt.Vector)

move_8 = Move(Geometry=mcomp.Vertices, Motion=x_34)  # -> Geometry, Transform
mesh_6 = Mesh(Vertices=move_8.Geometry, Faces=mcomp.Faces)
