# Grasshopper definition Millipede.gh (Grasshopper 0.9.76)
# plug-ins: Millipede, Weaverbird

boolean_toggle = BooleanToggle(True)
boolean_toggle_2 = BooleanToggle(False)
x = UnitX(Factor=1)
curve = Curve([<curve referenced from the Rhino model> x3])
curve_2 = Curve(<curve referenced from the Rhino model>)
support_type = SupportType(X=boolean_toggle, Y=boolean_toggle, Z=boolean_toggle_2, RX=boolean_toggle_2, RY=boolean_toggle_2, RZ=boolean_toggle)
curve_3 = Curve(<curve referenced from the Rhino model>)
negative = Negative(Value=x)
_2d_boundary_region = _2DBoundaryRegion(Boundary=curve_3, IsVoid=False)
_2d_support_region = _2DSupportRegion(Boundary=curve, SupportType=support_type, AmendExistingSupports=True, Displacement=Vector(0, 0, 0))
loadcase = LoadCase(SelfWeightFactor=1, Name="Load Case")
_2d_load_region = _2DLoadRegion(Boundary=curve_2, Load=negative)
geometry_pipeline = GeometryPipeline(
    GroupByLayer=False,
    GroupByType=False,
    IncludeHidden=True,
    IncludeLocked=True,
    LayerFilter="Mesh_Branch",
    NameFilter="*",
    TypeFilter=32)
geometry_pipeline_2 = GeometryPipeline(
    GroupByLayer=False,
    GroupByType=False,
    IncludeHidden=True,
    IncludeLocked=True,
    LayerFilter="Mesh_Field",
    NameFilter="*",
    TypeFilter=32)
topostruct_2d_model = Topostruct2DModel(ModelComponents=[_2d_boundary_region, _2d_load_region, _2d_support_region], XResolution=Slider(120, range=0..500))  # -> FEModel, CellCentres, CellSize
topopt_mesh = Mesh(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)
ribs = Mesh(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)
fields = Mesh([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])
deconstruct_mesh = DeconstructMesh(Mesh=ribs)  # -> Vertices, Faces, Colours, Normals

mesh_join = MeshJoin(Meshes=[ribs, fields])
# Remap the distance to the edges
# REMAP DISTANCE TO EDGES
weaverbird_s_naked_boundary = WeaverbirdsNakedBoundary(MeshClosedPolylines=mesh_join)
# - OR -
curve_closest_point = CurveClosestPoint(Point=deconstruct_mesh.Vertices, Curve=weaverbird_s_naked_boundary)  # -> Point, Parameter, Distance
bounds = Bounds(Numbers=curve_closest_point.Distance)
remap_numbers = RemapNumbers(Value=curve_closest_point.Distance, Source=bounds, Target="0 to 1")  # -> Mapped, Clipped
graph_mapper = GraphMapper(
    remap_numbers.Mapped,
    x0=0,
    x1=1,
    y0=0,
    y1=1,
    container_name="Bezier",
    cpx=[0, 0.752753675, 0.8362311721, 1],
    cpy=[0.00387263298, 0, 1, 1])
multiplication = Multiplication(A=Slider(100, range=0..100), B=graph_mapper)

topostruct_2d_solver = Topostruct2DSolver(
    FEModel=topostruct_2d_model.FEModel,
    SelfWeightCoefficient=0,
    OptimizationIterations=Slider(20, range=0..100),
    Smoothing=0.1,
    Penalization=3,
    TargetDensity=Slider(0.19, range=0..1),
    MinimumDensity=0.001,
    DeleteThreshold=0.5,
    PeriodicX=False,
    PeriodicY=False,
    LoadCase=0,
    AllCases=True,
    CompliantMechanism=False)  # -> FEModel, MaxDeflection

# ----
# Find Nearest "N" Vertices in the Grayscale Mesh
# Average out the grey values
# If N is too small, the final mesh will be noisy
deconstruct_mesh_2 = DeconstructMesh(Mesh=topopt_mesh)  # -> Vertices, Faces, Colours, Normals
N = Slider(50, range=0..100)
# REMAP COLOURS
closest_points = ClosestPoints(Cloud=deconstruct_mesh_2.Vertices, Count=N)  # -> ClosestPoint, CPIndex, Distance
list_item = ListItem(List=deconstruct_mesh_2.Colours, Index=closest_points.CPIndex, Wrap=True)
average = Average(Input=list_item)
# The colour remapping is computationally slow
split_argb = SplitARGB(Colour=average, IntegerChannels=True)  # -> Alpha, Red, Green, Blue

range = Range(Domain=Domain(0, 1), Steps=10)
_2d_mesh_results = _2DMeshResults(FEModel=topostruct_2d_solver.FEModel, Deflection=0, ColorMode=0)
_2d_iso_contour = _2DIsoContour(FEModel=topostruct_2d_solver.FEModel, Deflection=0, IsoContourValue=range)

# ----
# Transform the vertices of the mesh
unit_z = UnitZ(Factor=multiplication)
move = Move(Geometry=deconstruct_mesh.Vertices, Motion=unit_z)  # -> Geometry, Transform

# ----
# Reconstruct the mesh with same connectivity
construct_mesh = ConstructMesh(Vertices=move.Geometry, Faces=deconstruct_mesh.Faces)

# ----
# Construct the sides
mesh = Mesh(ribs)
mesh_edges = MeshEdges(Mesh=mesh)  # -> NakedEdges, InteriorEdges, NonManifoldEdges
mesh_edges_2 = MeshEdges(Mesh=construct_mesh)  # -> NakedEdges, InteriorEdges, NonManifoldEdges
data = Data(mesh_edges.NakedEdges)
data_2 = Data(mesh_edges_2.NakedEdges)
end_points = EndPoints(Curve=data)  # -> Start, End
end_points_2 = EndPoints(Curve=data_2)  # -> Start, End
merge = Merge(
    Data1=simplify(graft(end_points_2.Start)),
    Data2=simplify(graft(end_points_2.End)),
    Data3=simplify(graft(end_points.End)),
    Data4=simplify(graft(end_points.Start)))
construct_mesh_2 = ConstructMesh(Vertices=merge, Faces={A=0, B=1, C=2, D=3})

# ----
# Join and subdivide the mesh
mesh_join_2 = MeshJoin(Meshes=flatten([construct_mesh_2, construct_mesh, fields]))
weaverbird_s_catmull_clark_subdivision = WeaverbirdsCatmullClarkSubdivision(MeshCurves=mesh_join_2, Level=Slider(2, range=0..10), SmoothNakedEdges=Slider(0, range=0..100))
